# Grasshopper definition HB_Hygro_v0_0.gh (Grasshopper 1.0.8)
# plug-ins: LadybugGrasshopper

hygromat = HygrothermalOpaqueMaterial()  # -> out, mat; inputs sorption_w: list, sorption_rh: list, suction_w: list, suction_coeff: list, redist_w: list, redist_coeff: list, diff_rh: list, diff_resist: list, conductivity_w: list, conductivity: list
# ---------- hygromat: Python ----------
"""
Create a hygrothermal opaque material from a standard HB opaque material, which 
can be plugged into the "HB Opaque Construction" component. 
_
Note that all hygrothermal inputs are needed. Except for _porosity and _initial_w,
all hygrothermal inputs must be entered as a lists.
_ 
If you don't have enough data, use the standard "HB Opaque Material" instead. 
The HAMT model will only run on surfaces with constructions containing fully 
characterized hygrothermal properties. If all constructions are characterized, 
HAMT will be run for all surfaces.
_
Check MaterialProperty:HeatAndMoistureTransfer on EnergyPlus input-output documentation
for more information on the required inputs.
    Args:
        _mat: A standard HB opaque material object. For example, it can be the
        output of the "HB Opaque Material" component.
            
        _porosity: A number between 0 and 1 for the porosity. 
            _
            This is the maximum fraction, by volume, of a material that can be
            taken up with moisture. It is used to calculate the maximum point on 
            the sorption isotherm curve.
            
        _initial_w: A number for the initial water content ratio [kg/kg]
             _
             The initial water content is assumed to be distributed evenly through
             the depth of the material. Units are in kg of water per kg of dry material.
             
        _sorption_w: A list of moisture contents for the sorption isotherm [kg/m3]
            This list must have the same length as _sorption_rh.
            _
            Note that E+ automatically calculates the moisture content w at 
            0 and 100% relative humidity (rh), assigning 0 and maximum water 
            content based on porosity, respectively. However, these are overwritten 
            if new w are added to 0 and 100% rh. Following WUFI's recommendation, 
            it is more reasonable to overwrite w(rh=100%) with the free saturation 
            water content (wf). Data should be provided with increasing rh and w 
            up to as high an rh as possible to provide a stable solution.
        _sorption_rh: A list of relative humidities between 0 and 1 for the 
            sorption isotherm [-].
            This list must have the same length as _sorption_w.
            
        _suction_w: A list of moisture contents for the liquid suction [kg/m3]
            This list must have the same length as _suction_coeff
            _
            At least a datapoint at w = 0 is needed. The liquid coefficient at 
            the highest entered w is used for all values above this threshold.
        _suction_coeff: A list of (moisture-dependent) suction coefficients for 
            the liquid suction [m2/s].
            This list must have the same length as _suction_w
            _
            At least a datapoint at w = 0 is needed. The liquid coefficient at 
            the highest entered w is used for all values above this threshold.
            These coefficients are used when the rain flag is set in the epw.
            
        _redist_w: A list of moisture contents for the liquid redistribution [kg/m3]
            This list must have the same length as _redist_coeff
            _
            At least a datapoint at w = 0 is needed. The liquid coefficient at 
            the highest entered w is used for all values above this threshold.
        _redist_coeff: A list of (moisture-dependent) redistribution coefficients 
            for the liquid redistribution [m2/s].
            This list must have the same length as _redist_w
             _
            At least a datapoint at w = 0 is needed. The liquid coefficient at 
            the highest entered w is used for all values above this threshold.
            These coefficients are used when the rain flag is NOT set in the epw.
            
        _diff_rh: A list of relative humidities between 0 and 1 for the vapor 
            diffusion resistance factors [-].
            This list must have the same length as _diff_resist.
            _
            At least a datapoint at rh = 0 is needed. The diffusion resistance 
            factor at the highest entered rh is used for all values above this threshold.
        _diff_resist: A list of (moisture-dependent) vapor diffusion resistance 
            factors [-].
            This list must have the same length as _diff_rh.
            _
            At least a datapoint at rh = 0 is needed. The diffusion resistance 
            factor at the highest entered rh is used for all values above this threshold.
            
        _conductivity_w: A list of moisture contents for the thermal conductivities [kg/m3]
            This list must have the same length as _conductivity.
            _
            At least a datapoint at w = 0 is needed (dry thermal conductivity). 
            The thermal conductivity at the highest entered w is used for all values 
            above this threshold.
        _conductivity: A list of (moisture-dependent) thermal conductivities [W/m-K]
            This list must have the same length as _conductivity_w.
            _
            At least a datapoint at w = 0 is needed (dry thermal conductivity). 
            The thermal conductivity at the highest entered w is used for all values 
            above this threshold.
    Returns:
        mat: A hygrothermal opaque material that can be assigned to a Honeybee
            Opaque construction.
"""

ghenv.Component.Name = "Hygrothermal Opaque Material"
ghenv.Component.NickName = 'HygroMat'
ghenv.Component.Message = '0.0.1'
ghenv.Component.Category = 'HB-Hygro'
ghenv.Component.SubCategory = ""

import utils
import hygro_material
reload(utils)
reload (hygro_material)
from hygro_material import HygroMaterial

try:  # import the honeybee-energy dependencies
    from honeybee_energy.material.opaque import EnergyMaterial
except ImportError as e:
    raise ImportError('\nFailed to import honeybee_energy:\n\t{}'.format(e))

try:  # import ladybug_rhino dependencies
    from ladybug_rhino.grasshopper import all_required_inputs
except ImportError as e:
    raise ImportError('\nFailed to import ladybug_rhino:\n\t{}'.format(e))

if all_required_inputs(ghenv.Component):
    mat = _mat.duplicate()
    identifier = mat.identifier
    hygro_mat = HygroMaterial(
        identifier,
        _porosity,
        _initial_w,
        _sorption_w,
        _sorption_rh,
        _suction_w,
        _suction_coeff,
        _redist_w,
        _redist_coeff,
        _diff_rh,
        _diff_resist,
        _conductivity_w,
        _conductivity,
        )
        
    #Check if corresponding lists match
    hygro_mat.values_compatible()
    
    # Add HygroMaterial object as a dictionary to the standard EnergyMaterial
    mat.user_data = {"hygro_material": hygro_mat.to_dict()}
# ---------- end hygromat ----------

# ---- group: Parametric room
dom = ConstructDomain(DomainStart=0, DomainEnd=Slider(5, range=0..5))
dom_2 = ConstructDomain(DomainStart=0, DomainEnd=Slider(4, range=0..5))
dom_3 = ConstructDomain(DomainStart=0, DomainEnd=Slider(2.7, range=0..5))
box = DomainBox(Base=PlaneXY(0, 0, 0), X=dom, Y=dom_2, Z=dom_3)
# Improving plugin in the future:
# 1. Use components only as thin wrappers calling mylibrary.py
# 2. Ship components using COMPAS Componentizer
# Points to improve
# 
# - Add hygrothermal properties as user_data in the Opaque_Material component. Then, in the ModelToOSM component, extract this info from construction sets, and add as an idf as previously done.
# - Add materials provided in the EnergyPlus Reference DataSets (MoistureMaterials.idf)
# Notes on People moisture
# 
# - People moisture production is automatically calculated from the latent fraction from people's gains. When no latent fraction is added, E+ autocalculates the sensible and latent portions based on a polynomial that takes the metabolic rate M (W) and temperature T(°C). This polynomial was regressed for a dataset considering 100-400W and 21-28°C. Check this for more details:
# https://bigladdersoftware.com/epx/docs/8-3/engineering-reference/zone-internal-gains.html?utm_source=chatgpt.com#zone-internal-gains
# Points to improve
# 
# - Simplify workflow
# - Simulate for multiple years
# - Allow to choose whole HAMT or surface-based HAMT
# - Expose HAMT outputs
# - Automate moisture source conversion to latent loads
# - Structure hygrothermal material as JSON (same as standard HB materials)
debrep = DeconstructBrep(Brep=box)  # -> Faces, Edges, Vertices
split = SplitList(List=debrep.Faces, Index="2")  # -> ListA, ListB

# ---- group: Lighting and Appliances
panel = Panel("""0.1
0.1
0.1
0.1
0.1
0.2
0.8
0.2
0.1
0.1
0.1
0.1
0.8
0.2
0.1
0.1
0.1
0.2
0.8
1
0.2
0.2
0.2
0.1""")
constantschedule = HBConstantSchedule(values=panel, name="SIA_LIGHT_SCH")  # -> report, schedule, idf_text; plug-in component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

# ---- group: Occupancy
panel_2 = Panel("""1
1
1
1
1
1
0.6
0.4
0
0
0
0
0.8
0.4
0
0
0
0.4
0.8
0.8
0.8
1
1
1""")
constantschedule_2 = HBConstantSchedule(values=panel_2, name="SIA_OCC_SCH")  # -> report, schedule, idf_text; plug-in component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

# ----
dayschedule = HBDaySchedule(Decimals=0, Maximum=1, Minimum=0, Value=[1, 1, 1, 1, 1, 1, 1, 1, 0, 0, 0, 0, 1, 1, 0, 0, 0, 0, 0, 0, 0, 0, 1, 1])
# Ventilation schedule
panel_3 = Panel("On-Off")
constantschedule_3 = HBConstantSchedule(values=dayschedule, name="Summer", type_limit=panel_3)  # -> report, schedule, idf_text; plug-in component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

# ---- group: Heating and Cooling
neg = Negative(Value="99")
constantschedule_4 = HBConstantSchedule(values="99", name="SIA_COOL_SCH", type_limit="Temperature")  # -> report, schedule, idf_text; plug-in component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
constantschedule_5 = HBConstantSchedule(values=neg, name="SIA_HEAT_SCH", type_limit="Temperature")  # -> report, schedule, idf_text; plug-in component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

# ---- group: Activity
constantschedule_6 = HBConstantSchedule(values="126", name="SIA_ACT_SCH", type_limit="Activity Level")  # -> report, schedule, idf_text; plug-in component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

# ---- group: Lime plaster
free_water_saturation_kg_m3 = Panel("250")
water_absorption_coefficient_kg_m2h1_2 = Panel("3")
water_content_at_rh80_kg_m3 = Panel("30")
dry_thermal_conductivity_w_mk = Panel("0.7")
vapor_diffusion_resistance = Panel("7")
moisture_content_m3_m3 = Panel("""0
0.02
0.03
0.05
0.07
0.18
0.25""")
isotherm_rh = Panel("""0
0.5
0.8
0.9
0.93
0.99
1""")
dry_density_kg_m3 = Panel("1600")
porosity = Panel("0.30")
process_masea_data = Python3Script(
    density=dry_density_kg_m3,
    A=water_absorption_coefficient_kg_m2h1_2,
    w_80=water_content_at_rh80_kg_m3,
    w_f=free_water_saturation_kg_m3,
    mc_m3_m3=moisture_content_m3_m3)  # -> out, liquid_mc, suction_coeff, redist_coeff, initial_mc, isotherm_mc; inputs density: Double, A: Double, w_80: Double, w_f: Double, mc_m3_m3: list of Double
# ---------- process_masea_data: Python ----------
# Suction liquid transport coefficient
# Based on moisture content (w) and free water saturation (wf)
# Obtained from WUFI
def suction(A, w_f, w):
    return 3.8*(A/w_f)**2*1000**(w/w_f-1)

# Convert (kg/m2h1/2) to (kg/m2s1/2)
A_SI = A/60

liquid_mc = [0, w_80, w_f]
suction_coeff = [0]+[suction(A_SI, w_f, w) for w in liquid_mc[1:]]
redist_coeff = suction_coeff[:-1] + [suction_coeff[-1]/10]

initial_mc = w_80/density

isotherm_mc = [value*1000 for value in mc_m3_m3]
# ---------- end process_masea_data ----------
kalkputz_from_masea = Panel("lime plaster")
thickness_m = Panel("0.03")
item = ListItem(List=dry_thermal_conductivity_w_mk, Index=0, Wrap=True)
opaquemat = HBOpaqueMaterial(
    name=kalkputz_from_masea,
    thickness=thickness_m,
    conductivity=item,
    density=dry_density_kg_m3,
    spec_heat="850",
    therm_absp="0.64",
    sol_absp="0.70",
    vis_absp="0.70")  # -> mat; plug-in component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
hygromat_2 = HygrothermalOpaqueMaterial(
    mat=opaquemat,
    porosity=porosity,
    initial_w=process_masea_data.initial_mc,
    sorption_w=process_masea_data.isotherm_mc,
    sorption_rh=isotherm_rh,
    suction_w=process_masea_data.liquid_mc,
    suction_coeff=process_masea_data.suction_coeff,
    redist_w=process_masea_data.redist_coeff,
    redist_coeff=process_masea_data.liquid_mc,
    diff_rh="0",
    diff_resist=vapor_diffusion_resistance,
    conductivity_w="0",
    conductivity=dry_thermal_conductivity_w_mk)  # -> out, mat; inputs sorption_w: list, sorption_rh: list, suction_w: list, suction_coeff: list, redist_w: list, redist_coeff: list, diff_rh: list, diff_resist: list, conductivity_w: list, conductivity: list; same code as hygromat

# ---- group: RE material / Variable material parameters
water_content_at_rh80_kg_kg = Slider(0.023, range=0.023..0.0487)
vapor_diffusion_resistance_factor = Slider(7.8, range=7.8..17.5)
dry_thermal_conductivity_w_mk_2 = Slider(0.9, range=0.3..1.3)
specific_heat_capacity_j_kgk = Slider(750, range=750..1800)
dry_density_kg_m3_2 = Slider(1700, range=1700..2300)
porosity_m3_m3 = Slider(0.16, range=0.12..0.35)

# ---- group: Insulation material
free_water_saturation_kg_m3_2 = Panel("526")
water_absorption_coefficient_kg_m2h1_2_2 = Panel("0.20")
water_content_at_rh80_kg_m3_2 = Panel("17.3")
dry_thermal_conductivity_w_mk_3 = Panel("0.04")
vapor_diffusion_resistance_2 = Panel("3.3")
moisture_content_m3_m3_2 = Panel("""0
0.0125
0.0173
0.025
0.526""")
isotherm_rh_2 = Panel("""0
0.65
0.80
0.93
1""")
dry_density_kg_m3_3 = Panel("168")
porosity_2 = Panel("0.88")
process_masea_data_2 = Python3Script(
    density=dry_density_kg_m3_3,
    A=water_absorption_coefficient_kg_m2h1_2_2,
    w_80=water_content_at_rh80_kg_m3_2,
    w_f=free_water_saturation_kg_m3_2,
    mc_m3_m3=moisture_content_m3_m3_2)  # -> out, liquid_mc, suction_coeff, redist_coeff, initial_mc, isotherm_mc; inputs density: Double, A: Double, w_80: Double, w_f: Double, mc_m3_m3: list of Double
# ---------- process_masea_data_2: Python ----------
# Suction liquid transport coefficient
# Based on moisture content (w) and free water saturation (wf)
# Obtained from WUFI
def suction(A, w_f, w):
    return 3.8*(A/w_f)**2*1000**(w/w_f-1)

# Convert (kg/m2h1/2) to (kg/m2s1/2)
A_SI = A/60


liquid_mc = [0, w_80, w_f]
suction_coeff = [0]+[suction(A_SI, w_f, w) for w in liquid_mc[1:]]
redist_coeff = suction_coeff[:-1] + [suction_coeff[-1]/10]

initial_mc = w_80/density

isotherm_mc = [value*1000 for value in mc_m3_m3]
# ---------- end process_masea_data_2 ----------
holzfaserdämmplatte_1_from_masea = Panel("Wood fiber board")
thickness_m_2 = Panel("0.37")
item_2 = ListItem(List=dry_thermal_conductivity_w_mk_3, Index=0, Wrap=True)
opaquemat_2 = HBOpaqueMaterial(
    name=holzfaserdämmplatte_1_from_masea,
    thickness=thickness_m_2,
    conductivity=item_2,
    density=dry_density_kg_m3_3,
    spec_heat="1700",
    therm_absp="0.64",
    sol_absp="0.70",
    vis_absp="0.70")  # -> mat; plug-in component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
hygromat_3 = HygrothermalOpaqueMaterial(
    mat=opaquemat_2,
    porosity=porosity_2,
    initial_w=process_masea_data_2.initial_mc,
    sorption_w=process_masea_data_2.isotherm_mc,
    sorption_rh=isotherm_rh_2,
    suction_w=process_masea_data_2.liquid_mc,
    suction_coeff=process_masea_data_2.suction_coeff,
    redist_w=process_masea_data_2.liquid_mc,
    redist_coeff=process_masea_data_2.redist_coeff,
    diff_rh="0",
    diff_resist=vapor_diffusion_resistance_2,
    conductivity_w="0",
    conductivity=dry_thermal_conductivity_w_mk_3)  # -> out, mat; inputs sorption_w: list, sorption_rh: list, suction_w: list, suction_coeff: list, redist_w: list, redist_coeff: list, diff_rh: list, diff_resist: list, conductivity_w: list, conductivity: list; same code as hygromat

# ----
moisturesource = MoistureSource(name="PlantMoisture", moisture_rate="20", schedule="Always On")  # -> moisture_source
# ---------- moisturesource: Python ----------
"""
Create a MoistureSource object that can be assigned to a ProgramType or (be
assigned directly to a Room --> WIP).
-

    Args:
        _name_: Text to set the name for the MoistureSource and to be incorporated
            into a unique MoistureSource identifier. If None, a unique name will
            be generated.
        _moisture_rate: A numerical value for the intensity of moisture generation
            in g/h. Typical cumulative values (you need to convert them to g/h!!!):
            * 200 g - Washing floors
            * 500 g - Dishwashing
            * 900-2000 g - Cooking for four
            * 200-400 g - Typical bathing/washing per person
            * 200-500 g - Five plants or one dog in a day
            _
            [Straube, J. F. (2002). Moisture in Buildings. ASHRAE Journal]
                
        _schedule_: A fractional schedule for the moisture over the course
            of the year. The fractional values will get multiplied by the
            _moisture_generation to yield a complete moisture generation 
            profile. Default: 'Always On'

    Returns:
        infil: An Infiltration object that can be used to create a ProgramType or
            be assigned directly to a Room.
"""

ghenv.Component.Name = 'Moisture Source'
ghenv.Component.NickName = 'MoistureSource'
ghenv.Component.Message = '0.0.1'
ghenv.Component.Category = 'HB-Hygro'

import utils
import moisture_source
reload(utils)
reload(moisture_source)
from moisture_source import MoistureSource

try:  # import the core honeybee dependencies
    from honeybee.typing import clean_and_id_ep_string, clean_ep_string
except ImportError as e:
    raise ImportError('\nFailed to import honeybee:\n\t{}'.format(e))

try:
    from honeybee_energy.lib.schedules import schedule_by_identifier
except ImportError as e:
    raise ImportError('\nFailed to import honeybee_energy:\n\t{}'.format(e))

try:
    from ladybug_rhino.grasshopper import all_required_inputs
except ImportError as e:
    raise ImportError('\nFailed to import ladybug_rhino:\n\t{}'.format(e))

if all_required_inputs(ghenv.Component):
    # make a default MoistureSource name if none is provided
    name = clean_and_id_ep_string('MoistureSource') if _name_ is None else \
        clean_ep_string(_name_)

    # get the schedule
    _schedule_ = _schedule_ if _schedule_ is not None else 'Always On'
    if isinstance(_schedule_, str):
        _schedule_ = schedule_by_identifier(_schedule_)

    # create the MoistureSource object
    moisture_source = MoistureSource(name, _moisture_rate, _schedule_)
# ---------- end moisturesource ----------

# ---- group: RE material
estimate_re_from_literature = Python3Script(w_80=water_content_at_rh80_kg_kg, dry_conductivity=dry_thermal_conductivity_w_mk_2)  # -> out, initial_mc, isotherm_rh, vapor_mc, liquid_mc, suction_coeff, redist_coeff, wet_conductivity; inputs w_80: Double
# ---------- estimate_re_from_literature: Python ----------
C_fit, K_fit = 12.6387, 0.8223 # GAB fitted to Losini et al (2023), Table 8
rh = [0, 0.09, 0.2293, 0.3542, 0.4851, 0.5896, 0.6808, 0.7863, 0.842, 0.8954, 0.9836]
density = 2000 #kg/m3 - Fixing density to avoid influence of density on isotherms

# Define GAB model
def gab_model(rh_values, wm, C, K, units = "kg_m3"):
    results = [] # Use list to avoid numpy
    for rh in rh_values:
        num = wm * C * K * rh
        denom = (1 - K * rh) * (1 - K * rh + C * K * rh)
        w_kg_kg = num/denom
        w_kg_m3 = w_kg_kg * density # Convert units to kg/m3
        if units == "kg_m3":
            results.append(w_kg_m3)
        else:
            results.append(w_kg_kg)
    return results

# Fix C and K, and solve for wm, with w(@RH80%)
def wm_from_anchor(target_w, rh_value, C, K):
    # Guard against invalid denominator (e.g., K*rh -> 1)
    denom = (1 - K * rh_value) * (1 - K * rh_value + C * K * rh_value)
    num = C * K * rh_value
    if denom == 0:
        raise ZeroDivisionError("Denominator is zero; choose RH s.t. K*RH < 1 and parameters physical.")
    f = num / denom
    if f <= 0:
        raise ValueError("Unphysical f(C,K,RH) <= 0; check C>0, 0<K<1, and RH in (0,1).")
    return target_w / f

# Calculate new wm from anchor
wm_new = wm_from_anchor(w_80, 0.80, C_fit, K_fit)

print(f"wm needed to hit w(0.80)={w_80} is {wm_new:.6f}")

# Create lists for idf
vapor_mc = gab_model(rh, wm_new, C_fit, K_fit)
isotherm_rh = rh
initial_mc = w_80

# Water-dependent thermal conductivity
# Get list of kg/kg moisture content to calculate wet_conductivity. Include 
w_kg_kg = gab_model(rh, wm_new, C_fit, K_fit, units = "kg_kg")
c_s = 0.089 # From Losini et al. (2023)
b = c_s/dry_conductivity*100
wet_conductivity = [dry_conductivity*(1+b*w) for w in w_kg_kg] 
print(w_kg_kg)
print(wet_conductivity)

# Liquid transfer coefficients from Losini et al. (2023)
rh_liq = [0, 0.8420, 0.8698, 0.8954, 0.9168, 0.9363, 0.9512, 0.9673, 0.9836]
liq_coeff_raw = [0, 4.41, 6.64, 5.44, 6.04, 6.75, 7.42, 8.34, 9.42]
suction_coeff = [value*10**-9 for value in liq_coeff_raw]
redist_coeff = [value*10**-10 for value in liq_coeff_raw]
# Transform RH to moisture content in kg/m3 using the isotherm 
liquid_mc = gab_model(rh_liq, wm_new, C_fit, K_fit)
# ---------- end estimate_re_from_literature ----------
load_bearing_thickness_m_from_esteve_bou = Panel("0.40")  # "Load bearing thickness (m) from Esteve-Bourrel et al. (2024)"
item_3 = ListItem(List=estimate_re_from_literature.wet_conductivity, Index=0, Wrap=True)
opaquemat_3 = HBOpaqueMaterial(
    name="RE",
    thickness=load_bearing_thickness_m_from_esteve_bou,
    conductivity=item_3,
    density=dry_density_kg_m3_2,
    spec_heat=specific_heat_capacity_j_kgk,
    therm_absp="0.64",
    sol_absp="0.70",
    vis_absp="0.70")  # -> mat; plug-in component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
hygromat_4 = HygrothermalOpaqueMaterial(
    mat=opaquemat_3,
    porosity=porosity_m3_m3,
    initial_w=estimate_re_from_literature.initial_mc,
    sorption_w=estimate_re_from_literature.vapor_mc,
    sorption_rh=estimate_re_from_literature.isotherm_rh,
    suction_w=estimate_re_from_literature.liquid_mc,
    suction_coeff=estimate_re_from_literature.suction_coeff,
    redist_w=estimate_re_from_literature.liquid_mc,
    redist_coeff=estimate_re_from_literature.redist_coeff,
    diff_rh="0",
    diff_resist=vapor_diffusion_resistance_factor,
    conductivity_w=estimate_re_from_literature.vapor_mc,
    conductivity=estimate_re_from_literature.wet_conductivity)  # -> out, mat; inputs sorption_w: list, sorption_rh: list, suction_w: list, suction_coeff: list, redist_w: list, redist_coeff: list, diff_rh: list, diff_resist: list, conductivity_w: list, conductivity: list; same code as hygromat

# ---- group: Create constructions and construction set / Window
windowmat = HBWindowMaterial(name="SIA_WINDOW", u_factor="1.2", shgc="0.5", t_vis="0.5")  # -> mat; plug-in component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
windowconstr = HBWindowConstruction(name="SIA_WINDOW", materials=windowmat)  # -> constr; plug-in component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

# ---- group: Create constructions and construction set / HB materials
merge = Merge(Data1=hygromat_2.mat, Data2=hygromat_3.mat, Data3=hygromat_4.mat)  # -> flatten(Result)

# ---- group: Create constructions and construction set
opaqueconstr = HBOpaqueConstruction(name="INS_RE", materials=merge)  # -> constr; plug-in component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
subfacesubset = HBSubfaceSubset(window=windowconstr, operable=windowconstr)  # -> subface_set; plug-in component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
exteriorsubset = HBExteriorConstructionSubset(exterior_wall=opaqueconstr)  # -> exterior_set; plug-in component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
constructionset = HBConstructionSet(name="CustomSet", exterior_subset=exteriorsubset, subface_subset=subfacesubset)  # -> constr_set; plug-in component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

# ----
list = ValueList({"none": 0, "hygienic": 1, "variable": 2}, selected="variable")

infiltration_m3_s_m2 = Data(9.259259259e-05)
servicehotwater = HBServiceHotWater(name="SIA_DHW", flow_per_area="0.0825", schedule=constantschedule_2.schedule)  # -> hot_water; plug-in component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
setpoint = HBSetpoint(name="SIA_SETPOINTS", heating_sch=constantschedule_5.schedule, cooling_sch=constantschedule_4.schedule)  # -> setpoint; plug-in component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
people = HBPeople(
    name="SIA_PEOPLE",
    ppl_per_area="0.02",
    occupancy_sch=constantschedule_2.schedule,
    activity_sch=constantschedule_6.schedule)  # -> people; plug-in component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
infiltration = HBInfiltration(name="SIA_INF", flow_per_ext_area=infiltration_m3_s_m2)  # -> infil; plug-in component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
ventilation = HBVentilation(name="SIA_VENT", ach="0.8", schedule="Always On")  # -> vent; plug-in component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
lighting = HBLighting(name="SIA_LIGHT", watts_per_area="2.70", schedule=constantschedule.schedule)  # -> lighting; plug-in component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
equipment = HBEquipment(name="SIA_EQUIP", watts_per_area="8", schedule=constantschedule.schedule, radiant_fract="1")  # -> equip; plug-in component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
filter = StreamFilter(Gate=list, Stream1=ventilation)
programtype = HBProgramType(
    name="SIA_MFH_PROGRAM",
    people=people,
    lighting=lighting,
    electric_equip=equipment,
    hot_water=servicehotwater,
    infiltration=infiltration,
    ventilation=filter,
    setpoint=setpoint)  # -> program; plug-in component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

applymoistsrc = ApplyMoistureSource(program=programtype, moisture_source=moisturesource)  # -> program
# ---------- applymoistsrc: Python ----------
"""
Apply a MoistureSource object to an existing HB ProgramType.
_
ProgramTypes can be assigned to Honeybee Rooms to specify all default schedules
and loads on the Room.

    Args:
        _program: Text for the program to assign the moisture source to (to be 
            looked up in the ProgramType library) such as that output from the 
            "HB List Programs" component. This can also be a custom ProgramType 
            object.
        _moisture_source: A MoistureSource object from the "Moisture Source"
            component.
                
    Returns:
        program: A ProgramType object that can be assigned to Honeybee Rooms in
            order to specify all default schedules and loads on the Room.
"""

ghenv.Component.Name = 'Apply Moisture Source '
ghenv.Component.NickName = 'ApplyMoistSrc'
ghenv.Component.Message = '0.0.1'
ghenv.Component.Category = 'HB-Hygro'

import utils
reload(utils)

try:  # import the core honeybee dependencies
    from honeybee.typing import clean_and_id_ep_string, clean_ep_string
except ImportError as e:
    raise ImportError('\nFailed to import honeybee:\n\t{}'.format(e))

try:
    from honeybee_energy.lib.programtypes import program_type_by_identifier, \
        building_program_type_by_identifier, office_program
    from honeybee_energy.lib.schedules import schedule_by_identifier
except ImportError as e:
    raise ImportError('\nFailed to import honeybee_energy:\n\t{}'.format(e))

try:
    from ladybug_rhino.grasshopper import all_required_inputs
except ImportError as e:
    raise ImportError('\nFailed to import ladybug_rhino:\n\t{}'.format(e))

if all_required_inputs(ghenv.Component):
    if isinstance(_program, str):
        try:
            _program = building_programtype_by_identifier(_program)
        except ValueError:
            _program = program_type_by_identifier(_program)
    
    program = _program.duplicate()
    program.user_data = {
        "moisture_source":_moisture_source.to_dict()
        }
# ---------- end applymoistsrc ----------
applymoistsrc_2 = ApplyMoistureSource(program=applymoistsrc)  # -> program
# ---------- applymoistsrc_2: Python ----------
"""
Apply a MoistureSource object to an existing HB ProgramType.
_
ProgramTypes can be assigned to Honeybee Rooms to specify all default schedules
and loads on the Room.

    Args:
        _program: Text for the program to assign the moisture source to (to be 
            looked up in the ProgramType library) such as that output from the 
            "HB List Programs" component. This can also be a custom ProgramType 
            object.
        _moisture_source: A MoistureSource object from the "Moisture Source"
            component.
                
    Returns:
        program: A ProgramType object that can be assigned to Honeybee Rooms in
            order to specify all default schedules and loads on the Room.
"""

ghenv.Component.Name = 'Apply Moisture Source '
ghenv.Component.NickName = 'ApplyMoistSrc'
ghenv.Component.Message = '0.0.1'
ghenv.Component.Category = 'HB-Hygro'

import utils
reload(utils)
import moisture_source
reload(moisture_source)
from moisture_source import MoistureSource

data = _program.user_data["moisture_source"]
moisture_src = MoistureSource.from_dict(data)
print(moisture_src)
# ---------- end applymoistsrc_2 ----------
falsestart = LBFalseStartToggle(True)
py3 = Python3Script()  # -> out, sql_1, sql_2
# ---------- py3: Python ----------
import sqlite3
import pandas as pd
from pathlib import Path
import os

import os
import sqlite3
import pandas as pd
from pathlib import Path

def trim_ep_sql(sql_in, year_index=1, hours_per_year=8760):
    """
    Create a new SQL file containing only the specified year's data.

    Args:
        sql_in: Path to the original multi-year EnergyPlus .sql file.
        year_index: Which year to extract (1 = first, 2 = second, ...).
        hours_per_year: Number of hours per simulated year (default=8760).
    """
    sql_in = Path(sql_in)
    if not sql_in.exists():
        raise FileNotFoundError("Input SQL not found: {}".format(sql_in))

    # Output: same folder as input, with suffix "_yearX.sql"
    sql_out = sql_in.parent / f"{sql_in.stem}_year{year_index}.sql"

    # 🧹 Delete if already exists
    if sql_out.exists():
        sql_out.unlink()

    # Make sure directory exists and is writable
    os.makedirs(sql_in.parent, exist_ok=True)

    # Compute start/end rows
    start = (year_index - 1) * hours_per_year
    end = year_index * hours_per_year

    # Connect to input and create new output DB
    con_in = sqlite3.connect(str(sql_in))
    con_out = sqlite3.connect(str(sql_out))

    # Copy schema (table structure)
    schema_rows = con_in.execute(
        "SELECT sql FROM sqlite_master WHERE type='table' AND sql NOT NULL;"
    ).fetchall()
    for (stmt,) in schema_rows:
        con_out.execute(stmt)

    # Extract time slice
    df_time = pd.read_sql("SELECT * FROM Time ORDER BY TimeIndex", con_in)
    df_time = df_time.iloc[start:end].copy()
    df_time["TimeIndex"] = range(1, len(df_time) + 1)
    df_time["EnvironmentPeriodIndex"] = 1  # 👈 force link to the first environment
    df_time.to_sql("Time", con_out, index=False, if_exists="replace")


    # Filter relevant data tables
    for table in ["ReportVariableData", "ReportMeterData"]:
        if table not in [r[0] for r in con_in.execute("SELECT name FROM sqlite_master")]:
            continue
        df = pd.read_sql(f"SELECT * FROM {table}", con_in)
        df = df[df["TimeIndex"].isin(df_time["TimeIndex"])]
        df.to_sql(table, con_out, index=False, if_exists="replace")

    # Copy supporting dictionary tables unchanged
    for table in [
        "ReportVariableDataDictionary", "ReportMeterDataDictionary",
        "EnvironmentPeriods", "ReportDataDictionary", "SimulationData"]:
        if table not in [r[0] for r in con_in.execute("SELECT name FROM sqlite_master")]:
            continue
        df = pd.read_sql(f"SELECT * FROM {table}", con_in)
        df.to_sql(table, con_out, index=False, if_exists="replace")

    con_in.close()
    con_out.close()

    print("✅ Trimmed SQL written to:", sql_out)
    return sql_out


# Each year = 8760 hourly records
sql_in = _sql

# Extract first and second year as separate .sql files next to the original
sql_1 = trim_ep_sql(sql_in, year_index=1)
sql_2 = trim_ep_sql(sql_in, year_index=2)
# ---------- end py3 ----------

# ---- group: Run simulation
toggle = BooleanToggle(True)
simoutput = HBSimulationOutput(zone_energy_use=toggle, gains_and_losses=toggle, comfort_metrics=toggle, surface_energy_flow=toggle)  # -> report, sim_output; plug-in component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
simpar = HBSimulationParameter(output=simoutput.sim_output, timestep=Slider(20, range=0..100))  # -> sim_par; plug-in component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
path = FilePath("C:\Users\gzorzeto\Downloads\")
epw = FilePath("C:\Users\gzorzeto\OneDrive - ETH Zurich\01_PhD\01_Year\05_Hygrothermal_Model\EPWs\0_CHE_ZH_Zurich.Fluntern_UHI_Urban_High_Buffer_Auto_Present-day.epw")
roomcomfortresult = HBReadRoomComfortResult(sql=py3.sql_1)  # -> oper_temp, air_temp, rad_temp, rel_humidity, unmet_heat, unmet_cool; plug-in component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

# ----
# Create Honeybee Room
panel_4 = Panel("outdoors")
geo = Geometry(split.ListB)
geo_2 = Geometry(split.ListA)
face = HBFace(geo=geo, bc="adiabatic")  # -> report, faces; plug-in component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
face_2 = HBFace(geo=geo_2, bc=panel_4)  # -> report, faces; plug-in component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
south_wwr = Slider(0.4, range=0.1..0.9)
room = HBRoom(
    faces=flatten([face_2.faces, face.faces]),
    name="MFH_room",
    constr_set=constructionset,
    program=applymoistsrc,
    conditioned=Toggle(True))  # -> report, room; plug-in component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
merge_2 = Merge(Data1="0", Data2="0", Data3=south_wwr, Data4="0")
aperturesbyratio = HBAperturesByRatio(hb_objs=flatten(room.room), ratio=merge_2, subdivide=Toggle(False), operable=Toggle(True))  # -> report, hb_objs; plug-in component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
ventcontrol = HBVentilationControl(min_in_temp="23", delta_temp="1", schedule=constantschedule_3.schedule)  # -> vent_cntrl; plug-in component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
windowopen = HBWindowOpening(rooms=flatten(aperturesbyratio.hb_objs), vent_cntrl=ventcontrol, fract_area_oper="0.5", discharge_coeff="0.65")  # -> report, rooms; plug-in component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

filter_2 = StreamFilter(Gate=list, Stream0=aperturesbyratio.hb_objs, Stream1=aperturesbyratio.hb_objs, Stream2=windowopen.rooms)

model = HBModel(rooms=flatten(filter_2))  # -> report, model; plug-in component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

runhamt = RunHAMTSimulation(model=model.model, epw_file=epw, sim_par=simpar, folder=path, write=Toggle(True))  # -> report, jsons, osw, osm, idf, sql, zsz, rdd, html; inputs measures: list, add_str: list, write: Boolean, run: Int32
# ---------- runhamt: Python ----------
"""
Write a honeybee Model to an OSM file (OpenStudio Model), which can then be translated
to an IDF file and then run through EnergyPlus.

-
    Args:
        _model: A honeybee model object possessing all geometry and corresponding
            energy simulation properties.
        _epw_file: Path to an .epw file on this computer as a text string.
        _sim_par_: A honeybee Energy SimulationParameter object that describes all
            of the setting for the simulation. If None, some default simulation
            parameters will automatically be used.
        measures_: An optional list of measures to apply to the OpenStudio model
            upon export. Use the "HB Load Measure" component to load a measure
            into Grasshopper and assign input arguments. Measures can be
            downloaded from the NREL Building Components Library (BCL) at
            (https://bcl.nrel.gov/).
        add_str_: THIS OPTION IS JUST FOR ADVANCED USERS OF ENERGYPLUS.
            You can input additional text strings here that you would like
            written into the IDF.  The input here should be complete EnergyPlus
            objects as a single string following the IDF format. This input can
            be used to write objects into the IDF that are not currently supported
            by Honeybee.
        _folder_: An optional folder on this computer, into which the IDF and result
            files will be written.
        _write: Set to "True" to write out the honeybee JSONs (containing the Honeybee
            Model and Simulation Parameters) and write the OpenStudio Model file (OSM).
            This process will also write either an EnergyPlus Input Data File (IDF)
            or an OpenStudio Workflow file (OSW), which can be used to run the
            model through EnergyPlus. Most models can be simulated with just
            and IDF and so no OWS will be written. However, an OSW will be used
            if any measures_ have been connected or if the simulation parameters
            contain an efficiency standard.
        run_: Set to "True" to translate the Honeybee jsons to an OpenStudio Model
            (.osm) and EnergyPlus Input Data File (.idf) and then simulate the
            .idf in EnergyPlus. This will ensure that all result files appear
            in their respective outputs from this component.
            _
            This input can also be the integer "2", which will run the whole translation
            and simulation silently (without any batch windows).

    Returns:
        report: Check here to see a report of the EnergyPlus run.
        jsons: The file paths to the honeybee JSON files that describe the Model and
            SimulationParameter. These will be translated to an OpenStudio model.
        osw: File path to the OpenStudio Workflow JSON on this machine (if necessary
            for simulation). This workflow is executed using the OpenStudio
            command line interface (CLI) and it includes any connected
            measures_. Will be None if no OSW is needed for the simulation.
        osm: The file path to the OpenStudio Model (OSM) that has been generated
            on this computer.
        idf: The file path of the EnergyPlus Input Data File (IDF) that has been
            generated on this computer.
        sql: The file path of the SQL result file that has been generated on this
            computer. This will be None unless run_ is set to True.
        zsz: Path to a .csv file containing detailed zone load information recorded
            over the course of the design days. This will be None unless run_ is
            set to True.
        rdd: The file path of the Result Data Dictionary (.rdd) file that is
            generated after running the file through EnergyPlus.  This file
            contains all possible outputs that can be requested from the EnergyPlus
            model. Use the "HB Read Result Dictionary" component to see what outputs
            can be requested.
        html: The HTML file path containing all requested Summary Reports.
"""

ghenv.Component.Name = 'Run HAMT Simulation'
ghenv.Component.NickName = 'RunHAMT'
ghenv.Component.Message = '0.0.1'
ghenv.Component.Category = 'HB-Hygro'

import os
import re
import json
import subprocess
import utils
reload(utils)
from utils import generate_hygro_idf

try:
    from ladybug.futil import preparedir, nukedir, copy_file_tree
    from ladybug.epw import EPW
    from ladybug.stat import STAT
except ImportError as e:
    raise ImportError('\nFailed to import ladybug:\n\t{}'.format(e))

try:
    from honeybee.config import folders
    from honeybee.model import Model
except ImportError as e:
    raise ImportError('\nFailed to import honeybee:\n\t{}'.format(e))

try:
    from honeybee_energy.simulation.parameter import SimulationParameter
    from honeybee_energy.measure import Measure
    from honeybee_energy.run import to_openstudio_sim_folder, run_osw, run_idf, \
        output_energyplus_files, _parse_os_cli_failure
    from honeybee_energy.result.err import Err
    from honeybee_energy.config import folders as energy_folders
    from honeybee_energy.writer import generate_idf_string
except ImportError as e:
    raise ImportError('\nFailed to import honeybee_energy:\n\t{}'.format(e))

try:
    from honeybee_openstudio.openstudio import OSModel
except (ImportError, AssertionError):  # Openstudio C# bindings are not usable
    OSModel = None

try:
    from lbt_recipes.version import check_openstudio_version
except ImportError as e:
    raise ImportError('\nFailed to import lbt_recipes:\n\t{}'.format(e))

try:
    from ladybug_rhino.grasshopper import all_required_inputs, give_warning
    from ladybug_rhino.config import units_system
except ImportError as e:
    raise ImportError('\nFailed to import ladybug_rhino:\n\t{}'.format(e))

ROOM_COUNT_THRESH = 1000  # threshold at which the CLI is used for translation


def measures_to_folder(measures, sim_folder):
    osw_dict = {}  # dictionary that will be turned into the OSW JSON
    osw_dict['steps'] = []
    mea_folder = os.path.join(sim_folder, 'measures')
    # ensure measures are correctly ordered
    m_dict = {'ModelMeasure': [], 'EnergyPlusMeasure': [], 'ReportingMeasure': []}
    for measure in measures:
        assert isinstance(measure, Measure), 'Expected honeybee-energy Measure. ' \
            'Got {}.'.format(type(measure))
        m_dict[measure.type].append(measure)
    sorted_measures = m_dict['ModelMeasure'] + m_dict['EnergyPlusMeasure'] + \
        m_dict['ReportingMeasure']
    # add the measures and the measure paths to the OSW
    for measure in sorted_measures:
        measure.validate()  # ensure that all required arguments have values
        osw_dict['steps'].append(measure.to_osw_dict())  # add measure to workflow
        dest_folder = os.path.join(mea_folder, os.path.basename(measure.folder))
        copy_file_tree(measure.folder, dest_folder)
        test_dir = os.path.join(dest_folder, 'tests')
        if os.path.isdir(test_dir):
            nukedir(test_dir, rmdir=True)
    # write the dictionary to a workflow.osw
    osw_json = os.path.join(mea_folder, 'workflow.osw')
    try:
        with open(osw_json, 'w') as fp:
            json.dump(osw_dict, fp, indent=4)
    except UnicodeDecodeError:  # non-unicode character in the dictionary
        with open(osw_json, 'w') as fp:
            json.dump(osw_dict, fp, indent=4, ensure_ascii=False)
    return mea_folder


if all_required_inputs(ghenv.Component) and _write:
    # check the presence of openstudio and check that the version is compatible
    check_openstudio_version()
    assert isinstance(_model, Model), \
        'Expected Honeybee Model for _model input. Got {}.'.format(type(_model))

    # process the simulation parameters
    if _sim_par_ is None:
        sim_par = SimulationParameter()
        sim_par.output.add_zone_energy_use()
        sim_par.output.add_hvac_energy_use()
        sim_par.output.add_electricity_generation()
    else:
        sim_par = _sim_par_.duplicate()  # ensure input is not edited

    # assign design days from the DDY next to the EPW if there are None
    folder, epw_file_name = os.path.split(_epw_file)
    if len(sim_par.sizing_parameter.design_days) == 0:
        msg = None
        ddy_file = os.path.join(folder, epw_file_name.replace('.epw', '.ddy'))
        if os.path.isfile(ddy_file):
            try:
                sim_par.sizing_parameter.add_from_ddy_996_004(ddy_file)
            except AssertionError:
                pass
            if len(sim_par.sizing_parameter.design_days) == 0:
                msg = 'No ddy_file_ was input into the _sim_par_ sizing ' \
                    'parameters\n and no design days were found in the .ddy file '\
                    'next to the _epw_file.'
        else:
             msg = 'No ddy_file_ was input into the _sim_par_ sizing parameters\n' \
                'and no .ddy file was found next to the _epw_file.'
        if msg is not None:
            epw_obj = EPW(_epw_file)
            des_days = [epw_obj.approximate_design_day('WinterDesignDay'),
                        epw_obj.approximate_design_day('SummerDesignDay')]
            sim_par.sizing_parameter.design_days = des_days
            msg = msg + '\nDesign days were generated from the input _epw_file but this ' \
                '\nis not as accurate as design days from DDYs distributed with the EPW.'
            give_warning(ghenv.Component, msg)
            print(msg)
    if sim_par.sizing_parameter.climate_zone is None:
        stat_file = os.path.join(folder, epw_file_name.replace('.epw', '.stat'))
        if os.path.isfile(stat_file):
            stat_obj = STAT(stat_file)
            sim_par.sizing_parameter.climate_zone = stat_obj.ashrae_climate_zone

    # process the simulation folder name and the directory
    _folder_ = folders.default_simulation_folder if _folder_ is None else _folder_
    clean_name = re.sub(r'[^.A-Za-z0-9_-]', '_', _model.display_name)
    directory = os.path.join(_folder_, clean_name, 'openstudio')

    # delete any existing files in the directory and prepare it for simulation
    nukedir(directory, True)
    preparedir(directory)
    sch_directory = os.path.join(directory, 'schedules')
    preparedir(sch_directory)

    # write the model and simulation parameter to JSONs
    model_json = os.path.join(directory, '{}.hbjson'.format(clean_name))
    with open(model_json, 'wb') as fp:
        model_str = json.dumps(_model.to_dict(), ensure_ascii=False)
        fp.write(model_str.encode('utf-8'))
    sim_par_json = os.path.join(directory, 'simulation_parameter.json')
    with open(sim_par_json, 'w') as fp:
        json.dump(sim_par.to_dict(), fp)
    jsons = [model_json, sim_par_json]


# ------------------------HYGRO-------------------------------------------------
    idf_str, msg = generate_hygro_idf(_model)
    if msg:
        give_warning(ghenv.Component, msg)

    add_str_.append(idf_str)
# ------------------------HYGRO-------------------------------------------------

    # determine whether to run the translation with cPython or IronPython
    use_ironpython = False
    if OSModel is not None:
        vent_sim_control = _model.properties.energy.ventilation_simulation_control
        if vent_sim_control.vent_control_type == 'SingleZone':
            if len(_model.rooms) < ROOM_COUNT_THRESH:
                osc_version = tuple(int(v) for v in OSModel().version().str().split('.'))
                if osc_version == energy_folders.openstudio_version:
                    use_ironpython = True

    if use_ironpython:  # translate the model using IronPython methods
        add_str = '\n'.join(add_str_) if len(add_str_) != 0 and \
            add_str_[0] is not None else None
        osm, osw, idf = to_openstudio_sim_folder(
            _model, directory, epw_file=_epw_file, sim_par=sim_par,
            schedule_directory=sch_directory, enforce_rooms=True,
            additional_measures=measures_, strings_to_inject=add_str)
        if run_ > 0:
            silent = True if run_ > 1 else False
            if idf is not None:  # run the IDF directly through E+
                sql, zsz, rdd, html, err = run_idf(idf, _epw_file, silent=silent)
            else:
                osm, idf = run_osw(osw, measures_only=False, silent=silent)
                if idf is None or not os.path.isfile(idf):
                    _parse_os_cli_failure(directory)
                sql, zsz, rdd, html, err = output_energyplus_files(os.path.dirname(idf))
    else:  # translate the model with cPython using OpenStudio CLI
        # write additional strings and measures to a folder
        add_idf = None
        if len(add_str_) != 0 and add_str_[0] is not None:
            add_str = '\n'.join(add_str_)
            add_idf = os.path.join(directory, 'additional_strings.idf')
            with open(add_idf, 'w') as fp:
                fp.write(add_str)
        measure_folder = None
        if len(measures_) != 0 and measures_[0] is not None:
            measure_folder = measures_to_folder(measures_, directory)

        # put together the arguments for the command to be run
        if run_ > 0:  # use the simulate command
            cmds = ['"{}"'.format(folders.python_exe_path),
                    '-m', 'honeybee_energy', 'simulate', 'model',
                    '"{}"'.format(model_json), '"{}"'.format(_epw_file),
                    '--sim-par-json', '"{}"'.format(sim_par_json),
                    '--folder', '"{}"'.format(directory)]
        else:  # use the translate command
            cmds = ['"{}"'.format(folders.python_exe_path),
                    '-m', 'honeybee_energy', 'translate', 'model-to-sim-folder',
                    '"{}"'.format(model_json), '"{}"'.format(_epw_file),
                    '--sim-par-json', '"{}"'.format(sim_par_json),
                    '--folder', '"{}"'.format(directory)]
        if add_idf is not None:
            cmds.append('--additional-idf')
            cmds.append('"{}"'.format(add_idf))
        if measure_folder is not None:
            cmds.append('--measures')
            cmds.append('"{}"'.format(measure_folder))
        osm = os.path.join(directory, 'in.osm')
        idf = os.path.join(directory, 'run', 'in.idf')

        # execute the command
        custom_env = os.environ.copy()
        custom_env['PYTHONHOME'] = ''
        cmds = ' '.join(cmds)
        if os.name == 'nt':
            shell = False if run_ == 1 else True
        else:
            shell = True
        process = subprocess.Popen(cmds, shell=shell, env=custom_env)
        result = process.communicate()  # freeze the canvas while running

        # check if any part of the translation failed
        osw = os.path.join(directory, 'workflow.osw')
        osw = osw if os.path.isfile(osw) else None
        if not os.path.isfile(osm):
            # get the error from stdout
            process = subprocess.Popen(cmds, shell=shell, env=custom_env, stderr=subprocess.PIPE)
            result = process.communicate()  # freeze the canvas while running
            print(result[1])
            raise ValueError('Failed to translate Model to OpenStudio.\n{}'.format(
                '\n'.join(str(result[1]).split('\n')[-3:])))
        if run_ > 0:
            if not os.path.isfile(idf):
                cmds = ' '.join(cmds) if os.name == 'nt' else cmds
                print(cmds)
                raise ValueError('Failed to translate Model to EnergyPlus.')
            sql, zsz, rdd, html, err = output_energyplus_files(os.path.dirname(idf))

    # parse the error log and report any warnings
    if run_ >= 1 and err is not None:
        err_obj = Err(err)
        print(err_obj.file_contents)
        for warn in err_obj.severe_errors:
            give_warning(ghenv.Component, warn)
        for error in err_obj.fatal_errors:
            raise Exception(error)
# ---------- end runhamt ----------
edit_idf = Python3Script(idf_file=runhamt.idf)  # -> new_idf_file; inputs idf_file: String
# ---------- edit_idf: Python ----------
# requirements: eppy
# requirements: eppy
from eppy.modeleditor import IDF
import os

# Path to your Energy+.idd file (adjust version & install path!)
iddfile = r"C:\Program Files\ladybug_tools\openstudio\EnergyPlus\Energy+.idd"

# Register the IDD
IDF.setiddname(iddfile)

# Now load the IDF
idf = IDF(idf_file)

# Change max number of warmup days to 100
building = idf.getobject("Building", "unnamed")
building.Maximum_Number_of_Warmup_Days = 100

# Change the run period to 2 years
run_period = idf.getobject("RunPeriod", "Run Period 1")
run_period.End_Year = int(run_period.Begin_Year)+1

# Get the folder where the IDF is
folder = os.path.dirname(idf_file)
# Join them into a new path
new_idf_file = os.path.join(folder, "modified.idf")

idf.save(new_idf_file)
# ---------- end edit_idf ----------
runidf = HBRunIDF(idf=edit_idf, epw_file=epw, run=falsestart)  # -> report, sql, zsz, rdd, html; plug-in component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
