# Grasshopper definition installer.ghx (Grasshopper 1.0.8)

# ---- group: Set me to 'True' to download and install
toggle = BooleanToggle(False)

# ----
# APR 07, 2026 [v1.18.15]
# This installer will add new libraries to the Ladybug Tools python interpreter which is installed on your computer.
# Specifically, it will:
# - Download and add a new ‘Honeybee-PH’ plugin to your Ladybug Tools installation.
# - Download and add a new ‘PHX’ plugin to your Ladybug Tools installation.
# - Download and add a new library for read/write to excel (XLWings) to your Ladybug Tools installation.
# - Download and add new Grasshopper Components to your Grasshopper ‘User Objects’ folder which will then be available
# for use in your Grasshopper environment
# 
# NOTE: The Honeybee-PH Plugin is currently compatible with Ladybug Tools version v1.8.0 or newer only.
# Please update your Ladybug Tools version using the “LB Versioner” grasshopper component  BEFORE installing Honeybee-PH
# Once installed, please reboot Rhino for the new plugins to become available.
# After install, you no longer need this .GH file, and can safely discard it.
# If you run this again in the future, this installer will overwrite any existing Honeybee-PH installation with the latest version.
requirements = Panel("""plotly>=5.24.1
ladybug-rhino>=1.44.9
honeybee-ph>=1.32.9
PHX>=1.56.18""")
hbphinstall = HBPHInstaller(install=toggle, requirements=requirements)  # -> out; inputs install: Boolean, requirements: list
# ---------- hbphinstall: Python ----------
#
# Honeybee-PH: A Plugin for adding Passive-House data to LadybugTools Honeybee-Energy Models
# 
# This component is part of the PH-Tools toolkit <https://github.com/PH-Tools>.
# 
# Copyright (c) 2022, PH-Tools and bldgtyp, llc <phtools@bldgtyp.com> 
# Honeybee-PH is free software; you can redistribute it and/or modify 
# it under the terms of the GNU General Public License as published 
# by the Free Software Foundation; either version 3 of the License, 
# or (at your option) any later version. 
# 
# Honeybee-PH is distributed in the hope that it will be useful,
# but WITHOUT ANY WARRANTY; without even the implied warranty of 
# MERCHANTABILITY or FITNESS FOR A PARTICULAR PURPOSE. See the 
# GNU General Public License for more details.
# 
# For a copy of the GNU General Public License
# see <https://github.com/PH-Tools/honeybee_ph/blob/main/LICENSE>.
# 
# @license GPL-3.0+ <http://spdx.org/licenses/GPL-3.0+>
#
"""
This component installs/updates all of the 'Honeybee-PH' plugin libraries for Ladybug Tools.
Please make sure that you have Ladybug-Tools with Honeybee-Energy ALREADY fully installed BEFORE
proceeding with this installation. Make sure you are connected to the internet in 
order to download the latest version of the plugin libraries and components.
-
This tool will download and install several new libraries into the Ladybug-Tools
python interpreter, and will download and install new Grasshopper components which
will be added to your Rhino / Grasshopper installation.
-
EM January 9, 2026
    Args:
        _install: (bool) Set to True to install Honeybee-PH on your computer.
        
        _hbph_ver: (str): The Version number of the Honeybee-PH package to install from PyPi.
            Note that if you leave this input empty, the latest version will be installed. For 
            more details on honeybee-ph version, see https://pypi.org/project/honeybee-ph/
       
        _phx_ver: (str): The Version number of the PHX package to install from PyPi.
            Note that if you leave this input empty, the latest version will be installed. For 
            more details on honeybee-ph version, see https://pypi.org/project/PHX/
"""

COMPONENT = ghenv.Component # type: ignore
COMPONENT.Name = 'HBPH Installer'
COMPONENT.NickName = 'HBPHInstall'
COMPONENT.Message = 'JAN_09_2026'
COMPONENT.Category = 'Honeybee-PH'
COMPONENT.SubCategory = '00 | Utils'
COMPONENT.AdditionalHelpFromDocStrings = '0'

try:
    COMPONENT.ToggleObsolete(False)
except AttributeError:
    pass # Rhino 7
    
import os
import sys
import json
import subprocess

try:
    import ctypes
except:
    pass # MacOs

try:
    from typing import Optional, Tuple
except ImportError:
    pass # IronPython 2.7

try:
    from exceptions import IOError # type: ignore
except ImportError:
    pass # IronPython 2.7

try:
    import Rhino # type: ignore
except ImportError:
    pass # Outside Rhino/Grasshopper

try:
    from Grasshopper.Folders import UserObjectFolders # type: ignore
    from Grasshopper.Kernel import GH_RuntimeMessageLevel as Message # type: ignore
except ImportError:
    pass # Outside Rhino/Grasshopper

try:
    #from ladybug_rhino.versioning import change
    from ladybug_rhino import grasshopper as lbt_gh
    from ladybug_rhino.config import folders as lbr_folders
    lbr_loaded = True
except ImportError as e:
    lbr_loaded = False
    msg =   '\nFailed to import ladybug_rhino:\n'\
            'Please make sure Ladybug and Honeybee are installed properly before proceeding.\n\t{}'.format(e)
    raise ImportError(msg)

try:
    from ladybug import futil
except ImportError as e:
    msg =   '\nFailed to import ladybug.futil:\n'\
            'Please make sure Ladybug and Honeybee are installed properly before proceeding.\n\t{}'.format(e)
    raise ImportError(msg)

try:
    from honeybee.config import folders as hb_folders
except ImportError as e:
    msg =   '\nFailed to import honeybee.config.folders:\n'\
            'Please make sure Ladybug and Honeybee are installed properly before proceeding.\n\t{}'.format(e)
    raise ImportError(msg)



# - - - - - - - - - - - - - - - - - - - - - - - - - - - - - - - - - - - - - - - - - - - - - - - -
# -- Required Versions
MIN_VER_RHINO = (8, 27)
MIN_VER_LBT_GH = (1, 9, 1)


# - - - - - - - - - - - - - - - - - - - - - - - - - - - - - - - - - - - - - - - - - - - - - - - -
# -- System Check


def is_windows_user_admin():
    # type: () -> bool
    """For Windows only, return True if the user opened Rhino 'As Administrator' and False if not."""
    if (os.name != 'nt'): # In case used on MacOs
        return True
    
    try:
        mode = ctypes.windll.shell32.IsUserAnAdmin() != 0
    except Exception as e:
        raise Exception(e)
    
    if mode != 0:
        return True
    else:
        return False

def user_system_meets_min_rhino_version(_min_version_allowed):
    # type: (Tuple[int, int]) -> bool
    """Return True if the current Rhino version meets the minimum compatibility requirements.
    
    Arguments:
    ----------
        * _min_version_allowed (Tuple[int, int]): The Minimum Rhino version compatible
            with Honeybee-PH. 
    
    Returns:
    --------
        * (bool)
    """
    
    # -- Only check against Major / Minor version
    rh_min_version_allowed = (_min_version_allowed[0], _min_version_allowed[1])
    rh_version_found = (Rhino.RhinoApp.Version.Major, Rhino.RhinoApp.Version.Minor)
    
    # ---------------------------------------------------------------------------
    print ("Rhino version: {}.{}".format(Rhino.RhinoApp.Version.Major, Rhino.RhinoApp.Version.Minor))

    if rh_version_found < rh_min_version_allowed:
        return False
    else:
        return True

def user_system_meets_min_LBT_version(_min_version_allowed):
    # type: (Tuple[int, int, int]) -> bool
    """Return True if the installed LBT Grasshopper version meets the minimum compatibility requirements.
    
    Arguments:
    ----------
        * _min_version_allowed (Tuple[int, int]): The Minimum Ladybug Grasshopper version compatible
            with Honeybee-PH. 
    
    Returns:
    --------
        * (bool)
    """
    # ---------------------------------------------------------------------------
    lbt_gh = lbr_folders.lbt_grasshopper_version
    if not lbt_gh:
        msg = (
            "Error: Please make sure that you have Ladybug Tools and Honeybee installed "
            "before proceeding with the installation. \n"
            "Cannot determine the Ladybug Tools version installed? \n"
            " - ladybug_rhino.config.lbt_grasshopper_version={} \n".format(lbt_gh)
            )
        print msg
        raise Exception(msg)
    
    # ---------------------------------------------------------------------------
    print("Ladybug-Tools-Grasshopper version: {}.{}.{}".format(*lbt_gh))
    
    # ---------------------------------------------------------------------------
    if lbt_gh < _min_version_allowed:
        return False
    else:
        return True

def check_system_setup():
    # type: () -> None
    """Provide messages related to System compatibility."""
    
    print "Rhino running in 'Admin' mode:", is_windows_user_admin()
    if not is_windows_user_admin():
        msg = " Error: This Honeybee-PH installer will only work if Rhino is started in 'Admin' mode.\n"\
                "To proceed with the installation: \n"\
                "Please close Rhino and re-open it by 'right-clicking' on the Rhino application, and selecting 'Run as Administrator'.\n"\
                "Once you are in 'admin' mode, please re-open this installer and you will be able to continue with the Honeybee-PH Installation."
        raise Exception(msg)
    
    if not user_system_meets_min_rhino_version(MIN_VER_RHINO):
        msg = "Error: Honeybee-PH requires Rhino version: "\
            "{}.{} or better. Please update Rhino before proceeding. "\
            "Got version: {}.{}".format(
                MIN_VER_RHINO[0],
                MIN_VER_RHINO[1],
                Rhino.RhinoApp.Version.Major,
                Rhino.RhinoApp.Version.Minor,
            )
        print(msg)
        raise Exception(msg)
    
    if not user_system_meets_min_LBT_version(MIN_VER_LBT_GH):
        msg = "Error: Honeybee-PH requires Ladybug-Tools version: "\
            "{}.{} or better. Please update Ladybug-Tools before proceeding. "\
            "Got version: {}.{}".format(
                MIN_VER_LBT_GH[0],
                MIN_VER_LBT_GH[1],
                lbr_folders.lbt_grasshopper_version[0],
                lbr_folders.lbt_grasshopper_version[1],
            )
        print(msg)
        raise Exception(msg)
    
    # - - - - - - - - - - - - - - - - - - - - - - - - - - - - - - - - - - - - - - - - - - - - - - - -
    print "Ladybug Tools Python .exe:", hb_folders.python_exe_path
    print "Ladybug Tools Python packages:", hb_folders.python_package_path


# - - - - - - - - - - - - - - - - - - - - - - - - - - - - - - - - - - - - - - - - - - - - - - - -
# -- PIP Install


def run_pip_command(python_exe, package_name, version=None, target=None, _env=None):
    # type: (str, str, str, str, dict | None) -> str, str
    """Update or Install Python libraries using pip within a python subprocess.
    
    Args:
        * python_exe (str): The path to the Python executable to be used for installation.
        
        * package_name (str): The name of the PyPI package to install
        
        * version (str): An optional string for the version of the package to install.
        
        * target (str): An optional target directory into which the package will be installed.
        
        * _env (Optional[Dict]): The OS Environment to be used for the Pip-Install
    Returns:
        * stdout (bytes):

        * stderr (bytes): 
    """
    
    # Set the environment for pip install to fix Rhino-8 issues
    if _env == None:
        _env = os.environ
        
    # build up the command using the inputs
    if version is not None:
            package_name = '{}>={}'.format(package_name, version)
    
    cmds = [python_exe, '-m', 'pip', 'install', package_name]
    
    if version is None:
        cmds.append('-U')
    
    if target is not None:
        cmds.extend(['--target', target, '--upgrade'])

    # execute the command and print any errors
    print('Installing "{}" via pip'.format(package_name))
    
    use_shell = True if os.name == 'nt' else False
    
    # Use the ENV passed in to fix any Rhino-8 issues
    process = subprocess.Popen(
        cmds, shell=use_shell, stdout=subprocess.PIPE, stderr=subprocess.PIPE, env=_env)
    
    output = process.communicate()
    
    stdout, stderr = output
    return stdout, stderr

def update_pip(python_exe, _env=None):
    # type: (str, Optional[Dict]) -> str
    """Update 'Pip' to avoid seeing those error.
    
    Args:
        * python_exe (str): The path to the Python executable to be used for installation.
        
        * _env (Optional[Dict]): The OS Environment to be used for the Pip-Install
    
    Returns:
        error_msg (str)
    """
    
    # Set the environment for pip install to fix Rhino-8 issues
    if _env == None:
        _env = os.environ
        
    # build up the command using the inputs
    cmds = [python_exe, '-m', 'pip', 'install', '--upgrade', 'pip']
    
    # execute the command and print any errors
    print('Updating Pip...')
    
    use_shell = True if os.name == 'nt' else False
    
    try:
        # Use the ENV passed in to fix any Rhino-8 issues
        process = subprocess.Popen(
            cmds, shell=use_shell, stdout=subprocess.PIPE, stderr=subprocess.PIPE, env=_env)
        
        output = process.communicate()
        
        stdout, stderr = output
        error_msg = 'Command: {} may have failed for some reason'.format(cmds)
    except Exception as e:
        error_msg = e

    return error_msg

def get_package_name_and_version(package):
    # type: (str) -> tuple[str, str]
    if ">=" in package:
        delimiter = ">="
    elif "<=" in package:
        delimiter = "<="
    elif "==" in package:
        delimiter = "=="
    else:
        raise Exception("Error: {} format invalid. Please provide a version number".format(package))

    return package.split(delimiter)

def parse_version_tuple(version_str):
    # type: (str) -> tuple
    """Parse a version string like '1.32.9' into a tuple of ints for comparison."""
    try:
        return tuple(int(x) for x in version_str.split('.'))
    except (ValueError, AttributeError):
        return (0,)

def find_installed_dist_info(_package_install_folder_name, _min_version, _site_packages_path):
    # type: (str, str, str) -> Optional[str]
    """Find a dist-info folder for the package with version >= _min_version.

    Returns the folder name if found, or None.
    """
    min_ver = parse_version_tuple(_min_version)
    prefix = "{}-".format(_package_install_folder_name.lower())
    suffix = ".dist-info"

    for entry in os.listdir(_site_packages_path):
        if entry.lower().startswith(prefix) and entry.lower().endswith(suffix):
            version_str = entry[len(prefix):-len(suffix)]
            installed_ver = parse_version_tuple(version_str)
            if installed_ver >= min_ver:
                return entry
    return None

def pip_install(_package, _lbt_python_exe_path, _lbt_python_package_path, _package_install_folder_name=None, _env=None):
    # type: (str, str, str, Optional[str], Optional[Dict]) -> None
    """PIP install a specified package from PyPi to the Ladybug Tools Python.
    
    Arguments:
    ----------
        * _package(str): The name of the package to install from PyPi
   
        * _lbt_python_exe_path (str): The path to the Ladybug Tools python installation.
        
        * _lbt_python_package_path (str): The path to the Ladybug Tools python site-packages directory.
        
        * _package_install_folder_name (Optional[str]): An optional folder name for
            the package once it is installed. This is used to verify installation went
            correctly. Note that in many cases the install folder name will be 
            different than the package name (ie: "honeybee-ph" --> "honeybee_ph"). If None
            is supplied, will try and automatically create the folder name by just replacing all
            hyphens with underscores.
        
        * _env (Optional[Dict]): The OS Environment to use for the Pip-Install. This should have
            "PYTHONHOME" set to: "" in order to avoid the Rhino Python-3 install issues.
    Returns:
    --------
        * None
    """
    
    # Set the environment for pip install to fix Rhino-8 issues
    if _env == None:
        _env = os.environ
    
    package_name, package_version = get_package_name_and_version(_package)
    
    if not _package_install_folder_name:
        _package_install_folder_name = package_name.replace("-", "_")

    print '- '*50 
    print 'Installing Python package: "{}" (v{}) to: {}'.format(package_name, package_version, _lbt_python_package_path) 
    print "  _package_name=", package_name
    print "  _package_version=", package_version
    print "  _lbt_python_exe_path=", _lbt_python_exe_path
    print "  _lbt_python_package_path=", _lbt_python_package_path
    print "  _package_install_folder_name=", _package_install_folder_name
    print "  _env['PYTHONHOME']=", _env['PYTHONHOME'] 
    
    stdout, stderr = run_pip_command(_lbt_python_exe_path, package_name, package_version, _env=_env)

    found_dist = find_installed_dist_info(_package_install_folder_name, package_version, _lbt_python_package_path)
    if found_dist:
        print("Package '{}' (>={}) successfully installed to: {} [found: {}]".format(package_name, package_version, _lbt_python_package_path, found_dist))
    else:
        print("ERROR: Package '{}' (>={}) failed to install to: {}".format(package_name, package_version, _lbt_python_package_path))
        print("ERROR: Could not find any {}-*.dist-info with version >= {} in {}".format(_package_install_folder_name, package_version, _lbt_python_package_path))
        print("ERROR: {}".format(str(stderr)))
        print("ERROR: {}".format(str(stdout)))

        msg = "ERROR: Failed to install {} >={}".format(package_name, package_version)
        COMPONENT.AddRuntimeMessage(Message.Error, msg)


# - - - - - - - - - - - - - - - - - - - - - - - - - - - - - - - - - - - - - - - - - - - - - - - -
# -- GitHub


def copy_repo_contents_to_site_packages(_source_directory, _target_directory, _branch):
    # type: (str, str, str) -> None
    """Copy a directory's contents to the Ladybug Tools site-packages directory.
    
    Arguments:
    ----------
        * _source_directory (str): The full path to the directory to copy the contents of.
        
        * _target_directory (str): The full path to the directory to copy to.
    
    Returns:
    --------
        * None
    """
    
    directories_to_exclude = {'.github', 'tests', 'docs', 'diagrams',} 
    for _dir in os.listdir(_source_directory):
        src_dir = os.path.join(_source_directory, _dir)
        
        if _dir in directories_to_exclude: # don't copy any of these to site-packages
            continue
        
        if not os.path.isdir(src_dir): # If the target folder doesn't exist already
            continue
        
        print('Copying "{}" to:: {}'.format(_dir, _target_directory))
        futil.copy_file_tree(src_dir, os.path.join(_target_directory, _dir))

def get_files_from_github_repo(_github_repo_name, _target_directory, _branch='main'):
    # type: (str, str, str) -> None
    """Download, unzip and copy files from a GitHub repo into a target directory.
    
    Arguments:
    ----------
        * _github_repo_name (str): The name of the GitHub repo to download.
        
        * _target_directory (str): The full path of the directory to put the
            downloaded files in.
            
        * _branch (str): default='main' The target branch name to download.
    
    Returns:
    --------
        * None
    """

    # -------------------------------------------------------------------------
    # -- Setup all the file and directory paths
    github_url = "https://github.com/PH-Tools/{}/archive/refs/heads/{}.zip".format(_github_repo_name, _branch)
    directory_to_download_to = hb_folders.python_package_path
    name_of_zipfile_to_download = '{}.zip'.format(_github_repo_name)
    downloaded_zip_file_path = os.path.join(directory_to_download_to, name_of_zipfile_to_download)
    temp_unzip_directory = os.path.join(directory_to_download_to, "{}-{}".format(_github_repo_name, _branch))
    
    # -------------------------------------------------------------------------
    #-- Try and download the Github Repo as a .zip file
    try:
        print("- "*25)
        print("Downloading:: {}\nto:: {}".format(github_url, downloaded_zip_file_path))
        futil.download_file_by_name(github_url, directory_to_download_to, name_of_zipfile_to_download, mkdir=True)
    except IOError as e:
        msg = (
            "There was an error downloading the {} package to your computer.\n"
            "If you have Ladybug Tools installed in you 'ProgramFiles' directory, (ie: if you "
            "are using Pollination instead of the Food4Rhino LBT installer) you may \n"
            "need to run Rhino 'as administrator' in order to "
            "install to this directory?\n{}".format(_github_repo_name, e)
            )
        raise IOError(msg)
    except Exception as e:
        msg = "There was a error downloading {} to {}.\n{}".format(github_url, downloaded_zip_file_path, e)
        raise Exception(msg)
    print("{} downloaded successfully to {}".format(github_url, downloaded_zip_file_path))
    
    # -------------------------------------------------------------------------
    # -- Try and unzip the downloaded file
    try:
        print("Unzipping:: {}\nto:: {}".format(downloaded_zip_file_path, temp_unzip_directory))
        futil.unzip_file(downloaded_zip_file_path, directory_to_download_to, mkdir=True)
    except Exception as e:
        msg = "There was an error unzipping: {} to {}.\n{}".format(downloaded_zip_file_path, temp_unzip_directory, e)
        raise Exception(msg)
    print("{} successfully unzipped to {}".format(downloaded_zip_file_path, temp_unzip_directory))

    # -------------------------------------------------------------------------
    # -- Copy the unzipped files/folders over to the Ladybug site-packages folder
    try:
        print("Copying {} to {}".format(temp_unzip_directory, _target_directory))
        copy_repo_contents_to_site_packages(temp_unzip_directory, _target_directory, _branch)
    except Exception as e:
        print("There was an error copying {} to {}\n{}".format(temp_unzip_directory, _target_directory, e))
    print("{} successfully copied to {}".format(temp_unzip_directory, _target_directory))

    # -------------------------------------------------------------------------
    # -- Cleanup: Remove the downloaded folder and zip file
    print("Removing directory: {}".format(temp_unzip_directory))
    futil.nukedir(temp_unzip_directory, True)

    print("Removing downloaded file: {}".format(downloaded_zip_file_path))
    os.remove(downloaded_zip_file_path)

def copy_grasshopper_components_to_UserObjects(_repo_name, _download_directory, _target_directory):
    # type: (str, str, str) -> None
    """Copy all of the GH-User objects from the source dir over the Grasshopper UserObjects directory. 

    This is used when downloading from the "honeybee_grasshopper_ph" github repo, since the .ghuser objects 
    are nested down in the unzipped directory. This function should get called after download and unzip from 
    the "honeybee_grasshopper_ph" github repo.
    
    Arguments:
    ---------- 
        * _repo_name (str): The name of the honeybee_grasshopper_ph repo.
        
        * _download_directory (str): The path to the download directory.
        
        * _target_directory (str): The Grasshopper UserObjects directory to copy to .ghuser files to.
    
    Returns:
    --------
        * None
    """
    
    repo_download_directory = os.path.join(_download_directory, _repo_name)
    hbph_gh_source_folder = os.path.join(repo_download_directory, 'user_objects')
    
    if not os.path.isdir(hbph_gh_source_folder):
        msg = (
            "Cannot find the Grasshopper Component directory: {}? Please be sure"
            "you downloaded and unzipped the '{}' GitHub repo before trying to copy to"
            "the Grasshopper UserObjects directory".format(hbph_gh_source_folder, _repo_name)
        )
        print(msg)
        return
    
    target = os.path.join(_target_directory[0], _repo_name)
    
    # -- Clean out any existing files in the target directory.
    if os.path.exists(target):
        for file_name in os.listdir(target):
            file_path = os.path.join(target, file_name)
            try:
                if os.path.isfile(file_path):
                    os.unlink(file_path)
                elif os.path.isdir(file_path):
                    shutil.rmtree(file_path)
            except Exception as e:
                print("Error deleting file or directory: {}".format(e))

    print('- '*25)
    print('Copying downloaded Grasshopper Components from::\n{} to::\n{}'.format(hbph_gh_source_folder, target))
    
    futil.copy_file_tree(hbph_gh_source_folder, target, overwrite=True)
    
    print("Cleaning up and removing download directory: {}".format(repo_download_directory))
    futil.nukedir(repo_download_directory, True)


# - - - - - - - - - - - - - - - - - - - - - - - - - - - - - - - - - - - - - - - - - - - - - - - -
# -- Main


def install_honeybee_ph(
    _requirements,
    _hbph_gh_branch,
    _lbt_python_exe_path,
    _lbt_python_package_path,
    _env=None
):
    # type: (list[str], Optional[str], str, str, Optional[Dict]) -> None
    """Install Honeybee-PH and PHX Packages from PIP, then download Grasshopper components from Github.
    
    Arguments:
    ----------
        * _requirements (list[str]): A list of pacakges to pip-install from PyPi
    
        * _hbph_gh_branch (Optional[str]): The name of the 'honeybee_grasshopper_ph' Github branch to
            install. If None is supplied, 'main' will be used.
        
        * _lbt_python_exe_path (str): The path to the Ladybug Tools python.exe
        
        * _lbt_python_package_path (str): The path to the Ladybug Tools python site-packages directory.
        
        * _env: The os.environ dict to use for pip-install
    
    Returns:
    --------
        * None
    """
    
    # Set the environment for pip install to fix Rhino-8 issues
    if _env == None:
        _env = os.environ
    
    # -------------------------------------------------------------------------
    # Install all of the required pacakges
    for package in _requirements:
        update_pip(_lbt_python_exe_path, _env=_env)
        pip_install(
            _package=package, 
            _lbt_python_exe_path=_lbt_python_exe_path,
            _lbt_python_package_path=_lbt_python_package_path,
            _package_install_folder_name=None,
            _env=_env
        )
    
    # -------------------------------------------------------------------------
    # -- Install the Honeybee-PH Grasshopper Components and Libraries from GitHub
    get_files_from_github_repo(
        _github_repo_name='honeybee_grasshopper_ph',
        _target_directory=_lbt_python_package_path,
        _branch=_hbph_gh_branch or 'main'
    )
    copy_grasshopper_components_to_UserObjects(
        _repo_name='honeybee_grasshopper_ph',
        _download_directory=_lbt_python_package_path,
        _target_directory=UserObjectFolders
    )
    
    # -------------------------------------------------------------------------
    # -- Install the Honeybee-PH+ Grasshopper Components and Libraries from GitHub
    get_files_from_github_repo(
        _github_repo_name='honeybee_grasshopper_ph_plus',
        _target_directory=_lbt_python_package_path,
        _branch=_hbph_gh_branch or 'main'
    )
    copy_grasshopper_components_to_UserObjects(
        _repo_name='honeybee_grasshopper_ph_plus',
        _download_directory=_lbt_python_package_path,
        _target_directory=UserObjectFolders
    )

    # -------------------------------------------------------------------------
    # -- Install the PH-GH-Component-IO Library from GitHub
    get_files_from_github_repo(
        _github_repo_name='PH_GH_Component_IO',
        _target_directory=_lbt_python_package_path,
        _branch='main'
    )

    # -------------------------------------------------------------------------
    # Give a success message
    print "- " * 50
    msg = 'Honeybee-PH has been successfully installed!\n'\
        'Please RESTART RHINO to being using the new components + libraries.'
    print(msg)
    lbt_gh.give_popup_message(msg, 'Installation Successful!')
    
    return None


# - - - - - - - - - - - - - - - - - - - - - - - - - - - - - - - - - - - - - - - - - - - - - - - -


# -- Required for Rhino 8, otherwise the new py3.9 hijacks the pip install
CUSTOM_ENV = os.environ.copy()
CUSTOM_ENV['PYTHONHOME'] = ''

check_system_setup()

if _install:
    install_honeybee_ph(
        _requirements,
        _hbph_gh_branch=None,
        _lbt_python_exe_path=hb_folders.python_exe_path,
        _lbt_python_package_path=hb_folders.python_package_path,
        _env=CUSTOM_ENV
    )
else:
    msg = 'Please:\n'\
    '- Be sure you have already installed Ladybug Tools.\n'\
    '- Are connected to the internet.\n'\
    '- Set _install to "True" to install Honeybee-PH and all its dependencies on this system.'   
    print(msg)
# ---------- end hbphinstall ----------
panel = Panel(hbphinstall)

dbinstallupdate = DBInstallerAndUpdater(run=Toggle(False))  # -> out; inputs run: Boolean
# ---------- dbinstallupdate: Python ----------
"""
Install or update Dewbee. Please update your Ladybug Tools version using the
"LB Versioner" grasshopper component BEFORE installing dewbee.

When _run is "True", it installs or updates the Dewbee Python package into the Ladybug Tools Python environment,
installs Dewbee .ghuser components into the Grasshopper UserObjects folder, and Dewbee material
library into the custom constructions folder.

Only works with Rhino 8.0 and LBT version 1.10 or higher.
-

    Args:
       _run: Set to True to install or update Dewbee.
       _dewbee_ver: Optional version string for dewbee package (format: "0.1.0").
                    If empty, the latest version will be installed.
       _github_ref: Optional GitHub ref to download GH components from.
                    Can be a branch name like "main" or a tag like "v0.1.0".
                    If empty, the latest released version will be used.
"""

ghenv.Component.Name = "DB Installer and Updater"
ghenv.Component.NickName = "DBInstallUpdate"
ghenv.Component.Message = '0.1.0'
ghenv.Component.Category = "Dewbee"
ghenv.Component.SubCategory = "0 :: Miscellaneous"

try:
    ghenv.Component.ToggleObsolete(False)
except Exception:
    pass


import os
import shutil
import zipfile
import subprocess
import System.Net
import System.Windows.Forms
import Rhino
from Grasshopper.Folders import UserObjectFolders
 
from Grasshopper.Kernel import GH_RuntimeMessageLevel as Message

# Import ladybug dependencies
try:
    from ladybug.futil import preparedir, nukedir, copy_file_tree, download_file_by_name, unzip_file
except Exception as e:
    raise ImportError("Failed to import ladybug.futil utilities:\n\t{}".format(e))

# Get Ladybug Tools python executable and site-packages path, as well as standards dir.
try:
    from honeybee.config import folders as hb_folders
except Exception as e:
    raise ImportError(
        "Failed to import honeybee.config.folders.\n"
        "Ladybug Tools / Honeybee must already be installed.\n{}".format(e)
    )



# -----------------------------------------------------------------------------
# CONFIG
# -----------------------------------------------------------------------------

PY_EXE = hb_folders.python_exe_path
PY_SITE = hb_folders.python_package_path
CONSTRUCTIONS_DIR = os.path.join(hb_folders.default_standards_folder, "constructions")

if not PY_EXE or not os.path.isfile(PY_EXE):
    raise IOError("Could not find Ladybug Tools python executable:\n{}".format(PY_EXE))
if not PY_SITE or not os.path.isdir(PY_SITE):
    raise IOError("Could not find Ladybug Tools site-packages:\n{}".format(PY_SITE))
if not CONSTRUCTIONS_DIR or not os.path.isdir(CONSTRUCTIONS_DIR):
    raise IOError("Could not find Ladybug Tools custom constructions:\n{}".format(CONSTRUCTIONS_DIR))

PYPI_PACKAGE = "dewbee"
PYPI_IMPORT_NAME = "dewbee"

GITHUB_OWNER = "architecture-building-systems"
GITHUB_REPO = "dewbee"
_github_ref = None

# relative path inside the downloaded repo zip
REPO_GHUSER_SUBFOLDER = os.path.join("grasshopper", "user_objects")

# target folder name inside Grasshopper UserObjects
GHUSER_TARGET_FOLDER_NAME = "dewbee"

CUSTOM_ENV = os.environ.copy()
CUSTOM_ENV["PYTHONHOME"] = ""

# -----------------------------------------------------------------------------
# UI HELPERS
# -----------------------------------------------------------------------------

def give_warning(message):
    ghenv.Component.AddRuntimeMessage(Message.Warning, str(message))


def give_error(message):
    ghenv.Component.AddRuntimeMessage(Message.Error, str(message))


def give_popup_message(message, window_title=""):
    icon = System.Windows.Forms.MessageBoxIcon.Information
    buttons = System.Windows.Forms.MessageBoxButtons.OK
    Rhino.UI.Dialogs.ShowMessageBox(str(message), window_title, buttons, icon)


# -----------------------------------------------------------------------------
# FILE HELPERS
# -----------------------------------------------------------------------------
def remove_dist_info_files(directory, startswith_name=None):
    """Remove .dist-info folders, optionally filtering by prefix."""
    if not os.path.isdir(directory):
        return

    for name in os.listdir(directory):
        if not name.endswith(".dist-info"):
            continue
        if startswith_name is not None:
            if not name.lower().startswith(startswith_name.lower().replace("-", "_")):
                continue
        full_path = os.path.join(directory, name)
        print("Removing dist-info folder: {}".format(full_path))
        nukedir(full_path, rmdir=True)


def remove_existing_package(site_dir, package_name):
    """Remove any existing package folder and its dist-info from site_dir.

    This is needed because ``pip install --target --upgrade`` does not
    uninstall the previous version at the target first; it installs over it.
    If the previous install left files or a stale dist-info, or if another
    copy of the package exists earlier on sys.path, ``import`` can resolve to
    the wrong version. Wiping the target package dir + dist-info prior to
    install avoids that whole class of problem.
    """
    if not site_dir or not os.path.isdir(site_dir):
        return

    pkg_dir = os.path.join(site_dir, package_name)
    if os.path.isdir(pkg_dir):
        print("Removing existing package folder: {}".format(pkg_dir))
        nukedir(pkg_dir, rmdir=True)

    remove_dist_info_files(site_dir, startswith_name=package_name)


# -----------------------------------------------------------------------------
# DOWNLOAD HELPERS
# -----------------------------------------------------------------------------

def build_github_zip_url(owner, repo, ref):
    """
    Build GitHub archive URL.
    GitHub supports archive/refs/heads/<branch>.zip and archive/refs/tags/<tag>.zip.
    We try tag-style if ref starts with 'v', otherwise branch-style.
    """
    if ref and ref.startswith("v"):
        return "https://github.com/{}/{}/archive/refs/tags/{}.zip".format(owner, repo, ref)
    return "https://github.com/{}/{}/archive/refs/heads/{}.zip".format(owner, repo, ref or "main")


def expected_unzipped_repo_folder(base_dir, repo, ref):
    """Best-guess the name of the folder GitHub extracts from the archive zip.

    - For branch archives the folder is ``repo-<branch>``.
    - For tag archives, GitHub strips a leading ``v`` from the tag,
      so ``v0.1.1`` becomes the folder ``repo-0.1.1``.
    """
    if not ref:
        return os.path.join(base_dir, "{}-main".format(repo))
    folder_ref = ref
    if folder_ref[:1] in ("v", "V") and len(folder_ref) > 1 and folder_ref[1].isdigit():
        folder_ref = folder_ref[1:]
    return os.path.join(base_dir, "{}-{}".format(repo, folder_ref))

def download_and_extract_repo(owner, repo, ref, temp_root):
    """Download repo zip and return extracted repo directory."""
    url = build_github_zip_url(owner, repo, ref)
    zip_name = "{}_{}.zip".format(repo, ref or "main")
    zip_path = os.path.join(temp_root, zip_name)

    print("- " * 30)
    print("Downloading repo from GitHub:")
    print(url)

    preparedir(temp_root, remove_content=True)

    # This function downloads the file but does not return the path
    download_file_by_name(url, temp_root, zip_name, mkdir=True)

    if not os.path.isfile(zip_path):
        raise IOError("Zip file was not downloaded successfully:\n{}".format(zip_path))

    print("Downloaded zip to:")
    print(zip_path)

    unzip_file(zip_path, temp_root)

    extracted_repo_dir = expected_unzipped_repo_folder(temp_root, repo, ref or "main")

    if not os.path.isdir(extracted_repo_dir):
        candidates = []
        for name in os.listdir(temp_root):
            full = os.path.join(temp_root, name)
            if os.path.isdir(full) and name.startswith(repo + "-"):
                candidates.append(full)
        if len(candidates) == 1:
            extracted_repo_dir = candidates[0]

    if not os.path.isdir(extracted_repo_dir):
        raise IOError("Could not locate extracted repo folder inside:\n{}".format(temp_root))

    return zip_path, extracted_repo_dir

# -----------------------------------------------------------------------------
# LBT / PYTHON HELPERS
# -----------------------------------------------------------------------------

def run_pip_install(python_exe, package_name, version=None, target=None, env=None):
    """Install or update a package with pip."""
    if env is None:
        env = os.environ

    requirement = package_name if not version else "{}=={}".format(package_name, version)

    cmds = [python_exe, "-m", "pip", "install", requirement, "--no-deps", "--no-user", "--upgrade"]
    if target:
        cmds.extend(["--target", target])

    print("- " * 30)
    print("Running pip command:")
    print(" ".join(cmds))

    use_shell = True if os.name == "nt" else False
    process = subprocess.Popen(
        cmds,
        shell=use_shell,
        stdout=subprocess.PIPE,
        stderr=subprocess.PIPE,
        env=env
    )
    stdout, stderr = process.communicate()

    try:
        stdout = stdout.decode("utf-8")
    except Exception:
        stdout = str(stdout)

    try:
        stderr = stderr.decode("utf-8")
    except Exception:
        stderr = str(stderr)

    return process.returncode, stdout, stderr

def is_windows_user_admin():
    if os.name != "nt":
        return True

    try:
        import ctypes
        return ctypes.windll.shell32.IsUserAnAdmin() != 0
    except Exception:
        return False

def ensure_admin():
    if os.name == "nt" and not is_windows_user_admin():
        msg = (
            "Dewbee installer needs administrator privileges to write into:\n"
            "C:\\Program Files\\ladybug_tools\\python\\Lib\\site-packages\n\n"
            "Please close Rhino, right-click Rhino, choose 'Run as administrator', "
            "then run the installer again."
        )
        give_error(msg)
        give_popup_message(msg, "Administrator privileges required")
        raise Exception(msg)

# -----------------------------------------------------------------------------
# GH USER OBJECT INSTALL
# -----------------------------------------------------------------------------

def get_ghuser_target_folder():
    if not UserObjectFolders or len(UserObjectFolders) == 0:
        raise IOError("Could not find Grasshopper UserObjects directory.")
    base = UserObjectFolders[0]
    target = os.path.join(base, GHUSER_TARGET_FOLDER_NAME)
    return target

def install_ghuser_objects_from_repo(extracted_repo_dir, gh_target_folder):
    """Copy grasshopper/user_objects/* to GH UserObjects/dewbee."""
    source_ghuser_folder = os.path.join(extracted_repo_dir, REPO_GHUSER_SUBFOLDER)

    if not os.path.isdir(source_ghuser_folder):
        raise IOError(
            "Could not find expected GH user objects folder in repo:\n{}".format(source_ghuser_folder)
        )

    print("Copying .ghuser files from:\n{}\nTo:\n{}".format(source_ghuser_folder, gh_target_folder))
    preparedir(gh_target_folder, remove_content=True)
    copy_file_tree(source_ghuser_folder, gh_target_folder, overwrite=True)

def install_dewbee_materials_from_repo(extracted_repo_dir):
    """Copy dewbee_materials.json into Honeybee standards/constructions."""

    source_file = os.path.join(
        extracted_repo_dir,
        "resources",
        "standards",
        "dewbee_materials.json"
    )

    if not os.path.isfile(source_file):
        raise IOError(
            "Could not find dewbee_materials.json in repo:\n{}".format(source_file)
        )

    target_file = os.path.join(CONSTRUCTIONS_DIR, "dewbee_materials.json")

    print("Installing Dewbee materials from:")
    print(source_file)
    print("To:")
    print(target_file)
    shutil.copyfile(source_file, target_file)

def resolve_github_ref(user_github_ref, user_dewbee_ver, installed_version):
    """Resolve which GitHub ref to use for GH assets/materials."""
    if user_github_ref:
        return user_github_ref

    if user_dewbee_ver:
        return "v{}".format(user_dewbee_ver)

    if installed_version:
        return "v{}".format(installed_version)

    return "main"

# -----------------------------------------------------------------------------
# MAIN INSTALL
# -----------------------------------------------------------------------------

def verify_python_package(python_exe):
    """Read __version__ directly from the installed package file.

    We deliberately avoid ``import dewbee`` here: if another copy of dewbee
    is earlier on sys.path (e.g. a stale install in the user site-packages),
    ``import`` would return its version and mask the install we just did.
    Reading the file at PY_SITE directly guarantees we verify the install
    we actually performed.
    """
    init_path = os.path.join(PY_SITE, PYPI_IMPORT_NAME, "__init__.py")
    if not os.path.isfile(init_path):
        return 1, "", "Could not find {} after install.".format(init_path)

    try:
        with open(init_path, "r") as f:
            src = f.read()
    except Exception as e:
        return 1, "", "Could not read {}: {}".format(init_path, e)

    import re
    match = re.search(r"__version__\s*=\s*[\"']([^\"']+)[\"']", src)
    if not match:
        return 1, "", "Could not find __version__ in {}".format(init_path)

    return 0, match.group(1).strip(), ""

def install_dewbee(dewbee_version=None, github_ref=None):
    print("Ladybug Tools Python executable:")
    print(PY_EXE)
    print("Ladybug Tools site-packages:")
    print(PY_SITE)
    print("Ladybug Tools custom constructions folder")
    print(CONSTRUCTIONS_DIR)

    print("- " * 30)
    print("Installing Dewbee Python package into Ladybug Tools site-packages...")

    # Wipe any previous install at the target so --target --upgrade can't
    # leave stale files, and so a stale copy cannot shadow the new one.
    remove_existing_package(PY_SITE, PYPI_IMPORT_NAME)

    returncode, stdout, stderr = run_pip_install(
        python_exe=PY_EXE,
        package_name=PYPI_PACKAGE,
        version=dewbee_version,
        target=PY_SITE,
        env=CUSTOM_ENV
    )

    print(stdout)
    if stderr:
        print(stderr)

    if returncode != 0:
        raise Exception("pip install failed for '{}'.\n{}".format(PYPI_PACKAGE, stderr))

    check_code, check_out, check_err = verify_python_package(PY_EXE)
    if check_code != 0:
        raise Exception(
            "Dewbee installation could not be verified from Ladybug Tools Python.\n{}".format(check_err)
        )

    installed_version = check_out.strip()
    print("Verified Dewbee version in LBT Python: {}".format(installed_version))

    effective_github_ref = resolve_github_ref(
        user_github_ref=github_ref,
        user_dewbee_ver=dewbee_version,
        installed_version=installed_version
    )

    print("Using GitHub ref for GH assets/materials: {}".format(effective_github_ref))

    home_folder = os.getenv("HOME") or os.path.expanduser("~")
    temp_root = os.path.join(home_folder, "dewbee_installer_temp")
    gh_target = get_ghuser_target_folder()

    zip_path = None
    extracted_repo_dir = None

    try:
        zip_path, extracted_repo_dir = download_and_extract_repo(
            owner=GITHUB_OWNER,
            repo=GITHUB_REPO,
            ref=effective_github_ref,
            temp_root=temp_root
        )

        install_ghuser_objects_from_repo(
            extracted_repo_dir=extracted_repo_dir,
            gh_target_folder=gh_target
        )

        install_dewbee_materials_from_repo(
            extracted_repo_dir=extracted_repo_dir
        )

    finally:
        try:
            if zip_path and os.path.isfile(zip_path):
                os.remove(zip_path)
        except Exception:
            pass

        try:
            if extracted_repo_dir and os.path.isdir(extracted_repo_dir):
                nukedir(extracted_repo_dir, rmdir=True)
        except Exception:
            pass

        try:
            if os.path.isdir(temp_root):
                nukedir(temp_root, rmdir=True)
        except Exception:
            pass
    
    success_lines = [
        "Dewbee has been successfully installed.",
        "Verified Dewbee in Ladybug Tools Python: {}".format(check_out),
        "Grasshopper user objects installed to:",
        gh_target,
        "",
        "RESTART RHINO to load the new components and library."
    ]

    success_msg = "\n".join(success_lines)
    print(success_msg)
    give_popup_message(success_msg, "Dewbee Installation Successful")

# -----------------------------------------------------------------------------
# EXECUTION
# -----------------------------------------------------------------------------

if _run:
    ensure_admin()

    try:
        install_dewbee(
            dewbee_version=_dewbee_ver if _dewbee_ver else None,
            github_ref=_github_ref if _github_ref else None
        )
    except Exception as e:
        msg = "Dewbee installation failed:\n{}".format(e)
        print(msg)
        give_error(msg)
else:
    print("Set _run to True to install Dewbee.")
    print("Optional:")
    print("  _dewbee_ver  -> specific PyPI version, eg. 0.1.0")
# ---------- end dbinstallupdate ----------
panel_2 = Panel(dbinstallupdate)
