# Grasshopper definition DB Material Creation.ghx (Grasshopper 1.0.8)

# ----
# MASEA material
water_absorption_coefficient_kg_m2h1_2 = Panel("0")
water_content_at_rh80_kg_m3 = Panel("60")
free_water_saturation_kg_m3 = Panel("575")
moisture_content_m3_m3 = Panel("""0.030303692
0.057660924
0.086559384
0.113145967
0.574""")
dry_density_kg_m3 = Panel("400")
isotherm_rh = Panel("""0.499139772
0.798924672
0.899139746
0.969247242
0.999354819""")
processmasea = DBProcessMASEAData(
    density=dry_density_kg_m3,
    absorpt_coeff=water_absorption_coefficient_kg_m2h1_2,
    w_80=water_content_at_rh80_kg_m3,
    w_f=free_water_saturation_kg_m3,
    sorption_w_m3m3=moisture_content_m3_m3,
    sorption_rh=isotherm_rh)  # -> initial_w, sorption_w, sorption_rh, suction_w, suction_coeff, redist_w, redist_coeff; inputs sorption_w_m3m3: list, sorption_rh: list
# ---------- processmasea: Python ----------
"""
Process moisture-related data collected from the MASEA database into properties 
that can be plugged in the "HygroMat" component to create a hygrothermal material.
_
Link to MASEA: https://www.masea-ensan.com/

    Args:
        _density: Number for the density of the material [kg/m3].
            
        _absorpt_coeff: Number for the water absorption coefficient (A) [kg/(m2h1/2)]
            
        _w_80: Number for the water content at RH=80% [kg/m3]

        _w_f: Number for the water content at free saturation [kg/m3]
             
        _sorption_w_m3m3: A list of moisture contents for the sorption isotherm [m3/m3]
            This list must have the same length as _sorption_rh.
            _
            Note that the units are in m3/m3.
        _sorption_rh: A list of relative humidities between 0 and 1 for the 
            sorption isotherm [-].
            This list must have the same length as _sorption_w_m3m3.
            
    Returns:
        _initial_w: A number for the initial water content ratio [kg/kg]
            _
            This corresponds to _w_80 converted in kg/kg
        _sorption_w: A list of moisture contents for the sorption isotherm [kg/m3]
            This list must have the same length as _sorption_rh.
        _sorption_rh: A list of relative humidities between 0 and 1 for the 
            sorption isotherm [-].
        suction_w: A list of moisture contents for the liquid suction [kg/m3]
        suction_coeff: A list of (moisture-dependent) suction coefficients for 
            the liquid suction [m2/s].
        redist_w: A list of moisture contents for the liquid redistribution [kg/m3]
        redist_coeff: A list of (moisture-dependent) redistribution coefficients 
            for the liquid redistribution [m2/s].
        
"""

ghenv.Component.Name = "DB Process MASEA Data"
ghenv.Component.NickName = 'ProcessMASEA'
ghenv.Component.Message = '0.0.1'
ghenv.Component.Category = 'Dewbee'
ghenv.Component.SubCategory = "1 :: Constructions"

# Turn off the "old" tag
import ghpythonlib as ghlib
c = ghlib.component._get_active_component()
c.ToggleObsolete(False)

try:  # import ladybug_rhino dependencies
    from ladybug_rhino.grasshopper import all_required_inputs
except ImportError as e:
    raise ImportError('\nFailed to import ladybug_rhino:\n\t{}'.format(e))

# Suction liquid transport coefficient
# Based on moisture content (w) and free water saturation (wf)
def suction(A, w_f, w):
    if w <= 0: # start with 0
        return 0.0
    value = 3.8*(A/w_f)**2*1000**(w/w_f - 1)
    return max(value, 1e-15) # avoiding tiny values here
    
# Space moisture points geometrically to increase resolution near wf
def moisture_grid(w_f, n):
    return [w_f*(i/n)**2 for i in range(n+1)]


if all_required_inputs(ghenv.Component):
    # Convert (kg/m2h1/2) to (kg/m2s1/2)
    A_SI = _absorpt_coeff/60

    n_steps = 10
    suction_w = moisture_grid(_w_f, n_steps)
    suction_coeff = [suction(A_SI, _w_f, w) for w in suction_w]
    
    redist_w = suction_w
    redist_coeff = [v/10 for v in suction_coeff]
    
    initial_w = _w_80/_density
    
    sorption_w = [v*1000 for v in _sorption_w_m3m3]
    sorption_rh = _sorption_rh
    
    # Add w_f(RH=100%) if not already given
    if sorption_rh[-1] != 1 and _w_f > sorption_w[-1]:
        sorption_rh.append(1)
        sorption_w.append(_w_f)
# ---------- end processmasea ----------
thickness_m = Panel("0.02")
opaquemat = HBOpaqueMaterial(name="DB Softwood", thickness=thickness_m, conductivity="0.09", density=dry_density_kg_m3, spec_heat="1500")  # -> mat; plug-in component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
panel = Panel("""0.249377849
0.498395516
0.60055661
0.699738031
0.900229179
0.99855931""")
panel_2 = Panel("""180.714287
64.86607655
44.64287181
29.64285649
20
10.35714351""")
hygromat = DBHygrothermalMaterial(
    mat=opaquemat,
    porosity="0.73",
    initial_w=processmasea.initial_w,
    sorption_w=processmasea.sorption_w,
    sorption_rh=processmasea.sorption_rh,
    suction_w=processmasea.suction_w,
    suction_coeff=processmasea.suction_coeff,
    redist_w=processmasea.redist_w,
    redist_coeff=processmasea.redist_coeff,
    diff_rh=panel,
    diff_resist=panel_2,
    info="Source: MASEA, Weichholz")  # -> mat; inputs sorption_w: list, sorption_rh: list, suction_w: list, suction_coeff: list, redist_w: list, redist_coeff: list, diff_rh: list, diff_resist: list, conductivity_w: list, conductivity: list
# ---------- hygromat: Python ----------
"""
Create a hygrothermal opaque material from a standard HB opaque material, which 
can be plugged into the "HB Opaque Construction" component. 
_
Except for _porosity and _initial_w, all hygrothermal inputs must be entered as lists.
_ 
If you don't have enough data, use the standard "HB Opaque Material" instead. 
The HAMT model will only run on surfaces with constructions containing fully 
characterized hygrothermal properties. If all constructions are characterized, 
HAMT will be run for all surfaces.
_
Check MaterialProperty:HeatAndMoistureTransfer on EnergyPlus input-output documentation
for more information on the required inputs.
    Args:
        _mat: A standard HB opaque material object. For example, it can be the
        output of the "HB Opaque Material" component.
            
        _porosity: A number between 0 and 1 for the porosity.
        
        _initial_w_: A number for the initial water content ratio [kg/kg]
             _
             The initial water content is assumed to be distributed evenly through
             the depth of the material. UNITS ARE IN KG OF WATER PER KG OF DRY MATERIAL. (Default: 0)
             
        _sorption_w_: A list of moisture contents for the sorption isotherm [kg/m3]
            This list must have the same length as _sorption_rh. Required for hygroscopic materials.
            _
            EnergyPlus automatically sets w = 0 at rh = 0 and w = porosity*1000 
            at rh=1. If you provide values at rh=0 and rh=1, they override these defaults.
            Therefore, it is recommended to provide a point at rh=1 (w_f), because 
                orption should stop at a lower value, known as free saturation (w_f), because of air pockets
                trapped in the pore structure. For realistic predictions, remember 
            Supply increasing data up to the highest rh available for stability.
            _
            * Default *: when no curve is input, an artificial curve is created based
            on porosity. If at least w_80 and w_f are known, use the GenSorption component.
            
        _sorption_w_: A list of moisture contents for the sorption isotherm [kg/m3]
            This list must have the same length as _sorption_rh. Required for hygroscopic materials.
            _
            EnergyPlus automatically defines endpoints at rh = 0 (w = 0) and adds an
            internal maximum based on porosity. If you provide values at rh = 0 or 1,
            they override these defaults.
            _
            It is recommended to include a point at rh = 1.0 corresponding to free
            saturation (w_f), since real materials typically do not reach full pore
            saturation due to trapped air. This avoids overestimating moisture storage
            in the hygroscopic range.
            _
            Provide monotonically increasing values up to the highest available RH
            for numerical stability.
            _
            *Default*: If no curve is provided, an artificial isotherm is generated
            from porosity. If at least w_80 and w_f are known, use the GenSorption component.
        
        _sorption_rh_: A list of relative humidities between 0 and 1 for the 
            sorption isotherm [-]. Required for hygroscopic materials.
            This list must have the same length as _sorption_w.           
            
        _suction_w_: A list of moisture contents for the liquid suction [kg/m3]
            This list must have the same length as _suction_coeff. Required for capillary-active materials.
            _
            At least a datapoint at w = 0 is needed. The liquid coefficient at 
            the highest entered w is used for all values above this threshold. (Default: 0)

        _suction_coeff_: A list of (moisture-dependent) suction coefficients for 
            the liquid suction [m2/s]. Required for capillary-active materials.
            This list must have the same length as _suction_w
            _
            At least a datapoint at w = 0 is needed. The liquid coefficient at 
            the highest entered w is used for all values above this threshold.
            These coefficients are used when the rain flag is set in the epw. (Default: 0)
            
        _redist_w_: A list of moisture contents for the liquid redistribution [kg/m3].
            Required for capillary-active materials.
            This list must have the same length as _redist_coeff
            _
            At least a datapoint at w = 0 is needed. The liquid coefficient at 
            the highest entered w is used for all values above this threshold. (Default: 0)
            
        _redist_coeff_: A list of (moisture-dependent) redistribution coefficients 
            for the liquid redistribution [m2/s]. Required for capillary-active materials.
            This list must have the same length as _redist_w
             _
            At least a datapoint at w = 0 is needed. The liquid coefficient at 
            the highest entered w is used for all values above this threshold.
            These coefficients are used when the rain flag is NOT set in the epw. (Default: 0)
            
        _diff_rh: A list of relative humidities between 0 and 1 for the vapor 
            diffusion resistance factors [-].
            This list must have the same length as _diff_resist.
            _
            At least a datapoint at rh = 0 is needed. The diffusion resistance 
            factor at the highest entered rh is used for all values above this threshold.
        _diff_resist: A list of (moisture-dependent) vapor diffusion resistance 
            factors [-].
            This list must have the same length as _diff_rh.
            _
            At least a datapoint at rh = 0 is needed. The diffusion resistance 
            factor at the highest entered rh is used for all values above this threshold.
            
        _conductivity_w_: A list of moisture contents for the thermal conductivities [kg/m3]
            This list must have the same length as _conductivity.
            _
            At least a datapoint at w = 0 is needed (dry thermal conductivity). 
            The thermal conductivity at the highest entered w is used for all values 
            above this threshold. (Default: 0)
            
            
        _conductivity_: A list of (moisture-dependent) thermal conductivities [W/m-K] 
            This list must have the same length as _conductivity_w.
            _
            At least a datapoint at w = 0 is needed (dry thermal conductivity). 
            The thermal conductivity at the highest entered w is used for all values 
            above this threshold. (Default: dry conductivity from _mat)
            
        _info_: An optional string describing the material. This can be useful
            to document the source (e.g., MASEA).
    Returns:
        mat: A hygrothermal opaque material that can be assigned to a Honeybee
            Opaque construction.
"""

ghenv.Component.Name = "DB Hygrothermal Material"
ghenv.Component.NickName = 'HygroMat'
ghenv.Component.Message = '0.0.1'
ghenv.Component.Category = 'Dewbee'
ghenv.Component.SubCategory = "0 :: Constructions"

# Turn off the "old" tag
import ghpythonlib as ghlib
c = ghlib.component._get_active_component()
c.ToggleObsolete(False)

# Import dewbee dependencies
from dewbee import hygro_material
from dewbee import utils
reload(hygro_material)
reload(utils)
from dewbee.hygro_material import HygroMaterial
from dewbee.utils import rh_grid

try:  # import the honeybee-energy dependencies
    from honeybee_energy.material.opaque import EnergyMaterial
except ImportError as e:
    raise ImportError('\nFailed to import honeybee_energy:\n\t{}'.format(e))

try:  # import ladybug_rhino dependencies
    from ladybug_rhino.grasshopper import all_required_inputs
except ImportError as e:
    raise ImportError('\nFailed to import ladybug_rhino:\n\t{}'.format(e))

if all_required_inputs(ghenv.Component):
    # Set defaults
    if not _initial_w_:
        _initial_w_ = 0
    # Create artificial sorption curve
    if not _sorption_w_ and not _sorption_rh_:
        _sorption_rh_ = rh_grid()
        w_f = _porosity*0.05*1000 # assume w_f = 0.05*w_max 
        b = 1.01 # keeps the curve very steep
        _sorption_w_ = [w_f*(b-1)*rh/(b-rh) for rh in _sorption_rh_]
    if not _suction_w_ and not _suction_coeff_:
        _suction_w_ = [0]
        _suction_coeff_ = [0]
    if not _redist_w_ and not _redist_coeff_:
        _redist_w_ = [0]
        _redist_coeff_ = [0]
    if not _conductivity_w_ and not _conductivity_:
        _conductivity_w_ = [0]
        _conductivity_ = [_mat.conductivity]
    if not _info_:
        _info_ = ""
    mat = _mat.duplicate()
    identifier = mat.identifier
    hygro_mat = HygroMaterial(
        identifier,
        _porosity,
        _initial_w_,
        _sorption_w_,
        _sorption_rh_,
        _suction_w_,
        _suction_coeff_,
        _redist_w_,
        _redist_coeff_,
        _diff_rh,
        _diff_resist,
        _conductivity_w_,
        _conductivity_,
        )

    #Check if corresponding lists match
    hygro_mat.values_compatible()
    
    # Add HygroMaterial object as a dictionary to the standard EnergyMaterial
    mat.user_data = {"hygro_material": hygro_mat.to_dict(),
                     "info": _info_
                    }
# ---------- end hygromat ----------

# ----
# Generated liquid coefficients and wet thermal conductivity
free_water_saturation_kg_m3_2 = Panel("253.47")
water_absorption_coefficient_kg_m2s1_2 = Panel("0.089")
opaquemat_2 = HBOpaqueMaterial(name="DB Stabilized Rammed Earth", thickness="0.30", conductivity="0.643", density="1900", spec_heat="868")  # -> mat; plug-in component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
panel_3 = Panel("Source: Allinson, D. & Hall, M. Hygrothermal analysis of a stabilised rammed earth test building in the UK. Energy and Buildings 42, 845–852 (2010).")
liquidcoeff = DBLiquidCoefficients(absorpt_coeff=water_absorption_coefficient_kg_m2s1_2, w_f=free_water_saturation_kg_m3_2)  # -> suction_w, suction_coeff, redist_w, redist_coeff
# ---------- liquidcoeff: Python ----------
"""
Compute liquid transfer coefficients based on absorption coefficient and free 
saturation _w_f
_
This is only an approximation based on Künzel's exponential function. 

    Args:
        _absorpt_coeff: Number for the water absorption coefficient (A) [kg/(m2s1/2)]

        _w_f: Number for the water content at free saturation [kg/m3]
            
    Returns:
        suction_w: A list of moisture contents for the liquid suction [kg/m3]

        suction_coeff: A list of (moisture-dependent) suction coefficients for 
            the liquid suction [m2/s].
            
        redist_w: A list of moisture contents for the liquid redistribution [kg/m3]
        redist_coeff: A list of (moisture-dependent) redistribution coefficients 
            for the liquid redistribution [m2/s].
"""

ghenv.Component.Name = "DB Liquid Coefficients"
ghenv.Component.NickName = 'LiquidCoeff'
ghenv.Component.Message = '0.0.1'
ghenv.Component.Category = 'Dewbee'
ghenv.Component.SubCategory = "1 :: Constructions"

# Turn off the "old" tag
import ghpythonlib as ghlib
c = ghlib.component._get_active_component()
c.ToggleObsolete(False)

try:  # import ladybug_rhino dependencies
    from ladybug_rhino.grasshopper import all_required_inputs
except ImportError as e:
    raise ImportError('\nFailed to import ladybug_rhino:\n\t{}'.format(e))

# Suction liquid transport coefficient
# Based on moisture content (w) and free water saturation (wf)
def suction(A, w_f, w):
    if w <= 0: # start with 0
        return 0.0
    value = 3.8*(A/w_f)**2*1000**(w/w_f - 1)
    return max(value, 1e-15) # avoiding tiny values here
    
# Space moisture points geometrically to increase resolution near wf
def moisture_grid(w_f, n):
    return [w_f*(i/n)**2 for i in range(n+1)]

if all_required_inputs(ghenv.Component):
    n_steps = 10
    suction_w = moisture_grid(_w_f, n_steps)
    suction_coeff = [suction(_absorpt_coeff, _w_f, w) for w in suction_w]
    
    redist_w = suction_w
    redist_coeff = [v/10 for v in suction_coeff]
# ---------- end liquidcoeff ----------
panel_4 = Panel("""0.3285
0.4305
0.5815
0.7558
0.80
0.9406
1""")
panel_5 = Panel("""23.13
27.81
40.31
53.44
61.5
105.63
253.47""")
item = ListItem(List=panel_5, Index="4", Wrap=True)
division = Division(A=item, B="1900")
wetconductivity = DBWetThermalConductivity(conductivity_dry="0.643", conductivity_supplement="4.39", density="1900", porosity="0.295")  # -> conductivity_w, conductivity
# ---------- wetconductivity: Python ----------
"""
Generate moisture dependent thermal conductivity using a linear relationship.
conductivity = _conductivity_dry*(1+_conductivity_supplement*w/_bulk_density) 
    Args:
        _conductivity_dry: Number for the dry (10°C) thermal conductivity 
        of the material [W/m-K]
        _conductivity_supplement: Number for the linear supplement of thermal
        conductivity [%/M.-%]
        _porosity: A number between 0 and 1 for the porosity. 
            _
            This is the maximum fraction, by volume, of a material that can be
            taken up with moisture. It is used to calculate the maximum point of 
            conductivity_w.
            
        _density: A number for the dry density of the material [kg/m3]
    Returns:
        conductivity_w: A list of moisture contents for the thermal conductivities [kg/m3]

        conductivity: A list of (moisture-dependent) thermal conductivities [W/m-K]
"""

ghenv.Component.Name = "DB Wet Thermal Conductivity"
ghenv.Component.NickName = 'WetConductivity'
ghenv.Component.Message = '0.0.1'
ghenv.Component.Category = 'Dewbee'
ghenv.Component.SubCategory = "1 :: Constructions"

# Turn off the "old" tag
import ghpythonlib as ghlib
c = ghlib.component._get_active_component()
c.ToggleObsolete(False)

try:  # import ladybug_rhino dependencies
    from ladybug_rhino.grasshopper import all_required_inputs
except ImportError as e:
    raise ImportError('\nFailed to import ladybug_rhino:\n\t{}'.format(e))

# thermal conductivity of moist material
def lambda_w (w, lambda_0, b, rho):
    return lambda_0*(1+b*w/rho)

if all_required_inputs(ghenv.Component):
    w_max = _porosity*1000
    n_steps = 5
    step = w_max/n_steps
    conductivity_w = [i*step for i in range(n_steps+1)]
    conductivity = [lambda_w(w, _conductivity_dry, _conductivity_supplement, _density) 
                    for w in conductivity_w]
# ---------- end wetconductivity ----------
hygromat_2 = DBHygrothermalMaterial(
    mat=opaquemat_2,
    porosity="0.295",
    initial_w=division,
    sorption_w=panel_5,
    sorption_rh=panel_4,
    suction_w=liquidcoeff.suction_w,
    suction_coeff=liquidcoeff.suction_coeff,
    redist_w=liquidcoeff.redist_w,
    redist_coeff=liquidcoeff.redist_coeff,
    diff_rh="0",
    diff_resist="14.34",
    conductivity_w=wetconductivity.conductivity_w,
    conductivity=wetconductivity.conductivity,
    info=panel_3)  # -> mat; inputs sorption_w: list, sorption_rh: list, suction_w: list, suction_coeff: list, redist_w: list, redist_coeff: list, diff_rh: list, diff_resist: list, conductivity_w: list, conductivity: list; same code as hygromat

# ----
# Create hygrothermal material
# Fully characterized
panel_6 = Panel("DB Cellulose Insulation")
panel_7 = Panel("Source: EnergyPlus Reference DataSets, MoistureMaterials.idf")
opaquemat_3 = HBOpaqueMaterial(
    name=panel_6,
    thickness="0.066",
    conductivity="0.04",
    density="55",
    spec_heat="1880",
    roughness="Rough",
    therm_absp="0.9",
    sol_absp="0.70",
    vis_absp="0.70")  # -> mat; plug-in component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
panel_8 = Panel("""0
950""")
panel_9 = Panel("""0.04
0.583""")
panel_10 = Panel("""0.25
0.44
0.66
0.86
1""")
panel_11 = Panel("""2.365
4.62
6.655
11.4125
13""")
hygromat_3 = DBHygrothermalMaterial(
    mat=opaquemat_3,
    porosity="0.95",
    initial_w="0.001",
    sorption_w=panel_11,
    sorption_rh=panel_10,
    suction_w="0",
    suction_coeff="0",
    redist_w="0",
    redist_coeff="0",
    diff_rh="0",
    diff_resist="1.5",
    conductivity_w=panel_8,
    conductivity=panel_9,
    info=panel_7)  # -> mat; inputs sorption_w: list, sorption_rh: list, suction_w: list, suction_coeff: list, redist_w: list, redist_coeff: list, diff_rh: list, diff_resist: list, conductivity_w: list, conductivity: list; same code as hygromat

# ----
# Under-specified
thickness_m_2 = Panel("0.06")
panel_12 = Panel("Source: MASEA, XPS Extrudierter Polystyrol-Hartschaum 1 (Kernschicht)")
dry_density_kg_m3_2 = Panel("34")
opaquemat_4 = HBOpaqueMaterial(name="DB XPS", thickness=thickness_m_2, conductivity="0.04", density=dry_density_kg_m3_2, spec_heat="1450")  # -> mat; plug-in component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
hygromat_4 = DBHygrothermalMaterial(mat=opaquemat_4, porosity="0.95", diff_rh="0", diff_resist="70", info=panel_12)  # -> mat; inputs sorption_w: list, sorption_rh: list, suction_w: list, suction_coeff: list, redist_w: list, redist_coeff: list, diff_rh: list, diff_resist: list, conductivity_w: list, conductivity: list; same code as hygromat

# ----
# Search hygrothermal materials in the library
searchmats = HBSearchMaterials()  # -> opaque_mats, window_mats; plug-in component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
ishygromat = DBIsHygrothermalMaterial(material=searchmats.opaque_mats)  # -> result; inputs material: list
# ---------- ishygromat: Python ----------
"""
Check whether a material or a list of materials contains hygrothermal properties, 
such that it can be used to run a HAMT simulation using "DB Run HAMT Simulation".

    Args:
        _material: An opaque material or a list of opaque materials. This can 
            also be text for a material to be looked up in the material library. 

    Returns:
        result: True if material contains hygrothermal properties and can be used
            to run a HAMT simulation.
"""

ghenv.Component.Name = "DB Is Hygrothermal Material"
ghenv.Component.NickName = 'IsHygroMat'
ghenv.Component.Message = '0.0.1'
ghenv.Component.Category = 'Dewbee'
ghenv.Component.SubCategory = "1 :: Constructions"

# Import dewbee dependencies
from dewbee import hygro_material
from dewbee import utils
reload(hygro_material)
reload(utils)
from dewbee.hygro_material import HygroMaterial
from dewbee.utils import material_ishygro



try:  # import the honeybee-energy dependencies
    from honeybee_energy.lib.materials import opaque_material_by_identifier
    from honeybee_energy.lib.materials import window_material_by_identifier
    from honeybee_energy.material.glazing import EnergyWindowMaterialGlazing
except ImportError as e:
    raise ImportError('\nFailed to import honeybee_energy:\n\t{}'.format(e))
try:  # import ladybug_rhino dependencies
    from ladybug_rhino.grasshopper import all_required_inputs, give_warning
except ImportError as e:
    raise ImportError('\nFailed to import ladybug_rhino:\n\t{}'.format(e))


if all_required_inputs(ghenv.Component):
    result = []
    for _mat in _material:
        # check the input
        if isinstance(_mat, str):
            try:
                _mat = opaque_material_by_identifier(_mat)
            except ValueError:
                _mat = window_material_by_identifier(_mat)
        if isinstance(_mat, EnergyWindowMaterialGlazing):
            result.append(False)
        else:
            result.append(material_ishygro(_mat))
# ---------- end ishygromat ----------
dispatch = Dispatch(List=searchmats.opaque_mats, DispatchPattern=ishygromat)  # -> ListA, ListB
panel_13 = Panel(dispatch.ListA)

# ----
# Deconstruct hygrothermal material
panel_14 = Panel("DB Rammed Earth")
decnstrhygromat = DBDeconstructHygrothermalMaterial(mat=panel_14)  # -> name, porosity, initial_w, sorption_w, sorption_rh, suction_w, suction_coeff, redist_w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
# ---------- decnstrhygromat: Python ----------
"""
Deconstruct a hygrothermal opaque material into the attributes required to run HAMT
simulations. Note that the remaining material properties (e.g., thickness, density) 
can be retrieved as usual, with "HB Deconstruct Material".

    Args:
        _mat: A hygrothermal opaque material to be deconstructed. This can also be text for a
            material to be looked up in the material library. 

    Returns:
        
        name: Name of the hygrothermal material.
            
        porosity: A number between 0 and 1 for the *effective* porosity. It corresponds
            to the maximum fraction, by volume, of a material that can be taken up 
            with moisture.
            
        initial_w: A number for the initial water content ratio [kg/kg]
             
        sorption_w: A list of moisture contents for the sorption isotherm [kg/m3]
            
        sorption_rh: A list of relative humidities between 0 and 1 for the 
            sorption isotherm [-].    
            
        suction_w: A list of moisture contents for the liquid suction [kg/m3]

        suction_coeff: A list of (moisture-dependent) suction coefficients for 
            the liquid suction [m2/s].
            
        redist_w: A list of moisture contents for the liquid redistribution [kg/m3].
            
        redist_coeff: A list of (moisture-dependent) redistribution coefficients 
            for the liquid redistribution [m2/s].
            
        diff_rh: A list of relative humidities between 0 and 1 for the vapor 
            diffusion resistance factors [-].

        diff_resist: A list of (moisture-dependent) vapor diffusion resistance 
            factors [-].
            
        conductivity_w: A list of moisture contents for the thermal conductivities [kg/m3]
            
        conductivity: A list of (moisture-dependent) thermal conductivities [W/m-K] 
            
        info: String describing the material. 
"""

ghenv.Component.Name = "DB Deconstruct Hygrothermal Material"
ghenv.Component.NickName = 'DecnstrHygroMat'
ghenv.Component.Message = '0.0.1'
ghenv.Component.Category = 'Dewbee'
ghenv.Component.SubCategory = "1 :: Constructions"

# Import dewbee dependencies
from dewbee import hygro_material
from dewbee import utils
reload(hygro_material)
reload(utils)
from dewbee.hygro_material import HygroMaterial
from dewbee.utils import material_ishygro

import re

try:  # import the honeybee-energy dependencies
    from honeybee_energy.reader import parse_idf_string
    from honeybee_energy.lib.materials import opaque_material_by_identifier
    from honeybee_energy.lib.materials import window_material_by_identifier
except ImportError as e:
    raise ImportError('\nFailed to import honeybee_energy:\n\t{}'.format(e))
try:  # import ladybug_rhino dependencies
    from ladybug_rhino.grasshopper import all_required_inputs, give_warning
except ImportError as e:
    raise ImportError('\nFailed to import ladybug_rhino:\n\t{}'.format(e))
try:
    from ladybug.datatype.rvalue import RValue
    from ladybug.datatype.uvalue import UValue
except ImportError as e:
    raise ImportError('\nFailed to import ladybug:\n\t{}'.format(e))


if all_required_inputs(ghenv.Component):
    # check the input
    if isinstance(_mat, str):
        try:
            _mat = opaque_material_by_identifier(_mat)
        except ValueError:
            _mat = window_material_by_identifier(_mat)
    
    # check if material is hygrothermal
    if material_ishygro(_mat):    
        # get the values and attribute names from Dewbee HygroMat
        data = _mat.user_data["hygro_material"]
        hygro_mat = HygroMaterial.from_dict(data)
        
        name = hygro_mat.identifier
        porosity = hygro_mat.porosity
        initial_w = hygro_mat.initial_w
        sorption_w = hygro_mat.sorption_w
        sorption_rh = hygro_mat.sorption_rh
        suction_w = hygro_mat.suction_w
        suction_coeff = [str(c) for c in hygro_mat.suction_coeff]
        redist_w = hygro_mat.redist_w
        redist_coeff = hygro_mat.redist_coeff
        diff_rh = hygro_mat.diff_rh
        diff_resist = hygro_mat.diff_resist
        conductivity_w = hygro_mat.conductivity_w
        conductivity = hygro_mat.conductivity
        
        info = _mat.user_data["info"]
        print(suction_coeff)
    else:
        msg = "{} is not a hygrothermal material".format(_mat.identifier)
        raise TypeError (msg)
# ---------- end decnstrhygromat ----------
decnstrmat = HBDeconstructMaterial(mat=panel_14)  # -> values, attr_names, r_val_si, r_val_ip; plug-in component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
panel_15 = Panel(decnstrmat.attr_names)
entwine = Entwine(
    Branch00=decnstrhygromat.name,
    Branch01=decnstrhygromat.porosity,
    Branch02=decnstrhygromat.initial_w,
    Branch03=decnstrhygromat.sorption_w,
    Branch04=decnstrhygromat.sorption_rh,
    Branch05=decnstrhygromat.suction_w,
    Branch06=decnstrhygromat.suction_coeff,
    Branch07=decnstrhygromat.redist_w,
    Branch08=decnstrhygromat.redist_coeff,
    Branch09=decnstrhygromat.diff_rh,
    Branch010=decnstrhygromat.diff_resist,
    Branch011=decnstrhygromat.conductivity_w,
    Branch012=decnstrhygromat.conductivity,
    Branch013=decnstrhygromat.info,
    FlattenInputs=True)  # -> simplify(Result)
panel_16 = Panel(entwine)
panel_17 = Panel(decnstrmat.values)

ishygromat_2 = DBIsHygrothermalMaterial(material=["DB Spruce", "Generic Brick"])  # -> result; inputs material: list; same code as ishygromat
panel_18 = Panel(ishygromat_2)
