# Grasshopper definition DB Shoexbox HAMT.ghx (Grasshopper 1.0.8)
# plug-ins: LadybugGrasshopper

# ----
# Create Geometry
number_slider = Slider(4, range=0..5)
number_slider_2 = Slider(5, range=0..5)
dom = ConstructDomain(DomainStart=0, DomainEnd=number_slider_2)
dom_2 = ConstructDomain(DomainStart=0, DomainEnd=number_slider)
dom_3 = ConstructDomain(DomainStart=0, DomainEnd=Slider(2.7, range=0..5))
box = DomainBox(Base=PlaneXY(0, 0, 0), X=dom, Y=dom_2, Z=dom_3)
debrep = DeconstructBrep(Brep=box)  # -> Faces, Edges, Vertices
split = SplitList(List=debrep.Faces, Index="2")  # -> ListA, ListB

# ----
# Create hygrothermal construction
panel = Panel("DB Cellulose Insulation")
merge = Merge(Data1=panel, Data2="DB Rammed Earth")
ishygromat = DBIsHygrothermalMaterial(material=merge)  # -> result; inputs material: list
# ---------- ishygromat: Python ----------
"""
Check whether a material or a list of materials contains hygrothermal properties, 
such that it can be used to run a HAMT simulation using "DB Run HAMT Simulation".

    Args:
        _material: An opaque material or a list of opaque materials. This can 
            also be text for a material to be looked up in the material library. 

    Returns:
        result: True if material contains hygrothermal properties and can be used
            to run a HAMT simulation.
"""

ghenv.Component.Name = "DB Is Hygrothermal Material"
ghenv.Component.NickName = 'IsHygroMat'
ghenv.Component.Message = '0.0.1'
ghenv.Component.Category = 'Dewbee'
ghenv.Component.SubCategory = "1 :: Constructions"

# Import dewbee dependencies
from dewbee import hygro_material
from dewbee import utils
reload(hygro_material)
reload(utils)
from dewbee.hygro_material import HygroMaterial
from dewbee.utils import material_ishygro



try:  # import the honeybee-energy dependencies
    from honeybee_energy.lib.materials import opaque_material_by_identifier
    from honeybee_energy.lib.materials import window_material_by_identifier
    from honeybee_energy.material.glazing import EnergyWindowMaterialGlazing
except ImportError as e:
    raise ImportError('\nFailed to import honeybee_energy:\n\t{}'.format(e))
try:  # import ladybug_rhino dependencies
    from ladybug_rhino.grasshopper import all_required_inputs, give_warning
except ImportError as e:
    raise ImportError('\nFailed to import ladybug_rhino:\n\t{}'.format(e))


if all_required_inputs(ghenv.Component):
    result = []
    for _mat in _material:
        # check the input
        if isinstance(_mat, str):
            try:
                _mat = opaque_material_by_identifier(_mat)
            except ValueError:
                _mat = window_material_by_identifier(_mat)
        if isinstance(_mat, EnergyWindowMaterialGlazing):
            result.append(False)
        else:
            result.append(material_ishygro(_mat))
# ---------- end ishygromat ----------
opaqueconstr = HBOpaqueConstruction(name="Rammed Earth Wall", materials=merge)  # -> constr; plug-in component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
panel_2 = Panel(ishygromat)

# ----
# Create Honeybee Room
geo = Geometry(split.ListA)
geo_2 = Geometry(split.ListB)
face = HBFace(geo=geo_2, bc="adiabatic")  # -> report, faces; plug-in component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
face_2 = HBFace(geo=geo, bc="outdoors", ep_constr=opaqueconstr)  # -> report, faces; plug-in component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
south_wwr = Slider(0.4, range=0.1..0.9)
room = HBRoom(faces=flatten([face_2.faces, face.faces]), name="shoebox_room", conditioned=True)  # -> report, room; plug-in component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
merge_2 = Merge(Data1="0", Data2="0", Data3=south_wwr, Data4="0")
aperturesbyratio = HBAperturesByRatio(hb_objs=flatten(room.room), ratio=merge_2, subdivide=Toggle(False), operable=Toggle(True))  # -> report, hb_objs; plug-in component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

# ----
# Add moisture source
panel_3 = Panel("PlantMoisture")
moisturesource = DBMoistureSource(rooms=aperturesbyratio.hb_objs, name=panel_3, moisture_rate="40", schedule="Always On")  # -> rooms; inputs rooms: list, name: list, moisture_rate: list, schedule: list
# ---------- moisturesource: Python ----------
"""
Apply moisture source loads to Rooms using the Process object from Honeybee
-

    Args:
        _rooms: Honeybee Rooms to which process loads should be assigned.
        _name_: Text to set the name for the MoistureSource and to be incorporated
            into a unique MoistureSource identifier. If None, a unique name will
            be generated.
        _moisture_rate: A numerical value for the intensity of moisture generation
            in g/h. Typical cumulative values (you need to convert them to g/h!!!):
            * 200 g - Washing floors
            * 500 g - Dishwashing
            * 900-2000 g - Cooking for four
            * 200-400 g - Typical bathing/washing per person
            * 200-500 g - Five plants or one dog in a day
            _
            [Straube, J. F. (2002). Moisture in Buildings. ASHRAE Journal]
                
        _schedule_: A fractional schedule for the moisture over the course
            of the year. The fractional values will get multiplied by the
            _moisture_generation to yield a complete moisture generation 
            profile. Default: 'Always On'

    Returns:
        infil: An Infiltration object that can be used to create a ProgramType or
            be assigned directly to a Room.
"""

ghenv.Component.Name = 'DB Moisture Source'
ghenv.Component.NickName = 'MoistureSource'
ghenv.Component.Message = '0.0.1'
ghenv.Component.Category = 'Dewbee'
ghenv.Component.SubCategory = "0 :: Miscellaneous"

# Turn off the "old" tag
import ghpythonlib as ghlib
c = ghlib.component._get_active_component()
c.ToggleObsolete(False)

try:  # import the honeybee extension
    from honeybee.typing import clean_and_id_ep_string, clean_ep_string
except ImportError as e:
    raise ImportError('\nFailed to import honeybee:\n\t{}'.format(e))

try:  # import the honeybee-energy extension
    from honeybee_energy.load.process import Process
    from honeybee_energy.lib.schedules import schedule_by_identifier
except ImportError as e:
    raise ImportError('\nFailed to import honeybee_energy:\n\t{}'.format(e))

try:
    from ladybug_rhino.grasshopper import all_required_inputs, longest_list
except ImportError as e:
    raise ImportError('\nFailed to import ladybug_rhino:\n\t{}'.format(e))
    

if all_required_inputs(ghenv.Component):
    # duplicate the initial objects
    rooms = [room.duplicate() for room in _rooms]

    # set default values and check the inputs
    use_category_ = ['Moisture']
    fuel_type = ['None']
    radiant_fract_ = [0.0]
    latent_fract_ = [1]
    lost_fract_ = [0.0]
    for i, sched in enumerate(_schedule):
        if isinstance(sched, str):
            _schedule[i] = schedule_by_identifier(sched)

    # Convert moisture rate from g/h to W
    _watts = [moist / 3600 * 2450 for moist in _moisture_rate] # W
    
    # loop through the rooms and assign moisture loads
    for i, room in enumerate(rooms):
        load_watts = longest_list(_watts, i)
        if load_watts != 0:
            name = clean_and_id_ep_string('Process') if len(_name_) == 0 else \
                clean_ep_string(longest_list(_name_, i))
            process = Process(
                '{}..{}'.format(name, room.identifier), load_watts,
                longest_list(_schedule, i), longest_list(fuel_type, i),
                longest_list(use_category_, i), longest_list(radiant_fract_, i),
                longest_list(latent_fract_, i), longest_list(lost_fract_, i)
            )
            room.properties.energy.add_process_load(process)
# ---------- end moisturesource ----------

model = HBModel(rooms=flatten(moisturesource))  # -> report, model; plug-in component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

# ---- group: Recommended: timestep > 20
timestep = Slider(20, range=0..100)

# ----
# Visualize
facesbyalgo = DBFacesByAlgorithm(hb_objs=flatten(model.model))  # -> hygro_faces, non_hygro_faces; inputs hb_objs: list
# ---------- facesbyalgo: Python ----------
"""
Get faces that will be run with HAMT (hygro_faces) and those that will be run with
regular CTF simulations (non_hygro_faces). Note that this can include Face, Door 
and InternalMass objects.
-

    Args:
        _hb_objs: An array of honeybee Models, Rooms or Faces objects to be
            separated into hygro and non hygro faces.

    Returns:
        hygro_faces: Honeybee objects that contain fully characterized hygrothermal 
        constructions and will be used in the HAMT simulations.
        non_hygro_faces: Honeybee objects that do NOT contain fully characterized 
        hygrothermal constructions and will NOT be used in the HAMT simulations.
"""

ghenv.Component.Name = 'DB Faces by Algorithm'
ghenv.Component.NickName = 'FacesByAlgo'
ghenv.Component.Message = '0.0.1'
ghenv.Component.Category = 'Dewbee'
ghenv.Component.SubCategory = '0 :: Miscellaneous'

# Turn off the "old" tag
import ghpythonlib as ghlib
c = ghlib.component._get_active_component()
c.ToggleObsolete(False)

# Import dewbee dependencies
from dewbee import utils
reload(utils)
from dewbee.utils import get_hygro_and_non_hygro_faces

from ladybug_rhino.grasshopper import all_required_inputs

if all_required_inputs(ghenv.Component):
    hygro_faces, non_hygro_faces = get_hygro_and_non_hygro_faces(_hb_objs)
# ---------- end facesbyalgo ----------
vizwiref = HBVisualizeWireframe(hb_objs=flatten(model.model))  # -> geo; plug-in component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
vizquick = HBVisualizeQuick(hb_objs=flatten(facesbyalgo.hygro_faces))  # -> geo; plug-in component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
preview = CustomPreview(Geometry=vizquick, Material=ColourSwatch(SwatchColor=RGBA(154, 237, 222, 118)))
preview_2 = CustomPreview(Geometry=vizwiref, Material=ColourSwatch(SwatchColor=RGB(0, 0, 0)))

# ---- group: Recommended: n > 1
n_years_to_simulate = Slider(2, range=1..10)

# ----
# Simulate
toggle = BooleanToggle(True)
simoutput = HBSimulationOutput(
    zone_energy_use=toggle,
    gains_and_losses=toggle,
    comfort_metrics=toggle,
    surface_temperature=toggle,
    surface_energy_flow=toggle)  # -> report, sim_output; plug-in component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
simpar = HBSimulationParameter(output=simoutput.sim_output, timestep=timestep)  # -> sim_par; plug-in component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
epw_url = Panel("https://climate.onebuilding.org/WMO_Region_6_Europe/CHE_Switzerland/ZH_Zurich/CHE_ZH_Zurich.Fluntern.066600_TMYx.zip")
downloadepw = LBDownloadWeather(weather_URL=epw_url)  # -> epw_file, stat_file, ddy_file; plug-in component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
falsestart = LBFalseStartToggle(True)
runhamt = DBRunHAMTSimulation(
    model=model.model,
    epw_file=downloadepw.epw_file,
    sim_par=simpar,
    sim_years=n_years_to_simulate,
    write=falsestart,
    run=falsestart)  # -> report, jsons, osw, osm, idf, sql, zsz, rdd, html, add_str; inputs measures: list, add_str: list, warmup_days: Int32, sim_years: Int32, run_hamt: Boolean, write: Boolean, run: Int32
# ---------- runhamt: Python ----------
"""
Write a honeybee Model to an OSM file (OpenStudio Model), which can then be 
translated with the necessary hygrothermal data to an IDF file in order to 
run EnergyPlus Combined Heat and Moisture Transfer (HAMT) model.
_
Note that this component automatically extract the relevant hygrothermal data from
the honeybee Model, such as moisture sources and hygrothermal material data. The 
HAMT model is only applied to surfaces that have constructions with hygrothermal
material properties. The default Conduction Transfer Function (CTF) solver is applied
to all remaining surfaces.

-
    Args:
        _model: A honeybee model object possessing all geometry and corresponding
            energy simulation properties.
        _epw_file: Path to an .epw file on this computer as a text string.
        _sim_par_: A honeybee Energy SimulationParameter object that describes all
            of the setting for the simulation. If None, some default simulation
            parameters will automatically be used. It is highly recommended that
            at least 20 timesteps per hours are used in HAMT simulations.
        measures_: An optional list of measures to apply to the OpenStudio model
            upon export. Use the "HB Load Measure" component to load a measure
            into Grasshopper and assign input arguments. Measures can be
            downloaded from the NREL Building Components Library (BCL) at
            (https://bcl.nrel.gov/).
        add_str_: THIS OPTION IS JUST FOR ADVANCED USERS OF ENERGYPLUS.
            You can input additional text strings here that you would like
            written into the IDF.  The input here should be complete EnergyPlus
            objects as a single string following the IDF format. This input can
            be used to write objects into the IDF that are not currently supported
            by Honeybee.
        _folder_: An optional folder on this computer, into which the IDF and result
            files will be written.
        warmup_days_: An optional number for the amount of warm up days that precede
            the simulation. In HAMT simulations, increasing this number helps with 
            convergence. (Default: 100)
        sim_years_: An optional number for the amount of years to be simulated. In HAMT simulations,
            increasing this number allows the model to reach periodic equilibrium. If the 
            _initial_w_ of some materials is very high, the building might take multiple years to dry out.
            Conversely, if _initial_w_ is very low, the building might take many years to adsorb 
            moisture. (Default: 1).
            _
            Note that when sim_years_ > 1, sql result files must be read with custom
            Dewbee results components, because Honeybee does not support multiple years
            results.
        run_hamt_: Set to "False" to use the default EnergyPlus solver (CTF) for all 
            surfaces. This can be useful when comparing multiple models. (Default: "True")
            _
            If run_hamt_ = "True", the HAMT algorithm will be run to all surfaces 
            that have constructions with hygrothermal material properties.
        _write: Set to "True" to write out the honeybee JSONs (containing the Honeybee
            Model and Simulation Parameters) and write the OpenStudio Model file (OSM).
            This process will also write either an EnergyPlus Input Data File (IDF)
            or an OpenStudio Workflow file (OSW), which can be used to run the
            model through EnergyPlus. Most models can be simulated with just
            and IDF and so no OWS will be written. However, an OSW will be used
            if any measures_ have been connected or if the simulation parameters
            contain an efficiency standard.
        run_: Set to "True" to translate the Honeybee jsons to an OpenStudio Model
            (.osm) and EnergyPlus Input Data File (.idf) and then simulate the
            .idf in EnergyPlus. This will ensure that all result files appear
            in their respective outputs from this component.
            _
            This input can also be the integer "2", which will run the whole translation
            and simulation silently (without any batch windows).

    Returns:
        report: Check here to see a report of the EnergyPlus run.
        jsons: The file paths to the honeybee JSON files that describe the Model and
            SimulationParameter. These will be translated to an OpenStudio model.
        osw: File path to the OpenStudio Workflow JSON on this machine (if necessary
            for simulation). This workflow is executed using the OpenStudio
            command line interface (CLI) and it includes any connected
            measures_. Will be None if no OSW is needed for the simulation.
        osm: The file path to the OpenStudio Model (OSM) that has been generated
            on this computer.
        idf: The file path of the EnergyPlus Input Data File (IDF) that has been
            generated on this computer.
        sql: The file path of the SQL result file that has been generated on this
            computer. This will be None unless run_ is set to True.
        zsz: Path to a .csv file containing detailed zone load information recorded
            over the course of the design days. This will be None unless run_ is
            set to True.
        rdd: The file path of the Result Data Dictionary (.rdd) file that is
            generated after running the file through EnergyPlus.  This file
            contains all possible outputs that can be requested from the EnergyPlus
            model. Use the "HB Read Result Dictionary" component to see what outputs
            can be requested.
        html: The HTML file path containing all requested Summary Reports.
"""

ghenv.Component.Name = 'DB Run HAMT Simulation'
ghenv.Component.NickName = 'RunHAMT'
ghenv.Component.Message = '0.0.1'
ghenv.Component.Category = 'Dewbee'
ghenv.Component.SubCategory = "2 :: Simulation"

import os
import re
import json
import subprocess

# Turn off the "old" tag
import ghpythonlib as ghlib
c = ghlib.component._get_active_component()
c.ToggleObsolete(False)

# Import dewbee dependencies
from dewbee import utils
reload(utils)
from dewbee.utils import generate_hygro_idf, edit_idf

try:
    from ladybug.futil import preparedir, nukedir, copy_file_tree
    from ladybug.epw import EPW
    from ladybug.stat import STAT
except ImportError as e:
    raise ImportError('\nFailed to import ladybug:\n\t{}'.format(e))

try:
    from honeybee.config import folders
    from honeybee.model import Model
except ImportError as e:
    raise ImportError('\nFailed to import honeybee:\n\t{}'.format(e))

try:
    from honeybee_energy.simulation.parameter import SimulationParameter
    from honeybee_energy.measure import Measure
    from honeybee_energy.run import to_openstudio_sim_folder, run_osw, run_idf, \
        output_energyplus_files, _parse_os_cli_failure
    from honeybee_energy.result.err import Err
    from honeybee_energy.config import folders as energy_folders
    from honeybee_energy.writer import generate_idf_string
except ImportError as e:
    raise ImportError('\nFailed to import honeybee_energy:\n\t{}'.format(e))

try:
    from honeybee_openstudio.openstudio import OSModel
except (ImportError, AssertionError):  # Openstudio C# bindings are not usable
    OSModel = None

try:
    from lbt_recipes.version import check_openstudio_version
except ImportError as e:
    raise ImportError('\nFailed to import lbt_recipes:\n\t{}'.format(e))

try:
    from ladybug_rhino.grasshopper import all_required_inputs, give_warning
    from ladybug_rhino.config import units_system
except ImportError as e:
    raise ImportError('\nFailed to import ladybug_rhino:\n\t{}'.format(e))

ROOM_COUNT_THRESH = 1000  # threshold at which the CLI is used for translation


def measures_to_folder(measures, sim_folder):
    osw_dict = {}  # dictionary that will be turned into the OSW JSON
    osw_dict['steps'] = []
    mea_folder = os.path.join(sim_folder, 'measures')
    # ensure measures are correctly ordered
    m_dict = {'ModelMeasure': [], 'EnergyPlusMeasure': [], 'ReportingMeasure': []}
    for measure in measures:
        assert isinstance(measure, Measure), 'Expected honeybee-energy Measure. ' \
            'Got {}.'.format(type(measure))
        m_dict[measure.type].append(measure)
    sorted_measures = m_dict['ModelMeasure'] + m_dict['EnergyPlusMeasure'] + \
        m_dict['ReportingMeasure']
    # add the measures and the measure paths to the OSW
    for measure in sorted_measures:
        measure.validate()  # ensure that all required arguments have values
        osw_dict['steps'].append(measure.to_osw_dict())  # add measure to workflow
        dest_folder = os.path.join(mea_folder, os.path.basename(measure.folder))
        copy_file_tree(measure.folder, dest_folder)
        test_dir = os.path.join(dest_folder, 'tests')
        if os.path.isdir(test_dir):
            nukedir(test_dir, rmdir=True)
    # write the dictionary to a workflow.osw
    osw_json = os.path.join(mea_folder, 'workflow.osw')
    try:
        with open(osw_json, 'w') as fp:
            json.dump(osw_dict, fp, indent=4)
    except UnicodeDecodeError:  # non-unicode character in the dictionary
        with open(osw_json, 'w') as fp:
            json.dump(osw_dict, fp, indent=4, ensure_ascii=False)
    return mea_folder


if all_required_inputs(ghenv.Component) and _write:
    # check the presence of openstudio and check that the version is compatible
    check_openstudio_version()
    assert isinstance(_model, Model), \
        'Expected Honeybee Model for _model input. Got {}.'.format(type(_model))

    # process the simulation parameters
    if _sim_par_ is None:
        sim_par = SimulationParameter()
        sim_par.output.add_zone_energy_use()
        sim_par.output.add_hvac_energy_use()
        sim_par.output.add_electricity_generation()
    else:
        sim_par = _sim_par_.duplicate()  # ensure input is not edited

    # assign design days from the DDY next to the EPW if there are None
    folder, epw_file_name = os.path.split(_epw_file)
    if len(sim_par.sizing_parameter.design_days) == 0:
        msg = None
        ddy_file = os.path.join(folder, epw_file_name.replace('.epw', '.ddy'))
        if os.path.isfile(ddy_file):
            try:
                sim_par.sizing_parameter.add_from_ddy_996_004(ddy_file)
            except AssertionError:
                pass
            if len(sim_par.sizing_parameter.design_days) == 0:
                msg = 'No ddy_file_ was input into the _sim_par_ sizing ' \
                    'parameters\n and no design days were found in the .ddy file '\
                    'next to the _epw_file.'
        else:
             msg = 'No ddy_file_ was input into the _sim_par_ sizing parameters\n' \
                'and no .ddy file was found next to the _epw_file.'
        if msg is not None:
            epw_obj = EPW(_epw_file)
            des_days = [epw_obj.approximate_design_day('WinterDesignDay'),
                        epw_obj.approximate_design_day('SummerDesignDay')]
            sim_par.sizing_parameter.design_days = des_days
            msg = msg + '\nDesign days were generated from the input _epw_file but this ' \
                '\nis not as accurate as design days from DDYs distributed with the EPW.'
            give_warning(ghenv.Component, msg)
            print(msg)
    if sim_par.sizing_parameter.climate_zone is None:
        stat_file = os.path.join(folder, epw_file_name.replace('.epw', '.stat'))
        if os.path.isfile(stat_file):
            stat_obj = STAT(stat_file)
            sim_par.sizing_parameter.climate_zone = stat_obj.ashrae_climate_zone

    # process the simulation folder name and the directory
    _folder_ = folders.default_simulation_folder if _folder_ is None else _folder_
    clean_name = re.sub(r'[^.A-Za-z0-9_-]', '_', _model.display_name)
    directory = os.path.join(_folder_, clean_name, 'openstudio')

    # delete any existing files in the directory and prepare it for simulation
    nukedir(directory, True)
    preparedir(directory)
    sch_directory = os.path.join(directory, 'schedules')
    preparedir(sch_directory)

    # write the model and simulation parameter to JSONs
    model_json = os.path.join(directory, '{}.hbjson'.format(clean_name))
    with open(model_json, 'wb') as fp:
        model_str = json.dumps(_model.to_dict(), ensure_ascii=False)
        fp.write(model_str.encode('utf-8'))
    sim_par_json = os.path.join(directory, 'simulation_parameter.json')
    with open(sim_par_json, 'w') as fp:
        json.dump(sim_par.to_dict(), fp)
    jsons = [model_json, sim_par_json]
    
    run_hamt_ = True if run_hamt_ is None else run_hamt_
    if run_hamt_ > 0:
        # ------------------------------------------------------------------------------
            # Add hygrothermal objects as additional IDF strings
            idf_str, msg = generate_hygro_idf(_model)
            if msg:
                give_warning(ghenv.Component, msg)
            add_str_.append(idf_str)
        
            # Assign default values for edit_idf()
            warmup_days_ = 100 if warmup_days_ is None else warmup_days_
            sim_years_ = 1 if sim_years_ is None else sim_years_
    else:
        warmup_days_ = 25
        sim_years_ = 1
# ------------------------------------------------------------------------------
    # Run the translation with IronPython
    add_str = '\n'.join(add_str_) if len(add_str_) != 0 and \
        add_str_[0] is not None else None
    osm, osw, idf = to_openstudio_sim_folder(
        _model, directory, epw_file=_epw_file, sim_par=sim_par,
        schedule_directory=sch_directory, enforce_rooms=True,
        additional_measures=measures_, strings_to_inject=add_str)
        # ----------------------------------------------------------------------
    # Edit idf to include warmup days and multiple years to simulation
    idf = edit_idf(idf, warmup_days_, sim_years_)
    # ----------------------------------------------------------------------

    if run_ > 0:
        silent = True if run_ > 1 else False
        if idf is not None:  # run the IDF directly through E+
            sql, zsz, rdd, html, err = run_idf(idf, _epw_file, silent=silent)
        else:
            osm, idf = run_osw(osw, measures_only=False, silent=silent)
            if idf is None or not os.path.isfile(idf):
                _parse_os_cli_failure(directory)
            sql, zsz, rdd, html, err = output_energyplus_files(os.path.dirname(idf))

    # parse the error log and report any warnings
    if run_ >= 1 and err is not None:
        err_obj = Err(err)
        print(err_obj.file_contents)
        for warn in err_obj.severe_errors:
            give_warning(ghenv.Component, warn)
        for error in err_obj.fatal_errors:
            raise Exception(error)
# ---------- end runhamt ----------

# ----
# Read multiyear results
number_slider_3 = Slider(2, range=1..3)
multiyearfaceresult = DBReadFaceResultForMultipleYears(year=number_slider_3)  # -> face_indoor_temp, face_outdoor_temp, opaque_energy_flow, window_loss, window_gain; inputs year: Int32
#   port opaque_energy_flow: DataCollections for the mean radiant temperature of each room (C).
#   port window_loss: DataCollections for the relative humidity of each room (%).
#   port window_gain: DataCollections for time that the heating setpoint is not met in each room (hours).
# ---------- multiyearfaceresult: Python ----------
"""
Parse all of the common Face-level comfort-related results per simulated year
from an SQL result file that has been generated from an energy simulation.

_
Note that this component only works in Windows, with hourly data for periods
longer than 1 year.

-
    Args:
        _sql: The file path of the SQL result file that has been generated from
            an energy simulation.
        _year: The simulation year to extract.

    Returns:
        face_indoor_temp: DataCollections for the indoor surface temperature of
            each surface (C).
        face_outdoor_temp: DataCollections for the outdoor surface temperature
            of each surface (C).
        face_energy_flow: DataCollections for the heat loss (negative) or heat
            gain (positive) through each building surfaces (kWh).
"""

ghenv.Component.Name = 'DB Read Face Result for Multiple Years'
ghenv.Component.NickName = 'MultiyearFaceResult'
ghenv.Component.Message = '0.0.1'
ghenv.Component.Category = 'Dewbee'
ghenv.Component.SubCategory = "3 :: Results"

import os

# Turn off the "old" tag
import ghpythonlib as ghlib
c = ghlib.component._get_active_component()
c.ToggleObsolete(False)

# Import dewbee dependencies
from dewbee import multiyear_sql
reload(multiyear_sql)
from dewbee.multiyear_sql import MultiYearSQLiteResult

try:
    from ladybug_rhino.grasshopper import all_required_inputs
except ImportError as e:
    raise ImportError('\nFailed to import ladybug_rhino:\n\t{}'.format(e))


def subtract_loss_from_gain(gain_load, loss_load):
    """Create a single DataCollection list from gains and losses."""
    total_loads = []
    for gain, loss in zip(gain_load, loss_load):
        total_load = gain - loss
        if 'type' in total_load.header.metadata:
            total_load.header.metadata['type'] = \
                total_load.header.metadata['type'].replace('Gain ', '')
        total_loads.append(total_load)
    return total_loads


# List of all the output strings that will be requested
face_indoor_temp_output = 'Surface Inside Face Temperature'
face_outdoor_temp_output = 'Surface Outside Face Temperature'
opaque_energy_flow_output = 'Surface Inside Face Conduction Heat Transfer Energy'
window_loss_output = 'Surface Window Heat Loss Energy'
window_gain_output = 'Surface Window Heat Gain Energy'

all_output = [
    face_indoor_temp_output,
    face_outdoor_temp_output,
    opaque_energy_flow_output,
    window_loss_output,
    window_gain_output
]


if all_required_inputs(ghenv.Component):
    assert os.path.isfile(_sql), 'No sql file found at: {}.'.format(_sql)

    if os.name == 'nt':
        sql_obj = MultiYearSQLiteResult(_sql)

        # Fetch all requested outputs for the specified year in one go
        all_results = sql_obj.data_collections_by_output_names_and_year(all_output, _year)

        # Unpack results
        face_indoor_temp = all_results[face_indoor_temp_output]
        face_outdoor_temp = all_results[face_outdoor_temp_output]
        opaque_energy_flow = all_results[opaque_energy_flow_output]
        window_loss = all_results[window_loss_output]
        window_gain = all_results[window_gain_output]

        # Combine window gain/loss into net window energy flow
        window_energy_flow = []
        if len(window_gain) == len(window_loss):
            window_energy_flow = subtract_loss_from_gain(window_gain, window_loss)

        # Combine opaque and window results
        face_energy_flow = opaque_energy_flow + window_energy_flow

    else:
        raise NotImplementedError(
            'This multi-year component currently only works on Windows.'
        )
# ---------- end multiyearfaceresult ----------
# Ventilation schedule
multiyearroomenergyresult = DBReadRoomEnergyResultForMultipleYears(year=number_slider_3)  # -> cooling, heating, lighting, electric_equip, gas_equip, process, hot_water, fan_electric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; inputs year: Int32
# ---------- multiyearroomenergyresult: Python ----------
"""
Parse all of the common Room-level energy-related results per simulated year
from an SQL result file that has been generated from an energy simulation.
_
Note that this component only works in Windows, with hourly/daily/monthly data
for periods longer than 1 year.

    Args:
        _sql: The file path of the SQL result file that has been generated from
            an energy simulation.
        _year: The simulation year to extract.

    Returns:
        cooling: DataCollections for the cooling energy in kWh. For Ideal Air
            loads, this output is the sum of sensible and latent heat that must
            be removed from each room. For detailed HVAC systems, this output
            will be electric energy needed to power each chiller/cooling coil.
        heating: DataCollections for the heating energy needed in kWh. For Ideal
            Air loads, this is the heat that must be added to each room. For
            detailed HVAC systems, this will be fuel energy or electric energy
            needed for each boiler/heating element.
        lighting: DataCollections for the electric lighting energy used for
            each room in kWh.
        electric_equip: DataCollections for the electric equipment energy used
            for each room in kWh.
        gas_equip: DataCollections for the gas equipment energy used for each
            room in kWh.
        process: DataCollections for the process load energy used for each
            room in kWh.
        hot_water: DataCollections for the service hot water energy used for
            each room in kWh.
        fan_electric: DataCollections for the fan electric energy in kWh for
            either a ventilation fan or a HVAC system fan.
        pump_electric: DataCollections for the water pump electric energy in kWh
            for a heating/cooling system.
        people_gain: DataCollections for the internal heat gains in each room
            resulting from people (kWh).
        solar_gain: DataCollections for the total solar gain in each room (kWh).
        infiltration_load: DataCollections for the heat loss (negative) or heat
            gain (positive) in each room resulting from infiltration (kWh).
        mech_vent_load: DataCollections for the heat loss (negative) or heat gain
            (positive) in each room resulting from the outdoor air coming through
            the HVAC System (kWh).
        nat_vent_load: DataCollections for the heat loss (negative) or heat gain
            (positive) in each room resulting from natural ventilation (kWh).
"""

ghenv.Component.Name = 'DB Read Room Energy Result for Multiple Years'
ghenv.Component.NickName = 'MultiyearRoomEnergyResult'
ghenv.Component.Message = '0.0.1'
ghenv.Component.Category = 'Dewbee'
ghenv.Component.SubCategory = "3 :: Results"

import os
import subprocess
import json

# Turn off the "old" tag
import ghpythonlib as ghlib
c = ghlib.component._get_active_component()
c.ToggleObsolete(False)

try:
    from ladybug.datacollection import HourlyContinuousCollection, \
        MonthlyCollection, DailyCollection
except ImportError as e:
    raise ImportError('\nFailed to import ladybug:\n\t{}'.format(e))

try:
    from honeybee_energy.result.loadbalance import LoadBalance
except ImportError as e:
    raise ImportError('\nFailed to import honeybee_energy:\n\t{}'.format(e))

try:
    from ladybug_rhino.grasshopper import all_required_inputs
except ImportError as e:
    raise ImportError('\nFailed to import ladybug_rhino:\n\t{}'.format(e))

# Import dewbee dependencies
from dewbee import multiyear_sql
reload(multiyear_sql)
from dewbee.multiyear_sql import MultiYearSQLiteResult


def subtract_loss_from_gain(gain_load, loss_load):
    """Create a single DataCollection from gains and losses."""
    total_loads = []
    for gain, loss in zip(gain_load, loss_load):
        total_load = gain - loss
        total_load.header.metadata['type'] = \
            total_load.header.metadata['type'].replace('Gain ', '')
        total_loads.append(total_load)
    return total_loads


def serialize_data(data_dicts):
    """Reserialize a list of collection dictionaries."""
    if len(data_dicts) == 0:
        return []
    elif data_dicts[0]['type'] == 'HourlyContinuous':
        return [HourlyContinuousCollection.from_dict(data) for data in data_dicts]
    elif data_dicts[0]['type'] == 'Monthly':
        return [MonthlyCollection.from_dict(data) for data in data_dicts]
    elif data_dicts[0]['type'] == 'Daily':
        return [DailyCollection.from_dict(data) for data in data_dicts]


# List of all the output strings that will be requested
cooling_outputs = LoadBalance.COOLING + (
    'Cooling Coil Electricity Energy',
    'Chiller Electricity Energy',
    'Zone VRF Air Terminal Cooling Electricity Energy',
    'VRF Heat Pump Cooling Electricity Energy',
    'Chiller Heater System Cooling Electricity Energy',
    'District Cooling Water Energy',
    'Evaporative Cooler Electricity Energy')

heating_outputs = LoadBalance.HEATING + (
    'Boiler NaturalGas Energy',
    'Heating Coil Total Heating Energy',
    'Heating Coil NaturalGas Energy',
    'Heating Coil Electricity Energy',
    'Humidifier Electricity Energy',
    'Zone VRF Air Terminal Heating Electricity Energy',
    'VRF Heat Pump Heating Electricity Energy',
    'VRF Heat Pump Defrost Electricity Energy',
    'VRF Heat Pump Crankcase Heater Electricity Energy',
    'Chiller Heater System Heating Electricity Energy',
    'District Heating Water Energy',
    'Baseboard Electricity Energy',
    'Hot_Water_Loop_Central_Air_Source_Heat_Pump Electricity Consumption',
    'Boiler Electricity Energy',
    'Water Heater NaturalGas Energy',
    'Water Heater Electricity Energy',
    'Cooling Coil Water Heating Electricity Energy')

lighting_outputs = LoadBalance.LIGHTING
electric_equip_outputs = LoadBalance.ELECTRIC_EQUIP
gas_equip_outputs = LoadBalance.GAS_EQUIP
process_outputs = LoadBalance.PROCESS
shw_outputs = ('Water Use Equipment Heating Energy',) + LoadBalance.HOT_WATER

fan_electric_outputs = (
    'Zone Ventilation Fan Electricity Energy',
    'Fan Electricity Energy',
    'Cooling Tower Fan Electricity Energy')

pump_electric_outputs = 'Pump Electricity Energy'
people_gain_outputs = LoadBalance.PEOPLE_GAIN
solar_gain_outputs = LoadBalance.SOLAR_GAIN
infil_gain_outputs = LoadBalance.INFIL_GAIN
infil_loss_outputs = LoadBalance.INFIL_LOSS
vent_loss_outputs = LoadBalance.VENT_LOSS
vent_gain_outputs = LoadBalance.VENT_GAIN
nat_vent_gain_outputs = LoadBalance.NAT_VENT_GAIN
nat_vent_loss_outputs = LoadBalance.NAT_VENT_LOSS

all_output = [
    cooling_outputs, heating_outputs, lighting_outputs, electric_equip_outputs,
    gas_equip_outputs, process_outputs, shw_outputs, fan_electric_outputs,
    pump_electric_outputs, people_gain_outputs, solar_gain_outputs,
    infil_gain_outputs, infil_loss_outputs, vent_loss_outputs, vent_gain_outputs,
    nat_vent_gain_outputs, nat_vent_loss_outputs
]


if all_required_inputs(ghenv.Component):
    assert os.path.isfile(_sql), 'No sql file found at: {}.'.format(_sql)

    if os.name == 'nt':
        # Windows only: use IronPython + custom multi-year SQL parser
        sql_obj = MultiYearSQLiteResult(_sql)

        # get all of the results relevant for energy use
        cooling = sql_obj.data_collections_by_output_name_and_year(cooling_outputs, _year)
        heating = sql_obj.data_collections_by_output_name_and_year(heating_outputs, _year)
        lighting = sql_obj.data_collections_by_output_name_and_year(lighting_outputs, _year)
        electric_equip = sql_obj.data_collections_by_output_name_and_year(
            electric_equip_outputs, _year)
        hot_water = sql_obj.data_collections_by_output_name_and_year(shw_outputs, _year)
        gas_equip = sql_obj.data_collections_by_output_name_and_year(gas_equip_outputs, _year)
        process = sql_obj.data_collections_by_output_name_and_year(process_outputs, _year)
        fan_electric = sql_obj.data_collections_by_output_name_and_year(
            fan_electric_outputs, _year)
        pump_electric = sql_obj.data_collections_by_output_name_and_year(
            pump_electric_outputs, _year)

        # get all of the results relevant for gains and losses
        people_gain = sql_obj.data_collections_by_output_name_and_year(
            people_gain_outputs, _year)
        solar_gain = sql_obj.data_collections_by_output_name_and_year(
            solar_gain_outputs, _year)
        infil_gain = sql_obj.data_collections_by_output_name_and_year(
            infil_gain_outputs, _year)
        infil_loss = sql_obj.data_collections_by_output_name_and_year(
            infil_loss_outputs, _year)
        vent_loss = sql_obj.data_collections_by_output_name_and_year(
            vent_loss_outputs, _year)
        vent_gain = sql_obj.data_collections_by_output_name_and_year(
            vent_gain_outputs, _year)
        nat_vent_gain = sql_obj.data_collections_by_output_name_and_year(
            nat_vent_gain_outputs, _year)
        nat_vent_loss = sql_obj.data_collections_by_output_name_and_year(
            nat_vent_loss_outputs, _year)

    else:
        raise NotImplementedError(
            'This multi-year component currently only works on Windows.'
        )

    # do arithmetic with any of the gain/loss data collections
    infiltration_load = []
    mech_vent_load = []
    nat_vent_load = []

    if len(infil_gain) == len(infil_loss):
        infiltration_load = subtract_loss_from_gain(infil_gain, infil_loss)

    if len(vent_gain) == len(vent_loss) == len(cooling) == len(heating):
        mech_vent_loss = subtract_loss_from_gain(heating, vent_loss)
        mech_vent_gain = subtract_loss_from_gain(cooling, vent_gain)
        mech_vent_load = [data.duplicate() for data in
                          subtract_loss_from_gain(mech_vent_gain, mech_vent_loss)]
        for load in mech_vent_load:
            load.header.metadata['type'] = \
                'Zone Ideal Loads Ventilation Heat Energy'

    if len(nat_vent_gain) == len(nat_vent_loss):
        nat_vent_load = subtract_loss_from_gain(nat_vent_gain, nat_vent_loss)

    # remove the district hot water system used for service hot water from space heating
    shw_equip, distr_i = [], None
    for i, heat in enumerate(heating):
        if not isinstance(heat, float):
            try:
                heat_equip = heat.header.metadata['System']
                if heat_equip.startswith('SHW'):
                    shw_equip.append(i)
                elif heat_equip == 'SERVICE HOT WATER DISTRICT HEAT':
                    distr_i = i
            except KeyError:
                pass

    if len(shw_equip) != 0 and distr_i is None:
        hot_water = [heating.pop(i) for i in reversed(shw_equip)]
    elif distr_i is not None:
        for i in reversed(shw_equip + [distr_i]):
            heating.pop(i)
# ---------- end multiyearroomenergyresult ----------
multiyearroomcomfortresult = DBReadRoomComfortResultForMultipleYears(sql=runhamt.sql, year=number_slider_3)  # -> air_temp, oper_temp, rad_temp, rel_humidity, unmet_heat, unmet_cool; inputs year: Int32
# ---------- multiyearroomcomfortresult: Python ----------
"""
Parse all of the common Room-level comfort-related results per simulated year
from an SQL result file that has been generated from an energy simulation.
_
Note that this component only works in Windows, with hourly data for periods 
longer than 1 year.

    Args:
        _sql: The file path of the SQL result file that has been generated from
            an energy simulation.
        _year: The simulation year to extract.
    
    Returns:
        oper_temp: DataCollections for the mean operative temperature of each room (C).
        air_temp: DataCollections for the mean air temperature of each room (C).
        rad_temp: DataCollections for the mean radiant temperature of each room (C).
        rel_humidity: DataCollections for the relative humidity of each room (%).
        unmet_heat: DataCollections for time that the heating setpoint is not met
            in each room (hours).
        unmet_cool: DataCollections for time that the cooling setpoint is not met
            in each room (hours).
"""

ghenv.Component.Name = 'DB Read Room Comfort Result for Multiple Years'
ghenv.Component.NickName = 'MultiyearRoomComfortResult'
ghenv.Component.Message = '0.0.1'
ghenv.Component.Category = 'Dewbee'
ghenv.Component.SubCategory = "3 :: Results"

import os
import subprocess
import json

# Turn off the "old" tag
import ghpythonlib as ghlib
c = ghlib.component._get_active_component()
c.ToggleObsolete(False)

# Import dewbee dependencies
from dewbee import multiyear_sql
reload(multiyear_sql)
from dewbee.multiyear_sql import MultiYearSQLiteResult

try:
    from ladybug_rhino.grasshopper import all_required_inputs
except ImportError as e:
    raise ImportError('\nFailed to import ladybug_rhino:\n\t{}'.format(e))


# List of all the output strings that will be requested
oper_temp_output = 'Zone Operative Temperature'
air_temp_output = 'Zone Mean Air Temperature'
rad_temp_output = 'Zone Mean Radiant Temperature'
rel_humidity_output = 'Zone Air Relative Humidity'
heat_setpt_output = 'Zone Heating Setpoint Not Met Time'
cool_setpt_output = 'Zone Cooling Setpoint Not Met Time'
all_output = [
    oper_temp_output, air_temp_output, rad_temp_output,
    rel_humidity_output, heat_setpt_output, cool_setpt_output
]


if all_required_inputs(ghenv.Component):
    assert os.path.isfile(_sql), 'No sql file found at: {}.'.format(_sql)
    if os.name == 'nt':
        sql_obj = MultiYearSQLiteResult(_sql)
        # Fetch ALL outputs in a single query + single connection
        all_results = sql_obj.data_collections_by_output_names_and_year(all_output, _year)
        # Unpack results
        oper_temp = all_results[oper_temp_output]
        air_temp = all_results[air_temp_output]
        rad_temp = all_results[rad_temp_output]
        rel_humidity = all_results[rel_humidity_output]
        unmet_heat = all_results[heat_setpt_output]
        unmet_cool = all_results[cool_setpt_output]
    else:
        raise NotImplementedError(
            'This multi-year component currently only works on Windows.'
        )
# ---------- end multiyearroomcomfortresult ----------

# ----
# Plot hourly results
panel_4 = Panel("2")
multiplication = Multiplication(A=number_slider, B=panel_4)
multiplication_2 = Multiplication(A=number_slider_2, B=panel_4)
pt = ConstructPoint(XCoordinate=multiplication_2, YCoordinate=multiplication, ZCoordinate=0)
hourlyplot = LBHourlyPlot(data=multiyearroomcomfortresult.rel_humidity, base_pt=pt)  # -> report, mesh, legend, borders, labels, title, vis_set; plug-in component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
