# Grasshopper definition DB DEV Materials.ghx (Grasshopper 1.0.8)

# ---- group: Lime plaster
water_absorption_coefficient_kg_m2h1_2 = Panel("3")
water_content_at_rh80_kg_m3 = Panel("30")
free_water_saturation_kg_m3 = Panel("250")
moisture_content_m3_m3 = Panel("""0
0.02
0.03
0.05
0.07
0.18
0.25""")
isotherm_rh = Panel("""0
0.5
0.8
0.9
0.93
0.99
1""")
dry_density_kg_m3 = Panel("1600")
kalkputz_from_masea = Panel("DB Lime Plaster")
processmasea = DBProcessMASEAData(
    density=dry_density_kg_m3,
    absorpt_coeff=water_absorption_coefficient_kg_m2h1_2,
    w_80=water_content_at_rh80_kg_m3,
    w_f=free_water_saturation_kg_m3,
    sorption_w_m3m3=moisture_content_m3_m3,
    sorption_rh=isotherm_rh)  # -> initial_w, sorption_w, sorption_rh, suction_w, suction_coeff, redist_w, redist_coeff; inputs sorption_w_m3m3: list, sorption_rh: list
# ---------- processmasea: Python ----------
"""
Process moisture-related data collected from the MASEA database into properties 
that can be plugged in the "HygroMat" component to create a hygrothermal material.
_
Link to MASEA: https://www.masea-ensan.com/

    Args:
        _density: Number for the density of the material [kg/m3].
            
        _absorpt_coeff: Number for the water absorption coefficient (A) [kg/(m2h1/2)]
            
        _w_80: Number for the water content at RH=80% [kg/m3]

        _w_f: Number for the water content at free saturation [kg/m3]
             
        _sorption_w_m3m3: A list of moisture contents for the sorption isotherm [m3/m3]
            This list must have the same length as _sorption_rh.
            _
            Note that the units are in m3/m3.
        _sorption_rh: A list of relative humidities between 0 and 1 for the 
            sorption isotherm [-].
            This list must have the same length as _sorption_w_m3m3.
            
    Returns:
        _initial_w: A number for the initial water content ratio [kg/kg]
            _
            This corresponds to _w_80 converted in kg/kg
        _sorption_w: A list of moisture contents for the sorption isotherm [kg/m3]
            This list must have the same length as _sorption_rh.
        _sorption_rh: A list of relative humidities between 0 and 1 for the 
            sorption isotherm [-].
        suction_w: A list of moisture contents for the liquid suction [kg/m3]
        suction_coeff: A list of (moisture-dependent) suction coefficients for 
            the liquid suction [m2/s].
        redist_w: A list of moisture contents for the liquid redistribution [kg/m3]
        redist_coeff: A list of (moisture-dependent) redistribution coefficients 
            for the liquid redistribution [m2/s].
        
"""

ghenv.Component.Name = "DB Process MASEA Data"
ghenv.Component.NickName = 'ProcessMASEA'
ghenv.Component.Message = '0.1.2'
ghenv.Component.Category = 'Dewbee'
ghenv.Component.SubCategory = "1 :: Constructions"

# Import dewbee dependencies
try:
    import dewbee.utils as utils
    reload(utils)
    from dewbee.utils import suction, moisture_grid
except Exception as e:
    raise ImportError('Failed to import dewbee:\n\t{}'.format(e))

try:  # import ladybug_rhino dependencies
    from ladybug_rhino.grasshopper import all_required_inputs
except ImportError as e:
    raise ImportError('\nFailed to import ladybug_rhino:\n\t{}'.format(e))

if all_required_inputs(ghenv.Component):
    # Convert (kg/m2h1/2) to (kg/m2s1/2)
    A_SI = _absorpt_coeff/60

    n_steps = 10
    suction_w = moisture_grid(_w_f, n_steps)
    suction_coeff = [suction(A_SI, _w_f, w) for w in suction_w]
    
    redist_w = suction_w
    redist_coeff = [v/10 for v in suction_coeff]
    
    initial_w = _w_80/_density
    
    sorption_w = [v*1000 for v in _sorption_w_m3m3]
    sorption_rh = _sorption_rh
    
    # Add w_f(RH=100%) if not already given
    if sorption_rh[-1] != 1 and _w_f > sorption_w[-1]:
        sorption_rh.append(1)
        sorption_w.append(_w_f)
# ---------- end processmasea ----------
thickness_m = Panel("0.03")
opaquemat = HBOpaqueMaterial(
    name=kalkputz_from_masea,
    thickness=thickness_m,
    conductivity="0.7",
    density=dry_density_kg_m3,
    spec_heat="850",
    therm_absp="0.64",
    sol_absp="0.70",
    vis_absp="0.70")  # -> mat; plug-in component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
hygromat = DBHygrothermalMaterial(
    mat=opaquemat,
    porosity="0.3",
    initial_w=processmasea.initial_w,
    sorption_w=processmasea.sorption_w,
    sorption_rh=processmasea.sorption_rh,
    suction_w=processmasea.suction_w,
    suction_coeff=processmasea.suction_coeff,
    redist_w=processmasea.redist_w,
    redist_coeff=processmasea.redist_coeff,
    diff_rh="0",
    diff_resist="7",
    conductivity_w="0",
    conductivity="0.7",
    info="Source: MASEA, Kalkputz")  # -> mat; inputs sorption_w: list, sorption_rh: list, suction_w: list, suction_coeff: list, redist_w: list, redist_coeff: list, diff_rh: list, diff_resist: list, conductivity_w: list, conductivity: list
# ---------- hygromat: Python ----------
"""
Create a hygrothermal opaque material from a standard HB opaque material, which 
can be plugged into the "HB Opaque Construction" component. 
_
Except for _porosity and _initial_w, all hygrothermal inputs must be entered as lists.
_ 
If you don't have enough data, use the standard "HB Opaque Material" instead. 
The HAMT model will only run on surfaces with constructions containing fully 
characterized hygrothermal properties. If all constructions are characterized, 
HAMT will be run for all surfaces.
_
Check MaterialProperty:HeatAndMoistureTransfer on EnergyPlus input-output documentation
for more information on the required inputs.
    Args:
        _mat: A standard HB opaque material object. For example, it can be the
        output of the "HB Opaque Material" component.
            
        _porosity: A number between 0 and 1 for the porosity.
        
        _initial_w_: A number for the initial water content ratio [kg/kg]
             _
             The initial water content is assumed to be distributed evenly through
             the depth of the material. UNITS ARE IN KG OF WATER PER KG OF DRY MATERIAL. (Default: 0)
             
        _sorption_w_: A list of moisture contents for the sorption isotherm [kg/m3]
            This list must have the same length as _sorption_rh. Required for hygroscopic materials.
            _
            EnergyPlus automatically sets w = 0 at rh = 0 and w = porosity*1000 
            at rh=1. If you provide values at rh=0 and rh=1, they override these defaults.
            Therefore, it is recommended to provide a point at rh=1 (w_f), because 
                orption should stop at a lower value, known as free saturation (w_f), because of air pockets
                trapped in the pore structure. For realistic predictions, remember 
            Supply increasing data up to the highest rh available for stability.
            _
            * Default *: when no curve is input, an artificial curve is created based
            on porosity. If at least w_80 and w_f are known, use the GenSorption component.
            
        _sorption_w_: A list of moisture contents for the sorption isotherm [kg/m3]
            This list must have the same length as _sorption_rh. Required for hygroscopic materials.
            _
            EnergyPlus automatically defines endpoints at rh = 0 (w = 0) and adds an
            internal maximum based on porosity. If you provide values at rh = 0 or 1,
            they override these defaults.
            _
            It is recommended to include a point at rh = 1.0 corresponding to free
            saturation (w_f), since real materials typically do not reach full pore
            saturation due to trapped air. This avoids overestimating moisture storage
            in the hygroscopic range.
            _
            Provide monotonically increasing values up to the highest available RH
            for numerical stability.
            _
            *Default*: If no curve is provided, an artificial isotherm is generated
            from porosity. If at least w_80 and w_f are known, use the GenSorption component.
        
        _sorption_rh_: A list of relative humidities between 0 and 1 for the 
            sorption isotherm [-]. Required for hygroscopic materials.
            This list must have the same length as _sorption_w.           
            
        _suction_w_: A list of moisture contents for the liquid suction [kg/m3]
            This list must have the same length as _suction_coeff. Required for capillary-active materials.
            _
            At least a datapoint at w = 0 is needed. The liquid coefficient at 
            the highest entered w is used for all values above this threshold. (Default: 0)

        _suction_coeff_: A list of (moisture-dependent) suction coefficients for 
            the liquid suction [m2/s]. Required for capillary-active materials.
            This list must have the same length as _suction_w
            _
            At least a datapoint at w = 0 is needed. The liquid coefficient at 
            the highest entered w is used for all values above this threshold.
            These coefficients are used when the rain flag is set in the epw. (Default: 0)
            
        _redist_w_: A list of moisture contents for the liquid redistribution [kg/m3].
            Required for capillary-active materials.
            This list must have the same length as _redist_coeff
            _
            At least a datapoint at w = 0 is needed. The liquid coefficient at 
            the highest entered w is used for all values above this threshold. (Default: 0)
            
        _redist_coeff_: A list of (moisture-dependent) redistribution coefficients 
            for the liquid redistribution [m2/s]. Required for capillary-active materials.
            This list must have the same length as _redist_w
             _
            At least a datapoint at w = 0 is needed. The liquid coefficient at 
            the highest entered w is used for all values above this threshold.
            These coefficients are used when the rain flag is NOT set in the epw. (Default: 0)
            
        _diff_rh: A list of relative humidities between 0 and 1 for the vapor 
            diffusion resistance factors [-].
            This list must have the same length as _diff_resist.
            _
            At least a datapoint at rh = 0 is needed. The diffusion resistance 
            factor at the highest entered rh is used for all values above this threshold.
        _diff_resist: A list of (moisture-dependent) vapor diffusion resistance 
            factors [-].
            This list must have the same length as _diff_rh.
            _
            At least a datapoint at rh = 0 is needed. The diffusion resistance 
            factor at the highest entered rh is used for all values above this threshold.
            
        _conductivity_w_: A list of moisture contents for the thermal conductivities [kg/m3]
            This list must have the same length as _conductivity.
            _
            At least a datapoint at w = 0 is needed (dry thermal conductivity). 
            The thermal conductivity at the highest entered w is used for all values 
            above this threshold. (Default: 0)
            
            
        _conductivity_: A list of (moisture-dependent) thermal conductivities [W/m-K] 
            This list must have the same length as _conductivity_w.
            _
            At least a datapoint at w = 0 is needed (dry thermal conductivity). 
            The thermal conductivity at the highest entered w is used for all values 
            above this threshold. (Default: dry conductivity from _mat)
            
        _info_: An optional string describing the material. This can be useful
            to document the source (e.g., MASEA).
    Returns:
        mat: A hygrothermal opaque material that can be assigned to a Honeybee
            Opaque construction.
"""

ghenv.Component.Name = "DB Hygrothermal Material"
ghenv.Component.NickName = 'HygroMat'
ghenv.Component.Message = '0.1.2'
ghenv.Component.Category = 'Dewbee'
ghenv.Component.SubCategory = "0 :: Constructions"

# Import dewbee dependencies
try:
    import dewbee.utils as utils
    import dewbee.hygro_material as hygro_material
    reload(utils)
    reload(hygro_material)
    from dewbee.utils import rh_grid
    from dewbee.hygro_material import HygroMaterial
except Exception as e:
    raise ImportError('Failed to import dewbee:\n\t{}'.format(e))

try:  # import the honeybee-energy dependencies
    from honeybee_energy.material.opaque import EnergyMaterial
except ImportError as e:
    raise ImportError('\nFailed to import honeybee_energy:\n\t{}'.format(e))

try:  # import ladybug_rhino dependencies
    from ladybug_rhino.grasshopper import all_required_inputs
except ImportError as e:
    raise ImportError('\nFailed to import ladybug_rhino:\n\t{}'.format(e))

if all_required_inputs(ghenv.Component):
    # Set defaults
    if not _initial_w_:
        _initial_w_ = 0
    # Create artificial sorption curve
    if not _sorption_w_ and not _sorption_rh_:
        _sorption_rh_ = rh_grid()
        w_f = _porosity*0.05*1000 # assume w_f = 0.05*w_max 
        b = 1.01 # keeps the curve very steep
        _sorption_w_ = [w_f*(b-1)*rh/(b-rh) for rh in _sorption_rh_]
    if not _suction_w_ and not _suction_coeff_:
        _suction_w_ = [0]
        _suction_coeff_ = [0]
    if not _redist_w_ and not _redist_coeff_:
        _redist_w_ = [0]
        _redist_coeff_ = [0]
    if not _conductivity_w_ and not _conductivity_:
        _conductivity_w_ = [0]
        _conductivity_ = [_mat.conductivity]
    if not _info_:
        _info_ = ""
    mat = _mat.duplicate()
    identifier = mat.identifier
    hygro_mat = HygroMaterial(
        identifier,
        _porosity,
        _initial_w_,
        _sorption_w_,
        _sorption_rh_,
        _suction_w_,
        _suction_coeff_,
        _redist_w_,
        _redist_coeff_,
        _diff_rh,
        _diff_resist,
        _conductivity_w_,
        _conductivity_,
        )

    #Check if corresponding lists match
    hygro_mat.values_compatible()
    
    # Add HygroMaterial object as a dictionary to the standard EnergyMaterial
    mat.user_data = {"hygro_material": hygro_mat.to_dict(),
                     "info": _info_
                    }
# ---------- end hygromat ----------

# ---- group: RE material
free_water_saturation_kg_m3_2 = Panel("165.457")
water_absorption_coefficient_kg_m2s1_2 = Panel("0.191970875")
panel = Panel("Mix 433 from Hall, M. & Allinson, D. Analysis of the hygrothermal functional properties of stabilised rammed earth materials. Building and Environment 44, 1935–1942 (2009).")
opaquemat_2 = HBOpaqueMaterial(
    name="DB Cement Stabilized Rammed Earth (6%, 433)",
    thickness="0.30",
    conductivity="1.01",
    density="2120",
    spec_heat="827.36")  # -> mat; plug-in component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
liquidcoeff = DBLiquidCoefficients(absorpt_coeff=water_absorption_coefficient_kg_m2s1_2, w_f=free_water_saturation_kg_m3_2)  # -> suction_w, suction_coeff, redist_w, redist_coeff
# ---------- liquidcoeff: Python ----------
"""
Compute liquid transfer coefficients based on absorption coefficient and free 
saturation _w_f
_
This is only an approximation based on Künzel's exponential function. 

    Args:
        _absorpt_coeff: Number for the water absorption coefficient (A) [kg/(m2s1/2)]

        _w_f: Number for the water content at free saturation [kg/m3]
            
    Returns:
        suction_w: A list of moisture contents for the liquid suction [kg/m3]

        suction_coeff: A list of (moisture-dependent) suction coefficients for 
            the liquid suction [m2/s].
            
        redist_w: A list of moisture contents for the liquid redistribution [kg/m3]
        redist_coeff: A list of (moisture-dependent) redistribution coefficients 
            for the liquid redistribution [m2/s].
"""

ghenv.Component.Name = "DB Liquid Coefficients"
ghenv.Component.NickName = 'LiquidCoeff'
ghenv.Component.Message = '0.1.2'
ghenv.Component.Category = 'Dewbee'
ghenv.Component.SubCategory = "1 :: Constructions"

# Import dewbee dependencies
try:
    import dewbee.utils as utils
    reload(utils)
    from dewbee.utils import suction, moisture_grid
except Exception as e:
    raise ImportError('Failed to import dewbee:\n\t{}'.format(e))

try:  # import ladybug_rhino dependencies
    from ladybug_rhino.grasshopper import all_required_inputs
except ImportError as e:
    raise ImportError('\nFailed to import ladybug_rhino:\n\t{}'.format(e))

if all_required_inputs(ghenv.Component):
    n_steps = 10
    suction_w = moisture_grid(_w_f, n_steps)
    suction_coeff = [suction(_absorpt_coeff, _w_f, w) for w in suction_w]
    
    redist_w = suction_w
    redist_coeff = [v/10 for v in suction_coeff]
# ---------- end liquidcoeff ----------
panel_2 = Panel("""0
0.329
0.4316
0.582
0.7536
0.94
1""")
panel_3 = Panel("""0
9.9365
11.3065
14.4195
21.7665
40.852
165.457""")
item = ListItem(List=panel_3, Index="4", Wrap=True)
division = Division(A=item, B="2120")
wetconductivity = DBWetThermalConductivity(conductivity_dry="1.01", conductivity_supplement="7.114", density="2120", porosity="0.239")  # -> conductivity_w, conductivity
# ---------- wetconductivity: Python ----------
"""
Generate moisture dependent thermal conductivity using a linear relationship.
conductivity = _conductivity_dry*(1+_conductivity_supplement*w/_bulk_density) 
    Args:
        _conductivity_dry: Number for the dry (10°C) thermal conductivity 
        of the material [W/m-K]
        _conductivity_supplement: Number for the linear supplement of thermal
        conductivity [%/M.-%]
        _porosity: A number between 0 and 1 for the porosity. 
            _
            This is the maximum fraction, by volume, of a material that can be
            taken up with moisture. It is used to calculate the maximum point of 
            conductivity_w.
            
        _density: A number for the dry density of the material [kg/m3]
    Returns:
        conductivity_w: A list of moisture contents for the thermal conductivities [kg/m3]

        conductivity: A list of (moisture-dependent) thermal conductivities [W/m-K]
"""

ghenv.Component.Name = "DB Wet Thermal Conductivity"
ghenv.Component.NickName = 'WetConductivity'
ghenv.Component.Message = '0.1.2'
ghenv.Component.Category = 'Dewbee'
ghenv.Component.SubCategory = "1 :: Constructions"

# Import dewbee dependencies
try:
    import dewbee.utils as utils
    reload(utils)
    from dewbee.utils import wet_conductivity
except Exception as e:
    raise ImportError('Failed to import dewbee:\n\t{}'.format(e))

try:  # import ladybug_rhino dependencies
    from ladybug_rhino.grasshopper import all_required_inputs
except ImportError as e:
    raise ImportError('\nFailed to import ladybug_rhino:\n\t{}'.format(e))

if all_required_inputs(ghenv.Component):
    conductivity_w, conductivity = wet_conductivity(_porosity, _conductivity_dry, _conductivity_supplement, _density)
# ---------- end wetconductivity ----------
hygromat_2 = DBHygrothermalMaterial(
    mat=opaquemat_2,
    porosity="0.239",
    initial_w=division,
    sorption_w=panel_3,
    sorption_rh=panel_2,
    suction_w=liquidcoeff.suction_w,
    suction_coeff=liquidcoeff.suction_coeff,
    redist_w=liquidcoeff.redist_w,
    redist_coeff=liquidcoeff.redist_coeff,
    diff_rh="0",
    diff_resist="24.19",
    conductivity_w=wetconductivity.conductivity_w,
    conductivity=wetconductivity.conductivity,
    info=panel)  # -> mat; inputs sorption_w: list, sorption_rh: list, suction_w: list, suction_coeff: list, redist_w: list, redist_coeff: list, diff_rh: list, diff_resist: list, conductivity_w: list, conductivity: list; same code as hygromat

free_water_saturation_kg_m3_3 = Panel("199.215")
water_absorption_coefficient_kg_m2s1_2_2 = Panel("0.273303525")
panel_4 = Panel("Mix 613 from Hall, M. & Allinson, D. Analysis of the hygrothermal functional properties of stabilised rammed earth materials. Building and Environment 44, 1935–1942 (2009).")
opaquemat_3 = HBOpaqueMaterial(
    name="DB Cement Stabilized Rammed Earth (6%, 613)",
    thickness="0.30",
    conductivity="0.833",
    density="2020",
    spec_heat="855.44")  # -> mat; plug-in component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
liquidcoeff_2 = DBLiquidCoefficients(absorpt_coeff=water_absorption_coefficient_kg_m2s1_2_2, w_f=free_water_saturation_kg_m3_3)  # -> suction_w, suction_coeff, redist_w, redist_coeff; same code as liquidcoeff
panel_5 = Panel("""0
0.329
0.4316
0.582
0.7536
0.94
1""")
panel_6 = Panel("""0
7.256
12.0085
13.411
19.085
30.599
199.215""")
item_2 = ListItem(List=panel_6, Index="4", Wrap=True)
division_2 = Division(A=item_2, B="2020")
wetconductivity_2 = DBWetThermalConductivity(conductivity_dry="0.833", conductivity_supplement="4.758", density="2020", porosity="0.273")  # -> conductivity_w, conductivity; same code as wetconductivity
hygromat_3 = DBHygrothermalMaterial(
    mat=opaquemat_3,
    porosity="0.273",
    initial_w=division_2,
    sorption_w=panel_6,
    sorption_rh=panel_5,
    suction_w=liquidcoeff_2.suction_w,
    suction_coeff=liquidcoeff_2.suction_coeff,
    redist_w=liquidcoeff_2.redist_w,
    redist_coeff=liquidcoeff_2.redist_coeff,
    diff_rh="0",
    diff_resist="11.683",
    conductivity_w=wetconductivity_2.conductivity_w,
    conductivity=wetconductivity_2.conductivity,
    info=panel_4)  # -> mat; inputs sorption_w: list, sorption_rh: list, suction_w: list, suction_coeff: list, redist_w: list, redist_coeff: list, diff_rh: list, diff_resist: list, conductivity_w: list, conductivity: list; same code as hygromat

free_water_saturation_kg_m3_4 = Panel("226.498")
water_absorption_coefficient_kg_m2s1_2_3 = Panel("0.348568501")
panel_7 = Panel("Mix 703 from Hall, M. & Allinson, D. Analysis of the hygrothermal functional properties of stabilised rammed earth materials. Building and Environment 44, 1935–1942 (2009).")
opaquemat_4 = HBOpaqueMaterial(
    name="DB Cement Stabilized Rammed Earth (6%, 703)",
    thickness="0.30",
    conductivity="0.866",
    density="1980",
    spec_heat="868.18")  # -> mat; plug-in component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
liquidcoeff_3 = DBLiquidCoefficients(absorpt_coeff=water_absorption_coefficient_kg_m2s1_2_3, w_f=free_water_saturation_kg_m3_4)  # -> suction_w, suction_coeff, redist_w, redist_coeff; same code as liquidcoeff
panel_8 = Panel("""0
0.329
0.4316
0.582
0.7536
0.94
1""")
panel_9 = Panel("""0
6.94
8.831
10.9355
14.826
28.9435
226.498""")
item_3 = ListItem(List=panel_9, Index="4", Wrap=True)
division_3 = Division(A=item_3, B="1980")
wetconductivity_3 = DBWetThermalConductivity(conductivity_dry="0.866", conductivity_supplement="6.261", density="1980", porosity="0.302")  # -> conductivity_w, conductivity; same code as wetconductivity
hygromat_4 = DBHygrothermalMaterial(
    mat=opaquemat_4,
    porosity="0.302",
    initial_w=division_3,
    sorption_w=panel_9,
    sorption_rh=panel_8,
    suction_w=liquidcoeff_3.suction_w,
    suction_coeff=liquidcoeff_3.suction_coeff,
    redist_w=liquidcoeff_3.redist_w,
    redist_coeff=liquidcoeff_3.redist_coeff,
    diff_rh="0",
    diff_resist="7.878",
    conductivity_w=wetconductivity_3.conductivity_w,
    conductivity=wetconductivity_3.conductivity,
    info=panel_7)  # -> mat; inputs sorption_w: list, sorption_rh: list, suction_w: list, suction_coeff: list, redist_w: list, redist_coeff: list, diff_rh: list, diff_resist: list, conductivity_w: list, conductivity: list; same code as hygromat

# ----
panel_10 = Panel("""0
6.27
15.97
23.86
32.35
40.84
71.38""")
panel_11 = Panel("""1.34
1.39
1.44
1.55
1.57
1.61
1.86""")
item_4 = ListItem(List=panel_11, Index=0, Wrap=True)
opaquemat_5 = HBOpaqueMaterial(
    name="DB Rammed Earth",
    thickness="0.40",
    conductivity=item_4,
    density="1930",
    spec_heat="773",
    therm_absp="0.64",
    sol_absp="0.70",
    vis_absp="0.70")  # -> mat; plug-in component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
panel_12 = Panel("""20.5
18.6
18
15.1
13.8
12.7
7.05""")
panel_13 = Panel("""0
4.41e-10
6.64e-10
5.44e-10
6.04e-10
6.75e-10
7.42e-10
8.34e-10
9.42e-10""")
panel_14 = Panel("""0.055
0.25
0.31
0.425
0.48
0.68
0.88""")
panel_15 = Panel("Source: Losini, A. E. et al. Extended hygrothermal characterization of unstabilized rammed earth for modern construction. Construction and Building Materials 409, 133904 (2023).")
panel_16 = Panel("""0
4.41e-9
6.64e-9
5.44e-9
6.04e-9
6.75e-9
7.42e-9
8.34e-9
9.42e-9""")
panel_17 = Panel("""8.492
13.124
17.177
21.809
26.441
31.652
40.144
46.32
54.426
75.656""")
panel_18 = Panel("""0.09
0.2293
0.3542
0.4851
0.5896
0.6808
0.7863
0.842
0.8954
0.9836""")
panel_19 = Panel("""0
51.460914
55.788884
60.427519
64.906402
69.578136
73.607479
78.499961
84.139304""")
hygromat_5 = DBHygrothermalMaterial(
    mat=opaquemat_5,
    porosity="0.25",
    initial_w="0.04",
    sorption_w=panel_17,
    sorption_rh=panel_18,
    suction_w=panel_19,
    suction_coeff=panel_16,
    redist_w=panel_19,
    redist_coeff=panel_13,
    diff_rh=panel_14,
    diff_resist=panel_12,
    conductivity_w=panel_10,
    conductivity=panel_11,
    info=panel_15)  # -> mat; inputs sorption_w: list, sorption_rh: list, suction_w: list, suction_coeff: list, redist_w: list, redist_coeff: list, diff_rh: list, diff_resist: list, conductivity_w: list, conductivity: list; same code as hygromat

panel_20 = Panel("Source: C5 mix from Zhou, Y., Trabelsi, A. & El Mankibi, M. Hygrothermal properties of insulation materials from rice straw and natural binders for buildings. Construction and Building Materials 372, 130770 (2023).")
opaquemat_6 = HBOpaqueMaterial(name="DB Straw-Chitosan Insulation", thickness="0.5", conductivity="0.042", density="121", spec_heat="1375")  # -> mat; plug-in component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
panel_21 = Panel("""0
0.05
0.1
0.1131
0.15
0.2
0.2251
0.3
0.4
0.4316
0.5
0.582
0.6
0.7
0.7547
0.8
0.8511""")
panel_22 = Panel("""0
0.71555
1.44077
1.63309
2.1815
2.94402
3.33717
4.56293
6.36474
6.98596
8.44148
10.4424
10.92847
14.03941
16.12635
18.13939
20.81662""")
hygromat_6 = DBHygrothermalMaterial(
    mat=opaquemat_6,
    porosity="0.95",
    sorption_w=panel_21,
    sorption_rh=panel_22,
    diff_rh="0",
    diff_resist="3.7",
    info=panel_20)  # -> mat; inputs sorption_w: list, sorption_rh: list, suction_w: list, suction_coeff: list, redist_w: list, redist_coeff: list, diff_rh: list, diff_resist: list, conductivity_w: list, conductivity: list; same code as hygromat

# ---- group: RE material
free_water_saturation_kg_m3_5 = Panel("253.47")
water_absorption_coefficient_kg_m2s1_2_4 = Panel("0.089")
panel_23 = Panel("Source: Allinson, D. & Hall, M. Hygrothermal analysis of a stabilised rammed earth test building in the UK. Energy and Buildings 42, 845–852 (2010).")
opaquemat_7 = HBOpaqueMaterial(name="DB Cement Stabilized Rammed Earth (7%)", thickness="0.30", conductivity="0.643", density="1900", spec_heat="868")  # -> mat; plug-in component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
liquidcoeff_4 = DBLiquidCoefficients(absorpt_coeff=water_absorption_coefficient_kg_m2s1_2_4, w_f=free_water_saturation_kg_m3_5)  # -> suction_w, suction_coeff, redist_w, redist_coeff; same code as liquidcoeff
panel_24 = Panel("""0.3285
0.4305
0.5815
0.7558
0.80
0.9406
1""")
panel_25 = Panel("""23.13
27.81
40.31
53.44
61.5
105.63
253.47""")
item_5 = ListItem(List=panel_25, Index="4", Wrap=True)
division_4 = Division(A=item_5, B="1900")
wetconductivity_4 = DBWetThermalConductivity(conductivity_dry="0.643", conductivity_supplement="4.39", density="1900", porosity="0.295")  # -> conductivity_w, conductivity; same code as wetconductivity
hygromat_7 = DBHygrothermalMaterial(
    mat=opaquemat_7,
    porosity="0.295",
    initial_w=division_4,
    sorption_w=panel_25,
    sorption_rh=panel_24,
    suction_w=liquidcoeff_4.suction_w,
    suction_coeff=liquidcoeff_4.suction_coeff,
    redist_w=liquidcoeff_4.redist_w,
    redist_coeff=liquidcoeff_4.redist_coeff,
    diff_rh="0",
    diff_resist="14.34",
    conductivity_w=wetconductivity_4.conductivity_w,
    conductivity=wetconductivity_4.conductivity,
    info=panel_23)  # -> mat; inputs sorption_w: list, sorption_rh: list, suction_w: list, suction_coeff: list, redist_w: list, redist_coeff: list, diff_rh: list, diff_resist: list, conductivity_w: list, conductivity: list; same code as hygromat

# ----
panel_26 = Panel("Source: EnergyPlus Reference DataSets, MoistureMaterials.idf")
opaquemat_8 = HBOpaqueMaterial(
    name="DB Glass Fiber Insulation",
    thickness="1.003",
    conductivity="0.04",
    density="80",
    spec_heat="840",
    roughness="Rough",
    therm_absp="0.9",
    sol_absp="0.70",
    vis_absp="0.70")  # -> mat; plug-in component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
panel_27 = Panel("""0.202
0.4325
0.6465
0.8465
0.948
0.978""")
panel_28 = Panel("""0.748
1.04
1.24
1.56
1.92
2.72""")
hygromat_8 = DBHygrothermalMaterial(
    mat=opaquemat_8,
    porosity="0.95",
    initial_w="0.1",
    sorption_w=panel_28,
    sorption_rh=panel_27,
    suction_w="0",
    suction_coeff="0",
    redist_w="0",
    redist_coeff="0",
    diff_rh="0",
    diff_resist="1.2543",
    info=panel_26)  # -> mat; inputs sorption_w: list, sorption_rh: list, suction_w: list, suction_coeff: list, redist_w: list, redist_coeff: list, diff_rh: list, diff_resist: list, conductivity_w: list, conductivity: list; same code as hygromat

opaquemat_9 = HBOpaqueMaterial(
    name="DB Cellulose Insulation",
    thickness="0.066",
    conductivity="0.04",
    density="55",
    spec_heat="1880",
    roughness="Rough",
    therm_absp="0.9",
    sol_absp="0.70",
    vis_absp="0.70")  # -> mat; plug-in component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
panel_29 = Panel("Source: EnergyPlus Reference DataSets, MoistureMaterials.idf")
panel_30 = Panel("""0
950""")
panel_31 = Panel("""0.04
0.583""")
panel_32 = Panel("""0.25
0.44
0.66
0.86
1""")
panel_33 = Panel("""2.365
4.62
6.655
11.4125
13""")
hygromat_9 = DBHygrothermalMaterial(
    mat=opaquemat_9,
    porosity="0.95",
    initial_w="0.001",
    sorption_w=panel_33,
    sorption_rh=panel_32,
    suction_w="0",
    suction_coeff="0",
    redist_w="0",
    redist_coeff="0",
    diff_rh="0",
    diff_resist="1.5",
    conductivity_w=panel_30,
    conductivity=panel_31,
    info=panel_29)  # -> mat; inputs sorption_w: list, sorption_rh: list, suction_w: list, suction_coeff: list, redist_w: list, redist_coeff: list, diff_rh: list, diff_resist: list, conductivity_w: list, conductivity: list; same code as hygromat

sd_m = Panel("2.4")
opaquemat_10 = HBOpaqueMaterial(name="DB Dispersion Paint", thickness="0.00015", conductivity="0.25", density="2000", spec_heat="1250")  # -> mat; plug-in component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
division_5 = Division(A=sd_m, B="0.00015")
hygromat_10 = DBHygrothermalMaterial(
    mat=opaquemat_10,
    porosity="0.001",
    initial_w="0",
    sorption_w="0",
    sorption_rh="0",
    diff_rh="0",
    diff_resist=division_5,
    info="Source: MASEA, Dispersionsfarbe")  # -> mat; inputs sorption_w: list, sorption_rh: list, suction_w: list, suction_coeff: list, redist_w: list, redist_coeff: list, diff_rh: list, diff_resist: list, conductivity_w: list, conductivity: list; same code as hygromat

thickness_m_2 = Panel("0.2")
panel_34 = Panel("Source: MASEA, Schaumglas einlagig_150_20°C (Specific heat capacity estimated from Ubakus)")
dry_density_kg_m3_2 = Panel("150")
opaquemat_11 = HBOpaqueMaterial(name="DB Foamglass", thickness=thickness_m_2, conductivity="0.06", density=dry_density_kg_m3_2, spec_heat="1000")  # -> mat; plug-in component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
hygromat_11 = DBHygrothermalMaterial(mat=opaquemat_11, porosity="0.95", diff_rh="0", diff_resist="1000", info=panel_34)  # -> mat; inputs sorption_w: list, sorption_rh: list, suction_w: list, suction_coeff: list, redist_w: list, redist_coeff: list, diff_rh: list, diff_resist: list, conductivity_w: list, conductivity: list; same code as hygromat

opaquemat_12 = HBOpaqueMaterial(
    name="DB Vapor Retarder (Sd = 50)",
    thickness="0.001",
    conductivity="2.3",
    density="130",
    spec_heat="2300",
    roughness="Rough")  # -> mat; plug-in component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
hygromat_12 = DBHygrothermalMaterial(
    mat=opaquemat_12,
    porosity="0.001",
    initial_w="0",
    sorption_w="0",
    sorption_rh="0",
    diff_rh="0",
    diff_resist="50000",
    info="Source: TUM, PE Foil")  # -> mat; inputs sorption_w: list, sorption_rh: list, suction_w: list, suction_coeff: list, redist_w: list, redist_coeff: list, diff_rh: list, diff_resist: list, conductivity_w: list, conductivity: list; same code as hygromat

panel_35 = Panel("""0
18.8
294""")
panel_36 = Panel("""0
2e-10
7.698e-8""")
panel_37 = Panel("""0
7e-10
8e-5""")
panel_38 = Panel("Source: MASEA, Lehmputz (extracted from XML instead of HTML)")
opaquemat_13 = HBOpaqueMaterial(name="DB Earth Plaster", thickness="0.005", conductivity="0.65", density="1514", spec_heat="1000")  # -> mat; plug-in component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
panel_39 = Panel("""0
13
18.0
25.4
294.0""")
panel_40 = Panel("""0
0.65
0.8
0.93
1.0""")
panel_41 = Panel("""11.3
9.6""")
panel_42 = Panel("""0.265
0.715""")
hygromat_13 = DBHygrothermalMaterial(
    mat=opaquemat_13,
    porosity="0.424",
    sorption_w=panel_39,
    sorption_rh=panel_40,
    suction_w=panel_35,
    suction_coeff=panel_36,
    redist_w=panel_35,
    redist_coeff=panel_37,
    diff_rh=panel_42,
    diff_resist=panel_41,
    info=panel_38)  # -> mat; inputs sorption_w: list, sorption_rh: list, suction_w: list, suction_coeff: list, redist_w: list, redist_coeff: list, diff_rh: list, diff_resist: list, conductivity_w: list, conductivity: list; same code as hygromat

sd_m_2 = Panel("25")
opaquemat_14 = HBOpaqueMaterial(name="DB Vapor Retarder (Sd = 25)", thickness="0.00042", conductivity="0.2", density="121", spec_heat="1000")  # -> mat; plug-in component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
division_6 = Division(A=sd_m_2, B="0.00042")
hygromat_14 = DBHygrothermalMaterial(
    mat=opaquemat_14,
    porosity="0.001",
    initial_w="0",
    sorption_w="0",
    sorption_rh="0",
    diff_rh="0",
    diff_resist=division_6,
    info="Source: Ubakus, Majpell 25")  # -> mat; inputs sorption_w: list, sorption_rh: list, suction_w: list, suction_coeff: list, redist_w: list, redist_coeff: list, diff_rh: list, diff_resist: list, conductivity_w: list, conductivity: list; same code as hygromat

thickness_m_3 = Panel("0.06")
panel_43 = Panel("Source: MASEA, XPS Extrudierter Polystyrol-Hartschaum 1 (Kernschicht)")
dry_density_kg_m3_3 = Panel("34")
opaquemat_15 = HBOpaqueMaterial(name="DB XPS", thickness=thickness_m_3, conductivity="0.04", density=dry_density_kg_m3_3, spec_heat="1450")  # -> mat; plug-in component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
hygromat_15 = DBHygrothermalMaterial(mat=opaquemat_15, porosity="0.95", diff_rh="0", diff_resist="70", info=panel_43)  # -> mat; inputs sorption_w: list, sorption_rh: list, suction_w: list, suction_coeff: list, redist_w: list, redist_coeff: list, diff_rh: list, diff_resist: list, conductivity_w: list, conductivity: list; same code as hygromat

panel_44 = Panel("""0
730""")
opaquemat_16 = HBOpaqueMaterial(
    name="DB Spruce",
    thickness="0.012",
    conductivity="0.09",
    density="455",
    spec_heat="1500",
    roughness="Rough",
    therm_absp="0.9",
    sol_absp="0.70",
    vis_absp="0.70")  # -> mat; plug-in component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
panel_45 = Panel("""0.09
0.278""")
panel_46 = Panel("""0
0.00000000000032
0.0000000000092""")
panel_47 = Panel("""0
0.00000000000032
0.0000000000092""")
panel_48 = Panel("Source: EnergyPlus Reference DataSets, MoistureMaterials.idf")
panel_49 = Panel("""0.205
0.4465
0.6515
0.6545
0.83
0.9525
0.956""")
panel_50 = Panel("""25.935
44.3625
61.99375
61.99375
87.1325
119.665
120.12""")
panel_51 = Panel("""0
20
600""")
hygromat_16 = DBHygrothermalMaterial(
    mat=opaquemat_16,
    porosity="0.73",
    initial_w="0.05",
    sorption_w=panel_50,
    sorption_rh=panel_49,
    suction_w=panel_51,
    suction_coeff=panel_46,
    redist_w=panel_51,
    redist_coeff=panel_47,
    diff_rh="0",
    diff_resist="130",
    conductivity_w=panel_44,
    conductivity=panel_45,
    info=panel_48)  # -> mat; inputs sorption_w: list, sorption_rh: list, suction_w: list, suction_coeff: list, redist_w: list, redist_coeff: list, diff_rh: list, diff_resist: list, conductivity_w: list, conductivity: list; same code as hygromat

opaquemat_17 = HBOpaqueMaterial(
    name="DB Plywood",
    thickness="0.025",
    conductivity="0.14",
    density="530",
    spec_heat="1880",
    roughness="Rough",
    therm_absp="0.9",
    sol_absp="0.70",
    vis_absp="0.70")  # -> mat; plug-in component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
panel_52 = Panel("""0
500""")
panel_53 = Panel("""700
200
20""")
panel_54 = Panel("""0.1
0.25""")
panel_55 = Panel("""0
0.5
1""")
panel_56 = Panel("Source: EnergyPlus Reference DataSets, MoistureMaterials.idf")
panel_57 = Panel("""0.2015
0.203
0.435
0.439
0.6495
0.6515
0.8215
0.825
0.9215
0.925
0.9575
0.9605""")
panel_58 = Panel("""3.7125
3.74
5.8025
5.83
7.7825
7.81
10.3675
10.3675
13.1175
13.1175
14.7125
15.345""")
hygromat_17 = DBHygrothermalMaterial(
    mat=opaquemat_17,
    porosity="0.5",
    initial_w="0.05",
    sorption_w=panel_58,
    sorption_rh=panel_57,
    suction_w="0",
    suction_coeff="0",
    redist_w="0",
    redist_coeff="0",
    diff_rh=panel_55,
    diff_resist=panel_53,
    conductivity_w=panel_52,
    conductivity=panel_54,
    info=panel_56)  # -> mat; inputs sorption_w: list, sorption_rh: list, suction_w: list, suction_coeff: list, redist_w: list, redist_coeff: list, diff_rh: list, diff_resist: list, conductivity_w: list, conductivity: list; same code as hygromat

panel_59 = Panel("""0
0.80
0.93
0.99""")
panel_60 = Panel("""0
0.097
0.13
0.81""")
processmasea_2 = DBProcessMASEAData(density="595", absorpt_coeff="0.12", w_80="94.7", w_f="814", sorption_w_m3m3=panel_60, sorption_rh=panel_59)  # -> initial_w, sorption_w, sorption_rh, suction_w, suction_coeff, redist_w, redist_coeff; inputs sorption_w_m3m3: list, sorption_rh: list; same code as processmasea
opaquemat_18 = HBOpaqueMaterial(name="DB OSB3", thickness="0.015", conductivity="0.13", density="595", spec_heat="1700")  # -> mat; plug-in component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
panel_61 = Panel("""165
165
117
96""")
panel_62 = Panel("""0
0.26
0.63
0.72""")
hygromat_18 = DBHygrothermalMaterial(
    mat=opaquemat_18,
    porosity="0.522",
    initial_w=processmasea_2.initial_w,
    sorption_w=processmasea_2.sorption_w,
    sorption_rh=processmasea_2.sorption_rh,
    suction_w=processmasea_2.suction_w,
    suction_coeff=processmasea_2.suction_coeff,
    redist_w=processmasea_2.redist_w,
    redist_coeff=processmasea_2.redist_coeff,
    diff_rh=panel_62,
    diff_resist=panel_61,
    info="Source: MASEA, OSB/3")  # -> mat; inputs sorption_w: list, sorption_rh: list, suction_w: list, suction_coeff: list, redist_w: list, redist_coeff: list, diff_rh: list, diff_resist: list, conductivity_w: list, conductivity: list; same code as hygromat

panel_63 = Panel("""0.2
1.424""")
panel_64 = Panel("""0
60
100
160
240
320
360
380
400""")
panel_65 = Panel("""0
0.000000003
0.000000008
0.000000008
0.000000013
0.0000001
0.0000003
0.0000007
0.000001""")
panel_66 = Panel("""0
650""")
panel_67 = Panel("""0
0.000000003
0.0000001
0.0000001
0.00000012
0.00000022
0.0000006
0.0000009
0.00000045""")
panel_68 = Panel("""0
60
100
160
240
320
360
380
400""")

panel_69 = Panel("Source: EnergyPlus Reference DataSets, MoistureMaterials.idf")
opaquemat_19 = HBOpaqueMaterial(
    name="DB Plasterboard",
    thickness="0.012",
    conductivity="0.2",
    density="850",
    spec_heat="850",
    roughness="Rough",
    therm_absp="0.9",
    sol_absp="0.6",
    vis_absp="0.70")  # -> mat; plug-in component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
panel_70 = Panel("""0.202
0.4325
0.6465
0.8465
0.948
0.978""")
panel_71 = Panel("""0.748
1.04
1.24
1.56
1.92
2.72""")
hygromat_19 = DBHygrothermalMaterial(
    mat=opaquemat_19,
    porosity="0.65",
    initial_w="0.1",
    sorption_w=panel_71,
    sorption_rh=panel_70,
    suction_w=panel_68,
    suction_coeff=panel_67,
    redist_w=panel_64,
    redist_coeff=panel_65,
    diff_rh="0",
    diff_resist="8.3",
    conductivity_w=panel_66,
    conductivity=panel_63,
    info=panel_69)  # -> mat; inputs sorption_w: list, sorption_rh: list, suction_w: list, suction_coeff: list, redist_w: list, redist_coeff: list, diff_rh: list, diff_resist: list, conductivity_w: list, conductivity: list; same code as hygromat

panel_72 = Panel("""0
0.265
0.715""")
panel_73 = Panel("""1000
1000
800""")
sd_m_3 = Panel("1500")

opaquemat_20 = HBOpaqueMaterial(name="DB Linoleum", thickness="0.010", conductivity="0.17", density="1200", spec_heat="1400")  # -> mat; plug-in component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
hygromat_20 = DBHygrothermalMaterial(mat=opaquemat_20, porosity="0.1", diff_rh=panel_72, diff_resist=panel_73, info="Source: DIN EN ISO 10456")  # -> mat; inputs sorption_w: list, sorption_rh: list, suction_w: list, suction_coeff: list, redist_w: list, redist_coeff: list, diff_rh: list, diff_resist: list, conductivity_w: list, conductivity: list; same code as hygromat

water_content_at_rh80_kg_m3_2 = Panel("101")
water_absorption_coefficient_kg_m2h1_2_2 = Panel("0.75")
free_water_saturation_kg_m3_6 = Panel("144")
moisture_content_m3_m3_2 = Panel("""0.02505814
0.029244186
0.045813953
0.080174419
0.101453488
0.150116279
0.150813953""")
dry_density_kg_m3_4 = Panel("2104")
isotherm_rh_2 = Panel("""0.065456674
0.112529274
0.330327869
0.581850117
0.754683841
0.960538642
0.973887588""")
processmasea_3 = DBProcessMASEAData(
    density=dry_density_kg_m3_4,
    absorpt_coeff=water_absorption_coefficient_kg_m2h1_2_2,
    w_80=water_content_at_rh80_kg_m3_2,
    w_f=free_water_saturation_kg_m3_6,
    sorption_w_m3m3=moisture_content_m3_m3_2,
    sorption_rh=isotherm_rh_2)  # -> initial_w, sorption_w, sorption_rh, suction_w, suction_coeff, redist_w, redist_coeff; inputs sorption_w_m3m3: list, sorption_rh: list; same code as processmasea
thickness_m_4 = Panel("0.15")
opaquemat_21 = HBOpaqueMaterial(name="DB Concrete", thickness=thickness_m_4, conductivity="1.94", density=dry_density_kg_m3_4, spec_heat="776")  # -> mat; plug-in component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
hygromat_21 = DBHygrothermalMaterial(
    mat=opaquemat_21,
    porosity="0.172",
    initial_w=processmasea_3.initial_w,
    sorption_w=processmasea_3.sorption_w,
    sorption_rh=processmasea_3.sorption_rh,
    suction_w=processmasea_3.suction_w,
    suction_coeff=processmasea_3.suction_coeff,
    redist_w=processmasea_3.redist_w,
    redist_coeff=processmasea_3.redist_coeff,
    diff_rh="0",
    diff_resist="76.1",
    info="Source: MASEA, Beton")  # -> mat; inputs sorption_w: list, sorption_rh: list, suction_w: list, suction_coeff: list, redist_w: list, redist_coeff: list, diff_rh: list, diff_resist: list, conductivity_w: list, conductivity: list; same code as hygromat

# ---- group: Insulation material
free_water_saturation_kg_m3_7 = Panel("526")
water_content_at_rh80_kg_m3_3 = Panel("17.3")
water_absorption_coefficient_kg_m2h1_2_3 = Panel("0.20")
moisture_content_m3_m3_3 = Panel("""0
0.0125
0.0173
0.025
0.526""")
isotherm_rh_3 = Panel("""0
0.65
0.80
0.93
1""")
dry_density_kg_m3_5 = Panel("168")
holzfaserdämmplatte_1_from_masea = Panel("DB Wood Fiber")
processmasea_4 = DBProcessMASEAData(
    density=dry_density_kg_m3_5,
    absorpt_coeff=water_absorption_coefficient_kg_m2h1_2_3,
    w_80=water_content_at_rh80_kg_m3_3,
    w_f=free_water_saturation_kg_m3_7,
    sorption_w_m3m3=moisture_content_m3_m3_3,
    sorption_rh=isotherm_rh_3)  # -> initial_w, sorption_w, sorption_rh, suction_w, suction_coeff, redist_w, redist_coeff; inputs sorption_w_m3m3: list, sorption_rh: list; same code as processmasea
thickness_m_5 = Panel("0.37")
opaquemat_22 = HBOpaqueMaterial(
    name=holzfaserdämmplatte_1_from_masea,
    thickness=thickness_m_5,
    conductivity="0.04",
    density=dry_density_kg_m3_5,
    spec_heat="1700",
    therm_absp="0.64",
    sol_absp="0.70",
    vis_absp="0.70")  # -> mat; plug-in component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
hygromat_22 = DBHygrothermalMaterial(
    mat=opaquemat_22,
    porosity="0.88",
    initial_w=processmasea_4.initial_w,
    sorption_w=processmasea_4.sorption_w,
    sorption_rh=processmasea_4.sorption_rh,
    suction_w=processmasea_4.suction_w,
    suction_coeff=processmasea_4.suction_coeff,
    redist_w=processmasea_4.redist_w,
    redist_coeff=processmasea_4.redist_coeff,
    diff_rh="0",
    diff_resist="3.3",
    conductivity_w="0",
    conductivity="0.04",
    info="Source: MASEA, Holzfaserdämmplatte 1")  # -> mat; inputs sorption_w: list, sorption_rh: list, suction_w: list, suction_coeff: list, redist_w: list, redist_coeff: list, diff_rh: list, diff_resist: list, conductivity_w: list, conductivity: list; same code as hygromat

# ----
water_absorption_coefficient_kg_m2h1_2_4 = Panel("4.88")
water_content_at_rh80_kg_m3_4 = Panel("15.2")
free_water_saturation_kg_m3_8 = Panel("152")
moisture_content_m3_m3_4 = Panel("""0.00458
0.00530
0.00707
0.00927
0.01515
0.02903
0.03677""")
dry_density_kg_m3_6 = Panel("2058")
isotherm_rh_4 = Panel("""0.0657
0.228
0.330
0.582
0.754
0.96
0.974""")
processmasea_5 = DBProcessMASEAData(
    density=dry_density_kg_m3_6,
    absorpt_coeff=water_absorption_coefficient_kg_m2h1_2_4,
    w_80=water_content_at_rh80_kg_m3_4,
    w_f=free_water_saturation_kg_m3_8,
    sorption_w_m3m3=moisture_content_m3_m3_4,
    sorption_rh=isotherm_rh_4)  # -> initial_w, sorption_w, sorption_rh, suction_w, suction_coeff, redist_w, redist_coeff; inputs sorption_w_m3m3: list, sorption_rh: list; same code as processmasea
thickness_m_6 = Panel("0.06")
opaquemat_23 = HBOpaqueMaterial(name="DB Cement Screed", thickness=thickness_m_6, conductivity="0.97", density=dry_density_kg_m3_6, spec_heat="699")  # -> mat; plug-in component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
hygromat_23 = DBHygrothermalMaterial(
    mat=opaquemat_23,
    porosity="0.265",
    initial_w=processmasea_5.initial_w,
    sorption_w=processmasea_5.sorption_w,
    sorption_rh=processmasea_5.sorption_rh,
    suction_w=processmasea_5.suction_w,
    suction_coeff=processmasea_5.suction_coeff,
    redist_w=processmasea_5.redist_w,
    redist_coeff=processmasea_5.redist_coeff,
    diff_rh="0",
    diff_resist="83.7",
    info="Source: MASEA, Fliessestrich FE 50")  # -> mat; inputs sorption_w: list, sorption_rh: list, suction_w: list, suction_coeff: list, redist_w: list, redist_coeff: list, diff_rh: list, diff_resist: list, conductivity_w: list, conductivity: list; same code as hygromat

path = FilePath("C:\Users\gzorzeto\Documents\GitHub_repos\dewbee_main\resources\standards\")
panel_74 = Panel(path)

water_absorption_coefficient_kg_m2h1_2_5 = Panel("0")
water_content_at_rh80_kg_m3_5 = Panel("60")
free_water_saturation_kg_m3_9 = Panel("575")
moisture_content_m3_m3_5 = Panel("""0.030303692
0.057660924
0.086559384
0.113145967
0.574""")
dry_density_kg_m3_7 = Panel("400")
isotherm_rh_5 = Panel("""0.499139772
0.798924672
0.899139746
0.969247242
0.999354819""")
thickness_m_7 = Panel("0.02")
opaquemat_24 = HBOpaqueMaterial(name="DB Softwood", thickness=thickness_m_7, conductivity="0.09", density=dry_density_kg_m3_7, spec_heat="1500")  # -> mat; plug-in component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
panel_75 = Panel("""0.249377849
0.498395516
0.60055661
0.699738031
0.900229179
0.99855931""")
panel_76 = Panel("""180.714287
64.86607655
44.64287181
29.64285649
20
10.35714351""")

processmasea_6 = DBProcessMASEAData(
    density=dry_density_kg_m3_7,
    absorpt_coeff=water_absorption_coefficient_kg_m2h1_2_5,
    w_80=water_content_at_rh80_kg_m3_5,
    w_f=free_water_saturation_kg_m3_9,
    sorption_w_m3m3=moisture_content_m3_m3_5,
    sorption_rh=isotherm_rh_5)  # -> initial_w, sorption_w, sorption_rh, suction_w, suction_coeff, redist_w, redist_coeff; inputs sorption_w_m3m3: list, sorption_rh: list; same code as processmasea

hygromat_24 = DBHygrothermalMaterial(
    mat=opaquemat_24,
    porosity="0.73",
    initial_w=processmasea_6.initial_w,
    sorption_w=processmasea_6.sorption_w,
    sorption_rh=processmasea_6.sorption_rh,
    suction_w=processmasea_6.suction_w,
    suction_coeff=processmasea_6.suction_coeff,
    redist_w=processmasea_6.redist_w,
    redist_coeff=processmasea_6.redist_coeff,
    diff_rh=panel_75,
    diff_resist=panel_76,
    info="Source: MASEA, Weichholz")  # -> mat; inputs sorption_w: list, sorption_rh: list, suction_w: list, suction_coeff: list, redist_w: list, redist_coeff: list, diff_rh: list, diff_resist: list, conductivity_w: list, conductivity: list; same code as hygromat

opaquemat_25 = HBOpaqueMaterial(name="DB Vapor Barrier (Sd = 1500)", thickness="0.00028", conductivity="0.23", density="175", spec_heat="1500")  # -> mat; plug-in component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

division_7 = Division(A=sd_m_3, B="0.00028")

hygromat_25 = DBHygrothermalMaterial(
    mat=opaquemat_25,
    porosity="0.001",
    initial_w="0",
    sorption_w="0",
    sorption_rh="0",
    diff_rh="0",
    diff_resist=division_7,
    info="Source: Ubakus, Sisalex 518")  # -> mat; inputs sorption_w: list, sorption_rh: list, suction_w: list, suction_coeff: list, redist_w: list, redist_coeff: list, diff_rh: list, diff_resist: list, conductivity_w: list, conductivity: list; same code as hygromat

merge = Merge(
    Data1=hygromat_22,
    Data2=hygromat_5,
    Data3=hygromat,
    Data4=hygromat_7,
    Data5=hygromat_21,
    Data6=hygromat_15,
    Data7=hygromat_23,
    Data8=hygromat_24,
    Data9=hygromat_16,
    Data10=hygromat_17,
    Data11=hygromat_9,
    Data12=hygromat_8,
    Data13=hygromat_19,
    Data14=hygromat_20,
    Data15=hygromat_18,
    Data16=hygromat_12,
    Data17=hygromat_25,
    Data18=hygromat_10,
    Data19=hygromat_14,
    Data20=hygromat_4,
    Data21=hygromat_3,
    Data22=hygromat_2,
    Data23=hygromat_11,
    Data24=hygromat_13,
    Data25=hygromat_6)  # -> flatten(Result)
path_2 = FilePath("C:\Users\gzorzeto\AppData\Roaming\ladybug_tools\standards\constructions\")
dumpmergeobjects = DBDumpOrMergeObjects(hb_objs=flatten(merge), name="dewbee_materials", folder=[path_2, path], indent="1", dump=Toggle(True))  # -> out, hb_file; inputs hb_objs: list, indent: Int32, abridged: Boolean, dump: Boolean
#   port out: Errors, warnings, etc.
# ---------- dumpmergeobjects: Python ----------
"""
Dump any honeybee object to a JSON file. You can use "HB Load Objects" component
to load the objects from the file back into Grasshopper.
-
This version adds merge behavior for object-library JSON files:
If the target file does not exist, it is created.
If the target file exists and contains a JSON object/dictionary, objects with
matching identifiers are replaced and new ones are appended.
If a single Honeybee Model is written, the file is overwritten as usual.
-

    Args:
        _hb_objs: A list of Honeybee objects to be written to a file.
        _name_: A name for the file to which the honeybee objects will be written.
            (Default: 'unnamed').
        _folder_: An optional directory into which the honeybee objects will be
            written. The default is set to the default simulation folder.
        indent_: An optional positive integer to set the indentation used in the
            resulting JSON file.
        abridged_: Set to "True" to serialize the object in its abridged form.
        _dump: Set to "True" to save the honeybee objects to file.
    
    Returns:
        report: Errors, warnings, and info about added/replaced objects.
        hb_file: The location of the file where the honeybee JSON is saved.
"""

ghenv.Component.Name = 'DB Dump or Merge Objects'
ghenv.Component.NickName = 'DumpMergeObjects'
ghenv.Component.Message = '0.1.2'
ghenv.Component.Category = 'Dewbee'
ghenv.Component.SubCategory = '0 :: Miscellaneous'

import os
import sys
import json
import codecs

try:  # import the core honeybee dependencies
    from honeybee.model import Model
    from honeybee.room import Room
    from honeybee.face import Face
    from honeybee.aperture import Aperture
    from honeybee.door import Door
    from honeybee.shade import Shade
    from honeybee.config import folders
except ImportError as e:
    raise ImportError('\nFailed to import honeybee:\n\t{}'.format(e))

try:  # import the core ladybug_rhino dependencies
    from ladybug_rhino.grasshopper import all_required_inputs, give_warning
except ImportError as e:
    raise ImportError('\nFailed to import ladybug_rhino:\n\t{}'.format(e))


def geo_object_warning(obj):
    """Give a warning that individual geometry objects should be added to a Model."""
    msg = 'An individual {} has been connected to the _hb_objs.\n' \
        'The recommended practice is to add this object to a Model and\n' \
        'serialize the Model instead of serializing individual objects.'.format(
            obj.__class__.__name__)
    print(msg)
    give_warning(ghenv.Component, msg)


def obj_to_dict(obj, abridged=False):
    """Serialize a Honeybee object to a dictionary."""
    try:
        return obj.to_dict(abridged=abridged)
    except TypeError:
        return obj.to_dict()


def open_utf8_read(path):
    """Open a UTF-8 file for reading in IronPython/Python 2."""
    return codecs.open(path, 'r', 'utf-8')


def open_utf8_write(path):
    """Open a UTF-8 file for writing in IronPython/Python 2."""
    return codecs.open(path, 'w', 'utf-8')


def load_existing_library(path):
    """Load an existing JSON library file.

    Returns:
        {} if file does not exist.
        Existing dictionary if valid.

    Raises:
        ValueError if the existing file is not a dictionary-based object library.
    """
    if not os.path.isfile(path):
        return {}

    with open_utf8_read(path) as fp:
        data = json.load(fp)

    if not isinstance(data, dict):
        raise ValueError(
            'Existing JSON file is not a dictionary-based object library.\n'
            'Merge is only supported for JSON files storing objects keyed by identifier.'
        )

    return data


def write_json(path, data, indent):
    """Write JSON to file as UTF-8."""
    with open_utf8_write(path) as fp:
        json.dump(data, fp, indent=indent, ensure_ascii=False)


if all_required_inputs(ghenv.Component) and _dump:
    report_msgs = []

    # set defaults
    name = _name_ if _name_ is not None else 'unnamed'
    folder = _folder_ if _folder_ is not None else folders.default_simulation_folder
    abridged = bool(abridged_)
    indent = indent_ if indent_ is not None else 4

    # choose file extension
    file_name = '{}.json'.format(name) if len(_hb_objs) > 1 or not \
        isinstance(_hb_objs[0], Model) else '{}.hbjson'.format(name)
    hb_file = os.path.join(folder, file_name)

    # warn about individual geometry objects
    geo_types = (Room, Face, Aperture, Door, Shade)
    for obj in _hb_objs:
        if isinstance(obj, geo_types):
            geo_object_warning(obj)

    # ensure output folder exists
    if not os.path.isdir(folder):
        os.makedirs(folder)

    # CASE 1: single Model -> overwrite as normal
    if len(_hb_objs) == 1 and isinstance(_hb_objs[0], Model):
        obj_dict = obj_to_dict(_hb_objs[0], abridged)
        write_json(hb_file, obj_dict, indent)
        report_msgs.append('Wrote single Model to file (overwrite mode).')

    # CASE 2: library/object dump -> merge by identifier
    else:
        # serialize incoming objects
        new_obj_dict = {}
        for obj in _hb_objs:
            try:
                obj_id = obj.identifier
            except AttributeError:
                raise ValueError(
                    'One of the connected objects does not have an "identifier" '
                    'attribute and cannot be stored in the library.'
                )
            new_obj_dict[obj_id] = obj_to_dict(obj, abridged)

        # load existing library, if any
        try:
            existing_obj_dict = load_existing_library(hb_file)
        except Exception as e:
            raise ValueError(
                'Failed to load existing JSON library file:\n{}\nPath: {}'.format(e, hb_file)
            )

        # determine added vs replaced BEFORE update
        added = []
        replaced = []
        for obj_id in new_obj_dict:
            if obj_id in existing_obj_dict:
                replaced.append(obj_id)
            else:
                added.append(obj_id)

        # merge
        existing_obj_dict.update(new_obj_dict)

        # write merged result
        write_json(hb_file, existing_obj_dict, indent)

        # report
        report_msgs.append('Merged objects into existing library.')
        report_msgs.append('Added: {}'.format(len(added)))
        report_msgs.append('Replaced: {}'.format(len(replaced)))

        if len(added) != 0:
            report_msgs.append('Added identifiers: {}'.format(', '.join(sorted(added))))
        if len(replaced) != 0:
            report_msgs.append('Replaced identifiers: {}'.format(', '.join(sorted(replaced))))

    report = '\n'.join(report_msgs)
    print(report)
# ---------- end dumpmergeobjects ----------
