# Grasshopper definition DB DEV components.ghx (Grasshopper 1.0.8)

# ---- group: 0 :: Miscellaneous
facesbyalgo = DBFacesByAlgorithm()  # -> hygro_faces, non_hygro_faces; inputs hb_objs: list
# ---------- facesbyalgo: Python ----------
"""
Get faces that will be run with HAMT (hygro_faces) and those that will be run with
regular CTF simulations (non_hygro_faces). Note that this can include Face, Door 
and InternalMass objects.
-

    Args:
        _hb_objs: An array of honeybee Models, Rooms or Faces objects to be
            separated into hygro and non hygro faces.

    Returns:
        hygro_faces: Honeybee objects that contain fully characterized hygrothermal 
        constructions and will be used in the HAMT simulations.
        non_hygro_faces: Honeybee objects that do NOT contain fully characterized 
        hygrothermal constructions and will NOT be used in the HAMT simulations.
"""

ghenv.Component.Name = 'DB Faces by Algorithm'
ghenv.Component.NickName = 'FacesByAlgo'
ghenv.Component.Message = '0.0.1'
ghenv.Component.Category = 'Dewbee'
ghenv.Component.SubCategory = '0 :: Miscellaneous'

# Turn off the "old" tag
import ghpythonlib as ghlib
c = ghlib.component._get_active_component()
c.ToggleObsolete(False)

# Import dewbee dependencies
from dewbee import utils
reload(utils)
from dewbee.utils import get_hygro_and_non_hygro_faces

from ladybug_rhino.grasshopper import all_required_inputs

if all_required_inputs(ghenv.Component):
    hygro_faces, non_hygro_faces = get_hygro_and_non_hygro_faces(_hb_objs)
# ---------- end facesbyalgo ----------
moisturesource = DBMoistureSource()  # -> rooms; inputs rooms: list, name: list, moisture_rate: list, schedule: list
# ---------- moisturesource: Python ----------
"""
Apply moisture source loads to Rooms using the Process object from Honeybee
-

    Args:
        _rooms: Honeybee Rooms to which process loads should be assigned.
        _name_: Text to set the name for the MoistureSource and to be incorporated
            into a unique MoistureSource identifier. If None, a unique name will
            be generated.
        _moisture_rate: A numerical value for the intensity of moisture generation
            in g/h. Typical cumulative values (you need to convert them to g/h!!!):
            * 200 g - Washing floors
            * 500 g - Dishwashing
            * 900-2000 g - Cooking for four
            * 200-400 g - Typical bathing/washing per person
            * 200-500 g - Five plants or one dog in a day
            _
            [Straube, J. F. (2002). Moisture in Buildings. ASHRAE Journal]
                
        _schedule_: A fractional schedule for the moisture over the course
            of the year. The fractional values will get multiplied by the
            _moisture_generation to yield a complete moisture generation 
            profile. Default: 'Always On'

    Returns:
        infil: An Infiltration object that can be used to create a ProgramType or
            be assigned directly to a Room.
"""

ghenv.Component.Name = 'DB Moisture Source'
ghenv.Component.NickName = 'MoistureSource'
ghenv.Component.Message = '0.0.1'
ghenv.Component.Category = 'Dewbee'
ghenv.Component.SubCategory = "0 :: Miscellaneous"

# Turn off the "old" tag
import ghpythonlib as ghlib
c = ghlib.component._get_active_component()
c.ToggleObsolete(False)

try:  # import the honeybee extension
    from honeybee.typing import clean_and_id_ep_string, clean_ep_string
except ImportError as e:
    raise ImportError('\nFailed to import honeybee:\n\t{}'.format(e))

try:  # import the honeybee-energy extension
    from honeybee_energy.load.process import Process
    from honeybee_energy.lib.schedules import schedule_by_identifier
except ImportError as e:
    raise ImportError('\nFailed to import honeybee_energy:\n\t{}'.format(e))

try:
    from ladybug_rhino.grasshopper import all_required_inputs, longest_list
except ImportError as e:
    raise ImportError('\nFailed to import ladybug_rhino:\n\t{}'.format(e))
    

if all_required_inputs(ghenv.Component):
    # duplicate the initial objects
    rooms = [room.duplicate() for room in _rooms]

    # set default values and check the inputs
    use_category_ = ['Moisture']
    fuel_type = ['None']
    radiant_fract_ = [0.0]
    latent_fract_ = [1]
    lost_fract_ = [0.0]
    for i, sched in enumerate(_schedule):
        if isinstance(sched, str):
            _schedule[i] = schedule_by_identifier(sched)

    # Convert moisture rate from g/h to W
    _watts = [moist / 3600 * 2450 for moist in _moisture_rate] # W
    
    # loop through the rooms and assign moisture loads
    for i, room in enumerate(rooms):
        load_watts = longest_list(_watts, i)
        if load_watts != 0:
            name = clean_and_id_ep_string('Process') if len(_name_) == 0 else \
                clean_ep_string(longest_list(_name_, i))
            process = Process(
                '{}..{}'.format(name, room.identifier), load_watts,
                longest_list(_schedule, i), longest_list(fuel_type, i),
                longest_list(use_category_, i), longest_list(radiant_fract_, i),
                longest_list(latent_fract_, i), longest_list(lost_fract_, i)
            )
            room.properties.energy.add_process_load(process)
# ---------- end moisturesource ----------
dumpmergeobjects = DBDumpOrMergeObjects()  # -> out, hb_file; inputs hb_objs: list, indent: Int32, abridged: Boolean, dump: Boolean
#   port out: Errors, warnings, etc.
# ---------- dumpmergeobjects: Python ----------
"""
Dump any honeybee object to a JSON file. You can use "HB Load Objects" component
to load the objects from the file back into Grasshopper.
-
This version adds merge behavior for object-library JSON files:
If the target file does not exist, it is created.
If the target file exists and contains a JSON object/dictionary, objects with
matching identifiers are replaced and new ones are appended.
If a single Honeybee Model is written, the file is overwritten as usual.
-

    Args:
        _hb_objs: A list of Honeybee objects to be written to a file.
        _name_: A name for the file to which the honeybee objects will be written.
            (Default: 'unnamed').
        _folder_: An optional directory into which the honeybee objects will be
            written. The default is set to the default simulation folder.
        indent_: An optional positive integer to set the indentation used in the
            resulting JSON file.
        abridged_: Set to "True" to serialize the object in its abridged form.
        _dump: Set to "True" to save the honeybee objects to file.
    
    Returns:
        report: Errors, warnings, and info about added/replaced objects.
        hb_file: The location of the file where the honeybee JSON is saved.
"""

ghenv.Component.Name = 'DB Dump or Merge Objects'
ghenv.Component.NickName = 'DumpMergeObjects'
ghenv.Component.Message = '0.0.1'
ghenv.Component.Category = 'Dewbee'
ghenv.Component.SubCategory = '0 :: Miscellaneous'

import os
import sys
import json
import codecs

try:  # import the core honeybee dependencies
    from honeybee.model import Model
    from honeybee.room import Room
    from honeybee.face import Face
    from honeybee.aperture import Aperture
    from honeybee.door import Door
    from honeybee.shade import Shade
    from honeybee.config import folders
except ImportError as e:
    raise ImportError('\nFailed to import honeybee:\n\t{}'.format(e))

try:  # import the core ladybug_rhino dependencies
    from ladybug_rhino.grasshopper import all_required_inputs, give_warning
except ImportError as e:
    raise ImportError('\nFailed to import ladybug_rhino:\n\t{}'.format(e))


def geo_object_warning(obj):
    """Give a warning that individual geometry objects should be added to a Model."""
    msg = 'An individual {} has been connected to the _hb_objs.\n' \
        'The recommended practice is to add this object to a Model and\n' \
        'serialize the Model instead of serializing individual objects.'.format(
            obj.__class__.__name__)
    print(msg)
    give_warning(ghenv.Component, msg)


def obj_to_dict(obj, abridged=False):
    """Serialize a Honeybee object to a dictionary."""
    try:
        return obj.to_dict(abridged=abridged)
    except TypeError:
        return obj.to_dict()


def open_utf8_read(path):
    """Open a UTF-8 file for reading in IronPython/Python 2."""
    return codecs.open(path, 'r', 'utf-8')


def open_utf8_write(path):
    """Open a UTF-8 file for writing in IronPython/Python 2."""
    return codecs.open(path, 'w', 'utf-8')


def load_existing_library(path):
    """Load an existing JSON library file.

    Returns:
        {} if file does not exist.
        Existing dictionary if valid.

    Raises:
        ValueError if the existing file is not a dictionary-based object library.
    """
    if not os.path.isfile(path):
        return {}

    with open_utf8_read(path) as fp:
        data = json.load(fp)

    if not isinstance(data, dict):
        raise ValueError(
            'Existing JSON file is not a dictionary-based object library.\n'
            'Merge is only supported for JSON files storing objects keyed by identifier.'
        )

    return data


def write_json(path, data, indent):
    """Write JSON to file as UTF-8."""
    with open_utf8_write(path) as fp:
        json.dump(data, fp, indent=indent, ensure_ascii=False)


if all_required_inputs(ghenv.Component) and _dump:
    report_msgs = []

    # set defaults
    name = _name_ if _name_ is not None else 'unnamed'
    folder = _folder_ if _folder_ is not None else folders.default_simulation_folder
    abridged = bool(abridged_)
    indent = indent_ if indent_ is not None else 4

    # choose file extension
    file_name = '{}.json'.format(name) if len(_hb_objs) > 1 or not \
        isinstance(_hb_objs[0], Model) else '{}.hbjson'.format(name)
    hb_file = os.path.join(folder, file_name)

    # warn about individual geometry objects
    geo_types = (Room, Face, Aperture, Door, Shade)
    for obj in _hb_objs:
        if isinstance(obj, geo_types):
            geo_object_warning(obj)

    # ensure output folder exists
    if not os.path.isdir(folder):
        os.makedirs(folder)

    # CASE 1: single Model -> overwrite as normal
    if len(_hb_objs) == 1 and isinstance(_hb_objs[0], Model):
        obj_dict = obj_to_dict(_hb_objs[0], abridged)
        write_json(hb_file, obj_dict, indent)
        report_msgs.append('Wrote single Model to file (overwrite mode).')

    # CASE 2: library/object dump -> merge by identifier
    else:
        # serialize incoming objects
        new_obj_dict = {}
        for obj in _hb_objs:
            try:
                obj_id = obj.identifier
            except AttributeError:
                raise ValueError(
                    'One of the connected objects does not have an "identifier" '
                    'attribute and cannot be stored in the library.'
                )
            new_obj_dict[obj_id] = obj_to_dict(obj, abridged)

        # load existing library, if any
        try:
            existing_obj_dict = load_existing_library(hb_file)
        except Exception as e:
            raise ValueError(
                'Failed to load existing JSON library file:\n{}\nPath: {}'.format(e, hb_file)
            )

        # determine added vs replaced BEFORE update
        added = []
        replaced = []
        for obj_id in new_obj_dict:
            if obj_id in existing_obj_dict:
                replaced.append(obj_id)
            else:
                added.append(obj_id)

        # merge
        existing_obj_dict.update(new_obj_dict)

        # write merged result
        write_json(hb_file, existing_obj_dict, indent)

        # report
        report_msgs.append('Merged objects into existing library.')
        report_msgs.append('Added: {}'.format(len(added)))
        report_msgs.append('Replaced: {}'.format(len(replaced)))

        if len(added) != 0:
            report_msgs.append('Added identifiers: {}'.format(', '.join(sorted(added))))
        if len(replaced) != 0:
            report_msgs.append('Replaced identifiers: {}'.format(', '.join(sorted(replaced))))

    report = '\n'.join(report_msgs)
    print(report)
# ---------- end dumpmergeobjects ----------
savecompos = __DBSaveCompos()  # inputs run: Boolean
# ---------- savecompos: Python ----------
"""
Save all ghuser objects available in Grasshopper\UserObjects to the repository.
Anything that has "DB" will be saved. Note that if a component is erased from the 
UserObjects directory, it won't be erased from the repo. So you should manually erase
it from the repo.

    Args:
        _run: RUN IT BABY!
"""

import os
import shutil
import Grasshopper.Kernel as ghK
from GhPython.Component import ZuiPythonComponent




ghenv.Component.Name = '__DB Save Compos'
ghenv.Component.NickName = 'SaveCompos'
ghenv.Component.Message = '0.0.1'
ghenv.Component.Category = 'Dewbee'
ghenv.Component.SubCategory = "0 :: Miscellaneous"

# Turn off the "old" tag
import ghpythonlib as ghlib
c = ghlib.component._get_active_component()
c.ToggleObsolete(False)

class NamespaceComponentsOntoCanvas(object):
    def __init__(self, namespace, source_dir, ghdoc):
        self.namespace = namespace
        self.source_dir = source_dir
        self.ghdoc = ghdoc
        self.compos = []

    def __enter__(self):
        print("Adding {} components to canvas...".format(self.namespace))

        for filename in os.listdir(self.source_dir):
            if filename.startswith('.'):
                continue
            if filename.startswith('__'):
                continue
            if not filename.endswith('.ghuser'):
                continue
            if not filename.startswith(self.namespace):
                continue

            path = os.path.join(self.source_dir, filename)
            compo = ghK.GH_UserObject(path).InstantiateObject()
            self.ghdoc.AddObject(compo, False)
            self.compos.append(compo)
            print("Added: {}".format(filename))

        return self

    def __exit__(self, exc_type, exc_val, exc_tb):
        print("Cleaning canvas...")
        for compo in self.compos:
            self.ghdoc.RemoveObject(compo, False)

def copy_py_code(gh_component, target_dir):
    if not hasattr(gh_component, "Code"):
        return

    target_path = os.path.join(target_dir, gh_component.Name + ".py")
    with open(target_path, "wb") as f:
        f.write(gh_component.Code.encode("utf-8"))
    print("Wrote code: {}".format(target_path))

def copy_ghuser(gh_component, source_dir, target_dir):
    src = os.path.join(source_dir, gh_component.Name + ".ghuser")
    dst = os.path.join(target_dir, gh_component.Name + ".ghuser")

    if not os.path.exists(src):
        raise IOError("Missing source ghuser: {}".format(src))

    shutil.copy(src, dst)
    print("Copied ghuser: {}".format(dst))

if _run:
    ghdoc = ghenv.Component.OnPingDocument()

    dewbee_source_dir = r"C:\Users\gzorzeto\AppData\Roaming\Grasshopper\UserObjects"
    dewbee_target_ghuser = r"C:\Users\gzorzeto\Documents\GitHub_repos\dewbee_main\grasshopper\user_objects"
    dewbee_target_py = r"C:\Users\gzorzeto\Documents\GitHub_repos\dewbee_main\grasshopper\src"

    with NamespaceComponentsOntoCanvas("DB", dewbee_source_dir, ghdoc) as compos:
        for compo in compos.compos:
            copy_ghuser(compo, dewbee_source_dir, dewbee_target_ghuser)
            copy_py_code(compo, dewbee_target_py)
# ---------- end savecompos ----------

# ---- group: 1 :: Construction
wetconductivity = DBWetThermalConductivity()  # -> conductivity_w, conductivity
# ---------- wetconductivity: Python ----------
"""
Generate moisture dependent thermal conductivity using a linear relationship.
conductivity = _conductivity_dry*(1+_conductivity_supplement*w/_bulk_density) 
    Args:
        _conductivity_dry: Number for the dry (10°C) thermal conductivity 
        of the material [W/m-K]
        _conductivity_supplement: Number for the linear supplement of thermal
        conductivity [%/M.-%]
        _porosity: A number between 0 and 1 for the porosity. 
            _
            This is the maximum fraction, by volume, of a material that can be
            taken up with moisture. It is used to calculate the maximum point of 
            conductivity_w.
            
        _density: A number for the dry density of the material [kg/m3]
    Returns:
        conductivity_w: A list of moisture contents for the thermal conductivities [kg/m3]

        conductivity: A list of (moisture-dependent) thermal conductivities [W/m-K]
"""

ghenv.Component.Name = "DB Wet Thermal Conductivity"
ghenv.Component.NickName = 'WetConductivity'
ghenv.Component.Message = '0.0.1'
ghenv.Component.Category = 'Dewbee'
ghenv.Component.SubCategory = "1 :: Constructions"

# Turn off the "old" tag
import ghpythonlib as ghlib
c = ghlib.component._get_active_component()
c.ToggleObsolete(False)

try:  # import ladybug_rhino dependencies
    from ladybug_rhino.grasshopper import all_required_inputs
except ImportError as e:
    raise ImportError('\nFailed to import ladybug_rhino:\n\t{}'.format(e))

# thermal conductivity of moist material
def lambda_w (w, lambda_0, b, rho):
    return lambda_0*(1+b*w/rho)

if all_required_inputs(ghenv.Component):
    w_max = _porosity*1000
    n_steps = 5
    step = w_max/n_steps
    conductivity_w = [i*step for i in range(n_steps+1)]
    conductivity = [lambda_w(w, _conductivity_dry, _conductivity_supplement, _density) 
                    for w in conductivity_w]
# ---------- end wetconductivity ----------
processmasea = DBProcessMASEAData()  # -> initial_w, sorption_w, sorption_rh, suction_w, suction_coeff, redist_w, redist_coeff; inputs sorption_w_m3m3: list, sorption_rh: list
# ---------- processmasea: Python ----------
"""
Process moisture-related data collected from the MASEA database into properties 
that can be plugged in the "HygroMat" component to create a hygrothermal material.
_
Link to MASEA: https://www.masea-ensan.com/

    Args:
        _density: Number for the density of the material [kg/m3].
            
        _absorpt_coeff: Number for the water absorption coefficient (A) [kg/(m2h1/2)]
            
        _w_80: Number for the water content at RH=80% [kg/m3]

        _w_f: Number for the water content at free saturation [kg/m3]
             
        _sorption_w_m3m3: A list of moisture contents for the sorption isotherm [m3/m3]
            This list must have the same length as _sorption_rh.
            _
            Note that the units are in m3/m3.
        _sorption_rh: A list of relative humidities between 0 and 1 for the 
            sorption isotherm [-].
            This list must have the same length as _sorption_w_m3m3.
            
    Returns:
        _initial_w: A number for the initial water content ratio [kg/kg]
            _
            This corresponds to _w_80 converted in kg/kg
        _sorption_w: A list of moisture contents for the sorption isotherm [kg/m3]
            This list must have the same length as _sorption_rh.
        _sorption_rh: A list of relative humidities between 0 and 1 for the 
            sorption isotherm [-].
        suction_w: A list of moisture contents for the liquid suction [kg/m3]
        suction_coeff: A list of (moisture-dependent) suction coefficients for 
            the liquid suction [m2/s].
        redist_w: A list of moisture contents for the liquid redistribution [kg/m3]
        redist_coeff: A list of (moisture-dependent) redistribution coefficients 
            for the liquid redistribution [m2/s].
        
"""

ghenv.Component.Name = "DB Process MASEA Data"
ghenv.Component.NickName = 'ProcessMASEA'
ghenv.Component.Message = '0.0.1'
ghenv.Component.Category = 'Dewbee'
ghenv.Component.SubCategory = "1 :: Constructions"

# Turn off the "old" tag
import ghpythonlib as ghlib
c = ghlib.component._get_active_component()
c.ToggleObsolete(False)

try:  # import ladybug_rhino dependencies
    from ladybug_rhino.grasshopper import all_required_inputs
except ImportError as e:
    raise ImportError('\nFailed to import ladybug_rhino:\n\t{}'.format(e))

# Suction liquid transport coefficient
# Based on moisture content (w) and free water saturation (wf)
def suction(A, w_f, w):
    if w <= 0: # start with 0
        return 0.0
    value = 3.8*(A/w_f)**2*1000**(w/w_f - 1)
    return max(value, 1e-15) # avoiding tiny values here
    
# Space moisture points geometrically to increase resolution near wf
def moisture_grid(w_f, n):
    return [w_f*(i/n)**2 for i in range(n+1)]


if all_required_inputs(ghenv.Component):
    # Convert (kg/m2h1/2) to (kg/m2s1/2)
    A_SI = _absorpt_coeff/60

    n_steps = 10
    suction_w = moisture_grid(_w_f, n_steps)
    suction_coeff = [suction(A_SI, _w_f, w) for w in suction_w]
    
    redist_w = suction_w
    redist_coeff = [v/10 for v in suction_coeff]
    
    initial_w = _w_80/_density
    
    sorption_w = [v*1000 for v in _sorption_w_m3m3]
    sorption_rh = _sorption_rh
    
    # Add w_f(RH=100%) if not already given
    if sorption_rh[-1] != 1 and _w_f > sorption_w[-1]:
        sorption_rh.append(1)
        sorption_w.append(_w_f)
# ---------- end processmasea ----------
liquidcoeff = DBLiquidCoefficients()  # -> suction_w, suction_coeff, redist_w, redist_coeff
# ---------- liquidcoeff: Python ----------
"""
Compute liquid transfer coefficients based on absorption coefficient and free 
saturation _w_f
_
This is only an approximation based on Künzel's exponential function. 

    Args:
        _absorpt_coeff: Number for the water absorption coefficient (A) [kg/(m2s1/2)]

        _w_f: Number for the water content at free saturation [kg/m3]
            
    Returns:
        suction_w: A list of moisture contents for the liquid suction [kg/m3]

        suction_coeff: A list of (moisture-dependent) suction coefficients for 
            the liquid suction [m2/s].
            
        redist_w: A list of moisture contents for the liquid redistribution [kg/m3]
        redist_coeff: A list of (moisture-dependent) redistribution coefficients 
            for the liquid redistribution [m2/s].
"""

ghenv.Component.Name = "DB Liquid Coefficients"
ghenv.Component.NickName = 'LiquidCoeff'
ghenv.Component.Message = '0.0.1'
ghenv.Component.Category = 'Dewbee'
ghenv.Component.SubCategory = "1 :: Constructions"

# Turn off the "old" tag
import ghpythonlib as ghlib
c = ghlib.component._get_active_component()
c.ToggleObsolete(False)

try:  # import ladybug_rhino dependencies
    from ladybug_rhino.grasshopper import all_required_inputs
except ImportError as e:
    raise ImportError('\nFailed to import ladybug_rhino:\n\t{}'.format(e))

# Suction liquid transport coefficient
# Based on moisture content (w) and free water saturation (wf)
def suction(A, w_f, w):
    if w <= 0: # start with 0
        return 0.0
    value = 3.8*(A/w_f)**2*1000**(w/w_f - 1)
    return max(value, 1e-15) # avoiding tiny values here
    
# Space moisture points geometrically to increase resolution near wf
def moisture_grid(w_f, n):
    return [w_f*(i/n)**2 for i in range(n+1)]

if all_required_inputs(ghenv.Component):
    n_steps = 10
    suction_w = moisture_grid(_w_f, n_steps)
    suction_coeff = [suction(_absorpt_coeff, _w_f, w) for w in suction_w]
    
    redist_w = suction_w
    redist_coeff = [v/10 for v in suction_coeff]
# ---------- end liquidcoeff ----------
gensorption = DBSorptionIsotherm()  # -> sorption_w, sorption_rh
# ---------- gensorption: Python ----------
"""
Estimate the sorption isotherm curve based on equilibrium moisture content at 80% RH
(_w_80) and free water saturation (_w_f).
_
Note that this is only an approximation that shows a good fit for some materials like silica brick,
and cellular concrete. It should only be used as an estimation.
This is based on Künzel (1995), Simultaneous heat and moisture transport in 
building components: one- and two-dimensional calculation using simple parameters.

    Args:
        _w_80: Number for the water content at RH=80% [kg/m3] between 1 kg/m3 and _w_f.

        _w_f: Number for the water content at free saturation [kg/m3]
            
    Returns:
        sorption_w: A list of moisture contents for the sorption isotherm [kg/m3]
            This list must have the same length as _sorption_rh.
        sorption_rh: A list of relative humidities between 0 and 1 for the 
            sorption isotherm [-].
"""

ghenv.Component.Name = "DB Sorption Isotherm"
ghenv.Component.NickName = 'GenSorption'
ghenv.Component.Message = '0.0.1'
ghenv.Component.Category = 'Dewbee'
ghenv.Component.SubCategory = "1 :: Constructions"

# Turn off the "old" tag
import ghpythonlib as ghlib
c = ghlib.component._get_active_component()
c.ToggleObsolete(False)

# Import dewbee dependencies
from dewbee import utils
reload(utils)

try:  # import ladybug_rhino dependencies
    from ladybug_rhino.grasshopper import all_required_inputs
except ImportError as e:
    raise ImportError('\nFailed to import ladybug_rhino:\n\t{}'.format(e))

def gen_w(w_80, w_f, rh):
    R = w_80/w_f
    b = 0.8*(R-1)/(R-0.8)
    return w_f*((b-1)*rh/(b-rh))

if all_required_inputs(ghenv.Component):
    if _w_80 <= 1 or _w_80 >= _w_f:
        raise ValueError("_w_80 should be larger than 1kg/m3 and smaller than {} kg/m3".format(_w_f))
    sorption_rh = utils.rh_grid()
    sorption_w = [gen_w(_w_80, _w_f, rh) for rh in sorption_rh]
# ---------- end gensorption ----------
hygromat = DBHygrothermalMaterial()  # -> mat; inputs sorption_w: list, sorption_rh: list, suction_w: list, suction_coeff: list, redist_w: list, redist_coeff: list, diff_rh: list, diff_resist: list, conductivity_w: list, conductivity: list
# ---------- hygromat: Python ----------
"""
Create a hygrothermal opaque material from a standard HB opaque material, which 
can be plugged into the "HB Opaque Construction" component. 
_
Except for _porosity and _initial_w, all hygrothermal inputs must be entered as lists.
_ 
If you don't have enough data, use the standard "HB Opaque Material" instead. 
The HAMT model will only run on surfaces with constructions containing fully 
characterized hygrothermal properties. If all constructions are characterized, 
HAMT will be run for all surfaces.
_
Check MaterialProperty:HeatAndMoistureTransfer on EnergyPlus input-output documentation
for more information on the required inputs.
    Args:
        _mat: A standard HB opaque material object. For example, it can be the
        output of the "HB Opaque Material" component.
            
        _porosity: A number between 0 and 1 for the porosity.
        
        _initial_w_: A number for the initial water content ratio [kg/kg]
             _
             The initial water content is assumed to be distributed evenly through
             the depth of the material. UNITS ARE IN KG OF WATER PER KG OF DRY MATERIAL. (Default: 0)
             
        _sorption_w_: A list of moisture contents for the sorption isotherm [kg/m3]
            This list must have the same length as _sorption_rh. Required for hygroscopic materials.
            _
            EnergyPlus automatically sets w = 0 at rh = 0 and w = porosity*1000 
            at rh=1. If you provide values at rh=0 and rh=1, they override these defaults.
            Therefore, it is recommended to provide a point at rh=1 (w_f), because 
                orption should stop at a lower value, known as free saturation (w_f), because of air pockets
                trapped in the pore structure. For realistic predictions, remember 
            Supply increasing data up to the highest rh available for stability.
            _
            * Default *: when no curve is input, an artificial curve is created based
            on porosity. If at least w_80 and w_f are known, use the GenSorption component.
            
        _sorption_w_: A list of moisture contents for the sorption isotherm [kg/m3]
            This list must have the same length as _sorption_rh. Required for hygroscopic materials.
            _
            EnergyPlus automatically defines endpoints at rh = 0 (w = 0) and adds an
            internal maximum based on porosity. If you provide values at rh = 0 or 1,
            they override these defaults.
            _
            It is recommended to include a point at rh = 1.0 corresponding to free
            saturation (w_f), since real materials typically do not reach full pore
            saturation due to trapped air. This avoids overestimating moisture storage
            in the hygroscopic range.
            _
            Provide monotonically increasing values up to the highest available RH
            for numerical stability.
            _
            *Default*: If no curve is provided, an artificial isotherm is generated
            from porosity. If at least w_80 and w_f are known, use the GenSorption component.
        
        _sorption_rh_: A list of relative humidities between 0 and 1 for the 
            sorption isotherm [-]. Required for hygroscopic materials.
            This list must have the same length as _sorption_w.           
            
        _suction_w_: A list of moisture contents for the liquid suction [kg/m3]
            This list must have the same length as _suction_coeff. Required for capillary-active materials.
            _
            At least a datapoint at w = 0 is needed. The liquid coefficient at 
            the highest entered w is used for all values above this threshold. (Default: 0)

        _suction_coeff_: A list of (moisture-dependent) suction coefficients for 
            the liquid suction [m2/s]. Required for capillary-active materials.
            This list must have the same length as _suction_w
            _
            At least a datapoint at w = 0 is needed. The liquid coefficient at 
            the highest entered w is used for all values above this threshold.
            These coefficients are used when the rain flag is set in the epw. (Default: 0)
            
        _redist_w_: A list of moisture contents for the liquid redistribution [kg/m3].
            Required for capillary-active materials.
            This list must have the same length as _redist_coeff
            _
            At least a datapoint at w = 0 is needed. The liquid coefficient at 
            the highest entered w is used for all values above this threshold. (Default: 0)
            
        _redist_coeff_: A list of (moisture-dependent) redistribution coefficients 
            for the liquid redistribution [m2/s]. Required for capillary-active materials.
            This list must have the same length as _redist_w
             _
            At least a datapoint at w = 0 is needed. The liquid coefficient at 
            the highest entered w is used for all values above this threshold.
            These coefficients are used when the rain flag is NOT set in the epw. (Default: 0)
            
        _diff_rh: A list of relative humidities between 0 and 1 for the vapor 
            diffusion resistance factors [-].
            This list must have the same length as _diff_resist.
            _
            At least a datapoint at rh = 0 is needed. The diffusion resistance 
            factor at the highest entered rh is used for all values above this threshold.
        _diff_resist: A list of (moisture-dependent) vapor diffusion resistance 
            factors [-].
            This list must have the same length as _diff_rh.
            _
            At least a datapoint at rh = 0 is needed. The diffusion resistance 
            factor at the highest entered rh is used for all values above this threshold.
            
        _conductivity_w_: A list of moisture contents for the thermal conductivities [kg/m3]
            This list must have the same length as _conductivity.
            _
            At least a datapoint at w = 0 is needed (dry thermal conductivity). 
            The thermal conductivity at the highest entered w is used for all values 
            above this threshold. (Default: 0)
            
            
        _conductivity_: A list of (moisture-dependent) thermal conductivities [W/m-K] 
            This list must have the same length as _conductivity_w.
            _
            At least a datapoint at w = 0 is needed (dry thermal conductivity). 
            The thermal conductivity at the highest entered w is used for all values 
            above this threshold. (Default: dry conductivity from _mat)
            
        _info_: An optional string describing the material. This can be useful
            to document the source (e.g., MASEA).
    Returns:
        mat: A hygrothermal opaque material that can be assigned to a Honeybee
            Opaque construction.
"""

ghenv.Component.Name = "DB Hygrothermal Material"
ghenv.Component.NickName = 'HygroMat'
ghenv.Component.Message = '0.0.1'
ghenv.Component.Category = 'Dewbee'
ghenv.Component.SubCategory = "0 :: Constructions"

# Turn off the "old" tag
import ghpythonlib as ghlib
c = ghlib.component._get_active_component()
c.ToggleObsolete(False)

# Import dewbee dependencies
from dewbee import hygro_material
from dewbee import utils
reload(hygro_material)
reload(utils)
from dewbee.hygro_material import HygroMaterial
from dewbee.utils import rh_grid

try:  # import the honeybee-energy dependencies
    from honeybee_energy.material.opaque import EnergyMaterial
except ImportError as e:
    raise ImportError('\nFailed to import honeybee_energy:\n\t{}'.format(e))

try:  # import ladybug_rhino dependencies
    from ladybug_rhino.grasshopper import all_required_inputs
except ImportError as e:
    raise ImportError('\nFailed to import ladybug_rhino:\n\t{}'.format(e))

if all_required_inputs(ghenv.Component):
    # Set defaults
    if not _initial_w_:
        _initial_w_ = 0
    # Create artificial sorption curve
    if not _sorption_w_ and not _sorption_rh_:
        _sorption_rh_ = rh_grid()
        w_f = _porosity*0.05*1000 # assume w_f = 0.05*w_max 
        b = 1.01 # keeps the curve very steep
        _sorption_w_ = [w_f*(b-1)*rh/(b-rh) for rh in _sorption_rh_]
    if not _suction_w_ and not _suction_coeff_:
        _suction_w_ = [0]
        _suction_coeff_ = [0]
    if not _redist_w_ and not _redist_coeff_:
        _redist_w_ = [0]
        _redist_coeff_ = [0]
    if not _conductivity_w_ and not _conductivity_:
        _conductivity_w_ = [0]
        _conductivity_ = [_mat.conductivity]
    if not _info_:
        _info_ = ""
    mat = _mat.duplicate()
    identifier = mat.identifier
    hygro_mat = HygroMaterial(
        identifier,
        _porosity,
        _initial_w_,
        _sorption_w_,
        _sorption_rh_,
        _suction_w_,
        _suction_coeff_,
        _redist_w_,
        _redist_coeff_,
        _diff_rh,
        _diff_resist,
        _conductivity_w_,
        _conductivity_,
        )

    #Check if corresponding lists match
    hygro_mat.values_compatible()
    
    # Add HygroMaterial object as a dictionary to the standard EnergyMaterial
    mat.user_data = {"hygro_material": hygro_mat.to_dict(),
                     "info": _info_
                    }
# ---------- end hygromat ----------
decnstrhygromat = DBDeconstructHygrothermalMaterial()  # -> name, porosity, initial_w, sorption_w, sorption_rh, suction_w, suction_coeff, redist_w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
# ---------- decnstrhygromat: Python ----------
"""
Deconstruct a hygrothermal opaque material into the attributes required to run HAMT
simulations. Note that the remaining material properties (e.g., thickness, density) 
can be retrieved as usual, with "HB Deconstruct Material".

    Args:
        _mat: A hygrothermal opaque material to be deconstructed. This can also be text for a
            material to be looked up in the material library. 

    Returns:
        
        name: Name of the hygrothermal material.
            
        porosity: A number between 0 and 1 for the porosity. It corresponds
            to the maximum fraction, by volume, of a material that can be taken up 
            with moisture.
            
        initial_w: A number for the initial water content ratio [kg/kg]
             
        sorption_w: A list of moisture contents for the sorption isotherm [kg/m3]
            
        sorption_rh: A list of relative humidities between 0 and 1 for the 
            sorption isotherm [-].    
            
        suction_w: A list of moisture contents for the liquid suction [kg/m3]

        suction_coeff: A list of (moisture-dependent) suction coefficients for 
            the liquid suction [m2/s].
            
        redist_w: A list of moisture contents for the liquid redistribution [kg/m3].
            
        redist_coeff: A list of (moisture-dependent) redistribution coefficients 
            for the liquid redistribution [m2/s].
            
        diff_rh: A list of relative humidities between 0 and 1 for the vapor 
            diffusion resistance factors [-].

        diff_resist: A list of (moisture-dependent) vapor diffusion resistance 
            factors [-].
            
        conductivity_w: A list of moisture contents for the thermal conductivities [kg/m3]
            
        conductivity: A list of (moisture-dependent) thermal conductivities [W/m-K] 
            
        info: String describing the material. 
"""

ghenv.Component.Name = "DB Deconstruct Hygrothermal Material"
ghenv.Component.NickName = 'DecnstrHygroMat'
ghenv.Component.Message = '0.0.1'
ghenv.Component.Category = 'Dewbee'
ghenv.Component.SubCategory = "1 :: Constructions"

# Import dewbee dependencies
from dewbee import hygro_material
from dewbee import utils
reload(hygro_material)
reload(utils)
from dewbee.hygro_material import HygroMaterial
from dewbee.utils import material_ishygro

import re

try:  # import the honeybee-energy dependencies
    from honeybee_energy.reader import parse_idf_string
    from honeybee_energy.lib.materials import opaque_material_by_identifier
    from honeybee_energy.lib.materials import window_material_by_identifier
except ImportError as e:
    raise ImportError('\nFailed to import honeybee_energy:\n\t{}'.format(e))
try:  # import ladybug_rhino dependencies
    from ladybug_rhino.grasshopper import all_required_inputs, give_warning
except ImportError as e:
    raise ImportError('\nFailed to import ladybug_rhino:\n\t{}'.format(e))
try:
    from ladybug.datatype.rvalue import RValue
    from ladybug.datatype.uvalue import UValue
except ImportError as e:
    raise ImportError('\nFailed to import ladybug:\n\t{}'.format(e))


if all_required_inputs(ghenv.Component):
    # check the input
    if isinstance(_mat, str):
        try:
            _mat = opaque_material_by_identifier(_mat)
        except ValueError:
            _mat = window_material_by_identifier(_mat)
    
    # check if material is hygrothermal
    if material_ishygro(_mat):    
        # get the values and attribute names from Dewbee HygroMat
        data = _mat.user_data["hygro_material"]
        hygro_mat = HygroMaterial.from_dict(data)
        
        name = hygro_mat.identifier
        porosity = hygro_mat.porosity
        initial_w = hygro_mat.initial_w
        sorption_w = hygro_mat.sorption_w
        sorption_rh = hygro_mat.sorption_rh
        suction_w = hygro_mat.suction_w
        suction_coeff = hygro_mat.suction_coeff
        redist_w = hygro_mat.redist_w
        redist_coeff = hygro_mat.redist_coeff
        diff_rh = hygro_mat.diff_rh
        diff_resist = hygro_mat.diff_resist
        conductivity_w = hygro_mat.conductivity_w
        conductivity = hygro_mat.conductivity
        
        info = _mat.user_data["info"]
    else:
        msg = "{} is not a hygrothermal material".format(_mat.identifier)
        raise TypeError (msg)
# ---------- end decnstrhygromat ----------
ishygromat = DBIsHygrothermalMaterial()  # -> result; inputs material: list
# ---------- ishygromat: Python ----------
"""
Check whether a material or a list of materials contains hygrothermal properties, 
such that it can be used to run a HAMT simulation using "DB Run HAMT Simulation".

    Args:
        _material: An opaque material or a list of opaque materials. This can 
            also be text for a material to be looked up in the material library. 

    Returns:
        result: True if material contains hygrothermal properties and can be used
            to run a HAMT simulation.
"""

ghenv.Component.Name = "DB Is Hygrothermal Material"
ghenv.Component.NickName = 'IsHygroMat'
ghenv.Component.Message = '0.0.1'
ghenv.Component.Category = 'Dewbee'
ghenv.Component.SubCategory = "1 :: Constructions"

# Import dewbee dependencies
from dewbee import hygro_material
from dewbee import utils
reload(hygro_material)
reload(utils)
from dewbee.hygro_material import HygroMaterial
from dewbee.utils import material_ishygro



try:  # import the honeybee-energy dependencies
    from honeybee_energy.lib.materials import opaque_material_by_identifier
    from honeybee_energy.lib.materials import window_material_by_identifier
    from honeybee_energy.material.glazing import EnergyWindowMaterialGlazing
except ImportError as e:
    raise ImportError('\nFailed to import honeybee_energy:\n\t{}'.format(e))
try:  # import ladybug_rhino dependencies
    from ladybug_rhino.grasshopper import all_required_inputs, give_warning
except ImportError as e:
    raise ImportError('\nFailed to import ladybug_rhino:\n\t{}'.format(e))


if all_required_inputs(ghenv.Component):
    result = []
    for _mat in _material:
        # check the input
        if isinstance(_mat, str):
            try:
                _mat = opaque_material_by_identifier(_mat)
            except ValueError:
                _mat = window_material_by_identifier(_mat)
        if isinstance(_mat, EnergyWindowMaterialGlazing):
            result.append(False)
        else:
            result.append(material_ishygro(_mat))
# ---------- end ishygromat ----------

# ---- group: 2 :: Simulation
runhamt = DBRunHAMTSimulation()  # -> report, jsons, osw, osm, idf, sql, zsz, rdd, html, add_str; inputs measures: list, add_str: list, warmup_days: Int32, sim_years: Int32, run_hamt: Boolean, write: Boolean, run: Int32
# ---------- runhamt: Python ----------
"""
Write a honeybee Model to an OSM file (OpenStudio Model), which can then be 
translated with the necessary hygrothermal data to an IDF file in order to 
run EnergyPlus Combined Heat and Moisture Transfer (HAMT) model.
_
Note that this component automatically extract the relevant hygrothermal data from
the honeybee Model, such as moisture sources and hygrothermal material data. The 
HAMT model is only applied to surfaces that have constructions with hygrothermal
material properties. The default Conduction Transfer Function (CTF) solver is applied
to all remaining surfaces.

-
    Args:
        _model: A honeybee model object possessing all geometry and corresponding
            energy simulation properties.
        _epw_file: Path to an .epw file on this computer as a text string.
        _sim_par_: A honeybee Energy SimulationParameter object that describes all
            of the setting for the simulation. If None, some default simulation
            parameters will automatically be used. It is highly recommended that
            at least 20 timesteps per hours are used in HAMT simulations.
        measures_: An optional list of measures to apply to the OpenStudio model
            upon export. Use the "HB Load Measure" component to load a measure
            into Grasshopper and assign input arguments. Measures can be
            downloaded from the NREL Building Components Library (BCL) at
            (https://bcl.nrel.gov/).
        add_str_: THIS OPTION IS JUST FOR ADVANCED USERS OF ENERGYPLUS.
            You can input additional text strings here that you would like
            written into the IDF.  The input here should be complete EnergyPlus
            objects as a single string following the IDF format. This input can
            be used to write objects into the IDF that are not currently supported
            by Honeybee.
        _folder_: An optional folder on this computer, into which the IDF and result
            files will be written.
        warmup_days_: An optional number for the amount of warm up days that precede
            the simulation. In HAMT simulations, increasing this number helps with 
            convergence. (Default: 100)
        sim_years_: An optional number for the amount of years to be simulated. In HAMT simulations,
            increasing this number allows the model to reach periodic equilibrium. If the 
            _initial_w_ of some materials is very high, the building might take multiple years to dry out.
            Conversely, if _initial_w_ is very low, the building might take many years to adsorb 
            moisture. (Default: 1).
            _
            Note that when sim_years_ > 1, sql result files must be read with custom
            Dewbee results components, because Honeybee does not support multiple years
            results.
        run_hamt_: Set to "False" to use the default EnergyPlus solver (CTF) for all 
            surfaces. This can be useful when comparing multiple models. (Default: "True")
            _
            If run_hamt_ = "True", the HAMT algorithm will be run to all surfaces 
            that have constructions with hygrothermal material properties.
        _write: Set to "True" to write out the honeybee JSONs (containing the Honeybee
            Model and Simulation Parameters) and write the OpenStudio Model file (OSM).
            This process will also write either an EnergyPlus Input Data File (IDF)
            or an OpenStudio Workflow file (OSW), which can be used to run the
            model through EnergyPlus. Most models can be simulated with just
            and IDF and so no OWS will be written. However, an OSW will be used
            if any measures_ have been connected or if the simulation parameters
            contain an efficiency standard.
        run_: Set to "True" to translate the Honeybee jsons to an OpenStudio Model
            (.osm) and EnergyPlus Input Data File (.idf) and then simulate the
            .idf in EnergyPlus. This will ensure that all result files appear
            in their respective outputs from this component.
            _
            This input can also be the integer "2", which will run the whole translation
            and simulation silently (without any batch windows).

    Returns:
        report: Check here to see a report of the EnergyPlus run.
        jsons: The file paths to the honeybee JSON files that describe the Model and
            SimulationParameter. These will be translated to an OpenStudio model.
        osw: File path to the OpenStudio Workflow JSON on this machine (if necessary
            for simulation). This workflow is executed using the OpenStudio
            command line interface (CLI) and it includes any connected
            measures_. Will be None if no OSW is needed for the simulation.
        osm: The file path to the OpenStudio Model (OSM) that has been generated
            on this computer.
        idf: The file path of the EnergyPlus Input Data File (IDF) that has been
            generated on this computer.
        sql: The file path of the SQL result file that has been generated on this
            computer. This will be None unless run_ is set to True.
        zsz: Path to a .csv file containing detailed zone load information recorded
            over the course of the design days. This will be None unless run_ is
            set to True.
        rdd: The file path of the Result Data Dictionary (.rdd) file that is
            generated after running the file through EnergyPlus.  This file
            contains all possible outputs that can be requested from the EnergyPlus
            model. Use the "HB Read Result Dictionary" component to see what outputs
            can be requested.
        html: The HTML file path containing all requested Summary Reports.
"""

ghenv.Component.Name = 'DB Run HAMT Simulation'
ghenv.Component.NickName = 'RunHAMT'
ghenv.Component.Message = '0.0.1'
ghenv.Component.Category = 'Dewbee'
ghenv.Component.SubCategory = "2 :: Simulation"

import os
import re
import json
import subprocess

# Turn off the "old" tag
import ghpythonlib as ghlib
c = ghlib.component._get_active_component()
c.ToggleObsolete(False)

# Import dewbee dependencies
from dewbee import utils
reload(utils)
from dewbee.utils import generate_hygro_idf, edit_idf

try:
    from ladybug.futil import preparedir, nukedir, copy_file_tree
    from ladybug.epw import EPW
    from ladybug.stat import STAT
except ImportError as e:
    raise ImportError('\nFailed to import ladybug:\n\t{}'.format(e))

try:
    from honeybee.config import folders
    from honeybee.model import Model
except ImportError as e:
    raise ImportError('\nFailed to import honeybee:\n\t{}'.format(e))

try:
    from honeybee_energy.simulation.parameter import SimulationParameter
    from honeybee_energy.measure import Measure
    from honeybee_energy.run import to_openstudio_sim_folder, run_osw, run_idf, \
        output_energyplus_files, _parse_os_cli_failure
    from honeybee_energy.result.err import Err
    from honeybee_energy.config import folders as energy_folders
    from honeybee_energy.writer import generate_idf_string
except ImportError as e:
    raise ImportError('\nFailed to import honeybee_energy:\n\t{}'.format(e))

try:
    from honeybee_openstudio.openstudio import OSModel
except (ImportError, AssertionError):  # Openstudio C# bindings are not usable
    OSModel = None

try:
    from lbt_recipes.version import check_openstudio_version
except ImportError as e:
    raise ImportError('\nFailed to import lbt_recipes:\n\t{}'.format(e))

try:
    from ladybug_rhino.grasshopper import all_required_inputs, give_warning
    from ladybug_rhino.config import units_system
except ImportError as e:
    raise ImportError('\nFailed to import ladybug_rhino:\n\t{}'.format(e))

ROOM_COUNT_THRESH = 1000  # threshold at which the CLI is used for translation


def measures_to_folder(measures, sim_folder):
    osw_dict = {}  # dictionary that will be turned into the OSW JSON
    osw_dict['steps'] = []
    mea_folder = os.path.join(sim_folder, 'measures')
    # ensure measures are correctly ordered
    m_dict = {'ModelMeasure': [], 'EnergyPlusMeasure': [], 'ReportingMeasure': []}
    for measure in measures:
        assert isinstance(measure, Measure), 'Expected honeybee-energy Measure. ' \
            'Got {}.'.format(type(measure))
        m_dict[measure.type].append(measure)
    sorted_measures = m_dict['ModelMeasure'] + m_dict['EnergyPlusMeasure'] + \
        m_dict['ReportingMeasure']
    # add the measures and the measure paths to the OSW
    for measure in sorted_measures:
        measure.validate()  # ensure that all required arguments have values
        osw_dict['steps'].append(measure.to_osw_dict())  # add measure to workflow
        dest_folder = os.path.join(mea_folder, os.path.basename(measure.folder))
        copy_file_tree(measure.folder, dest_folder)
        test_dir = os.path.join(dest_folder, 'tests')
        if os.path.isdir(test_dir):
            nukedir(test_dir, rmdir=True)
    # write the dictionary to a workflow.osw
    osw_json = os.path.join(mea_folder, 'workflow.osw')
    try:
        with open(osw_json, 'w') as fp:
            json.dump(osw_dict, fp, indent=4)
    except UnicodeDecodeError:  # non-unicode character in the dictionary
        with open(osw_json, 'w') as fp:
            json.dump(osw_dict, fp, indent=4, ensure_ascii=False)
    return mea_folder


if all_required_inputs(ghenv.Component) and _write:
    # check the presence of openstudio and check that the version is compatible
    check_openstudio_version()
    assert isinstance(_model, Model), \
        'Expected Honeybee Model for _model input. Got {}.'.format(type(_model))

    # process the simulation parameters
    if _sim_par_ is None:
        sim_par = SimulationParameter()
        sim_par.output.add_zone_energy_use()
        sim_par.output.add_hvac_energy_use()
        sim_par.output.add_electricity_generation()
    else:
        sim_par = _sim_par_.duplicate()  # ensure input is not edited

    # assign design days from the DDY next to the EPW if there are None
    folder, epw_file_name = os.path.split(_epw_file)
    if len(sim_par.sizing_parameter.design_days) == 0:
        msg = None
        ddy_file = os.path.join(folder, epw_file_name.replace('.epw', '.ddy'))
        if os.path.isfile(ddy_file):
            try:
                sim_par.sizing_parameter.add_from_ddy_996_004(ddy_file)
            except AssertionError:
                pass
            if len(sim_par.sizing_parameter.design_days) == 0:
                msg = 'No ddy_file_ was input into the _sim_par_ sizing ' \
                    'parameters\n and no design days were found in the .ddy file '\
                    'next to the _epw_file.'
        else:
             msg = 'No ddy_file_ was input into the _sim_par_ sizing parameters\n' \
                'and no .ddy file was found next to the _epw_file.'
        if msg is not None:
            epw_obj = EPW(_epw_file)
            des_days = [epw_obj.approximate_design_day('WinterDesignDay'),
                        epw_obj.approximate_design_day('SummerDesignDay')]
            sim_par.sizing_parameter.design_days = des_days
            msg = msg + '\nDesign days were generated from the input _epw_file but this ' \
                '\nis not as accurate as design days from DDYs distributed with the EPW.'
            give_warning(ghenv.Component, msg)
            print(msg)
    if sim_par.sizing_parameter.climate_zone is None:
        stat_file = os.path.join(folder, epw_file_name.replace('.epw', '.stat'))
        if os.path.isfile(stat_file):
            stat_obj = STAT(stat_file)
            sim_par.sizing_parameter.climate_zone = stat_obj.ashrae_climate_zone

    # process the simulation folder name and the directory
    _folder_ = folders.default_simulation_folder if _folder_ is None else _folder_
    clean_name = re.sub(r'[^.A-Za-z0-9_-]', '_', _model.display_name)
    directory = os.path.join(_folder_, clean_name, 'openstudio')

    # delete any existing files in the directory and prepare it for simulation
    nukedir(directory, True)
    preparedir(directory)
    sch_directory = os.path.join(directory, 'schedules')
    preparedir(sch_directory)

    # write the model and simulation parameter to JSONs
    model_json = os.path.join(directory, '{}.hbjson'.format(clean_name))
    with open(model_json, 'wb') as fp:
        model_str = json.dumps(_model.to_dict(), ensure_ascii=False)
        fp.write(model_str.encode('utf-8'))
    sim_par_json = os.path.join(directory, 'simulation_parameter.json')
    with open(sim_par_json, 'w') as fp:
        json.dump(sim_par.to_dict(), fp)
    jsons = [model_json, sim_par_json]
    
    run_hamt_ = True if run_hamt_ is None else run_hamt_
    if run_hamt_ > 0:
        # ------------------------------------------------------------------------------
            # Add hygrothermal objects as additional IDF strings
            idf_str, msg = generate_hygro_idf(_model)
            if msg:
                give_warning(ghenv.Component, msg)
            add_str_.append(idf_str)
        
            # Assign default values for edit_idf()
            warmup_days_ = 100 if warmup_days_ is None else warmup_days_
            sim_years_ = 1 if sim_years_ is None else sim_years_
    else:
        warmup_days_ = 25
        sim_years_ = 1
# ------------------------------------------------------------------------------
    # Run the translation with IronPython
    add_str = '\n'.join(add_str_) if len(add_str_) != 0 and \
        add_str_[0] is not None else None
    osm, osw, idf = to_openstudio_sim_folder(
        _model, directory, epw_file=_epw_file, sim_par=sim_par,
        schedule_directory=sch_directory, enforce_rooms=True,
        additional_measures=measures_, strings_to_inject=add_str)
        # ----------------------------------------------------------------------
    # Edit idf to include warmup days and multiple years to simulation
    idf = edit_idf(idf, warmup_days_, sim_years_)
    # ----------------------------------------------------------------------

    if run_ > 0:
        silent = True if run_ > 1 else False
        if idf is not None:  # run the IDF directly through E+
            sql, zsz, rdd, html, err = run_idf(idf, _epw_file, silent=silent)
        else:
            osm, idf = run_osw(osw, measures_only=False, silent=silent)
            if idf is None or not os.path.isfile(idf):
                _parse_os_cli_failure(directory)
            sql, zsz, rdd, html, err = output_energyplus_files(os.path.dirname(idf))

    # parse the error log and report any warnings
    if run_ >= 1 and err is not None:
        err_obj = Err(err)
        print(err_obj.file_contents)
        for warn in err_obj.severe_errors:
            give_warning(ghenv.Component, warn)
        for error in err_obj.fatal_errors:
            raise Exception(error)
# ---------- end runhamt ----------

# ---- group: 3 :: Results
multiyearfaceresult = DBReadFaceResultForMultipleYears()  # -> face_indoor_temp, face_outdoor_temp, opaque_energy_flow, window_loss, window_gain; inputs year: Int32
#   port opaque_energy_flow: DataCollections for the mean radiant temperature of each room (C).
#   port window_loss: DataCollections for the relative humidity of each room (%).
#   port window_gain: DataCollections for time that the heating setpoint is not met in each room (hours).
# ---------- multiyearfaceresult: Python ----------
"""
Parse all of the common Face-level comfort-related results per simulated year
from an SQL result file that has been generated from an energy simulation.

_
Note that this component only works in Windows, with hourly data for periods
longer than 1 year.

-
    Args:
        _sql: The file path of the SQL result file that has been generated from
            an energy simulation.
        _year: The simulation year to extract.

    Returns:
        face_indoor_temp: DataCollections for the indoor surface temperature of
            each surface (C).
        face_outdoor_temp: DataCollections for the outdoor surface temperature
            of each surface (C).
        face_energy_flow: DataCollections for the heat loss (negative) or heat
            gain (positive) through each building surfaces (kWh).
"""

ghenv.Component.Name = 'DB Read Face Result for Multiple Years'
ghenv.Component.NickName = 'MultiyearFaceResult'
ghenv.Component.Message = '0.0.1'
ghenv.Component.Category = 'Dewbee'
ghenv.Component.SubCategory = "3 :: Results"

import os

# Turn off the "old" tag
import ghpythonlib as ghlib
c = ghlib.component._get_active_component()
c.ToggleObsolete(False)

# Import dewbee dependencies
from dewbee import multiyear_sql
reload(multiyear_sql)
from dewbee.multiyear_sql import MultiYearSQLiteResult

try:
    from ladybug_rhino.grasshopper import all_required_inputs
except ImportError as e:
    raise ImportError('\nFailed to import ladybug_rhino:\n\t{}'.format(e))


def subtract_loss_from_gain(gain_load, loss_load):
    """Create a single DataCollection list from gains and losses."""
    total_loads = []
    for gain, loss in zip(gain_load, loss_load):
        total_load = gain - loss
        if 'type' in total_load.header.metadata:
            total_load.header.metadata['type'] = \
                total_load.header.metadata['type'].replace('Gain ', '')
        total_loads.append(total_load)
    return total_loads


# List of all the output strings that will be requested
face_indoor_temp_output = 'Surface Inside Face Temperature'
face_outdoor_temp_output = 'Surface Outside Face Temperature'
opaque_energy_flow_output = 'Surface Inside Face Conduction Heat Transfer Energy'
window_loss_output = 'Surface Window Heat Loss Energy'
window_gain_output = 'Surface Window Heat Gain Energy'

all_output = [
    face_indoor_temp_output,
    face_outdoor_temp_output,
    opaque_energy_flow_output,
    window_loss_output,
    window_gain_output
]


if all_required_inputs(ghenv.Component):
    assert os.path.isfile(_sql), 'No sql file found at: {}.'.format(_sql)

    if os.name == 'nt':
        sql_obj = MultiYearSQLiteResult(_sql)

        # Fetch all requested outputs for the specified year in one go
        all_results = sql_obj.data_collections_by_output_names_and_year(all_output, _year)

        # Unpack results
        face_indoor_temp = all_results[face_indoor_temp_output]
        face_outdoor_temp = all_results[face_outdoor_temp_output]
        opaque_energy_flow = all_results[opaque_energy_flow_output]
        window_loss = all_results[window_loss_output]
        window_gain = all_results[window_gain_output]

        # Combine window gain/loss into net window energy flow
        window_energy_flow = []
        if len(window_gain) == len(window_loss):
            window_energy_flow = subtract_loss_from_gain(window_gain, window_loss)

        # Combine opaque and window results
        face_energy_flow = opaque_energy_flow + window_energy_flow

    else:
        raise NotImplementedError(
            'This multi-year component currently only works on Windows.'
        )
# ---------- end multiyearfaceresult ----------
multiyearroomenergyresult = DBReadRoomEnergyResultForMultipleYears()  # -> cooling, heating, lighting, electric_equip, gas_equip, process, hot_water, fan_electric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; inputs year: Int32
# ---------- multiyearroomenergyresult: Python ----------
"""
Parse all of the common Room-level energy-related results per simulated year
from an SQL result file that has been generated from an energy simulation.
_
Note that this component only works in Windows, with hourly/daily/monthly data
for periods longer than 1 year.

    Args:
        _sql: The file path of the SQL result file that has been generated from
            an energy simulation.
        _year: The simulation year to extract.

    Returns:
        cooling: DataCollections for the cooling energy in kWh. For Ideal Air
            loads, this output is the sum of sensible and latent heat that must
            be removed from each room. For detailed HVAC systems, this output
            will be electric energy needed to power each chiller/cooling coil.
        heating: DataCollections for the heating energy needed in kWh. For Ideal
            Air loads, this is the heat that must be added to each room. For
            detailed HVAC systems, this will be fuel energy or electric energy
            needed for each boiler/heating element.
        lighting: DataCollections for the electric lighting energy used for
            each room in kWh.
        electric_equip: DataCollections for the electric equipment energy used
            for each room in kWh.
        gas_equip: DataCollections for the gas equipment energy used for each
            room in kWh.
        process: DataCollections for the process load energy used for each
            room in kWh.
        hot_water: DataCollections for the service hot water energy used for
            each room in kWh.
        fan_electric: DataCollections for the fan electric energy in kWh for
            either a ventilation fan or a HVAC system fan.
        pump_electric: DataCollections for the water pump electric energy in kWh
            for a heating/cooling system.
        people_gain: DataCollections for the internal heat gains in each room
            resulting from people (kWh).
        solar_gain: DataCollections for the total solar gain in each room (kWh).
        infiltration_load: DataCollections for the heat loss (negative) or heat
            gain (positive) in each room resulting from infiltration (kWh).
        mech_vent_load: DataCollections for the heat loss (negative) or heat gain
            (positive) in each room resulting from the outdoor air coming through
            the HVAC System (kWh).
        nat_vent_load: DataCollections for the heat loss (negative) or heat gain
            (positive) in each room resulting from natural ventilation (kWh).
"""

ghenv.Component.Name = 'DB Read Room Energy Result for Multiple Years'
ghenv.Component.NickName = 'MultiyearRoomEnergyResult'
ghenv.Component.Message = '0.0.1'
ghenv.Component.Category = 'Dewbee'
ghenv.Component.SubCategory = "3 :: Results"

import os
import subprocess
import json

# Turn off the "old" tag
import ghpythonlib as ghlib
c = ghlib.component._get_active_component()
c.ToggleObsolete(False)

try:
    from ladybug.datacollection import HourlyContinuousCollection, \
        MonthlyCollection, DailyCollection
except ImportError as e:
    raise ImportError('\nFailed to import ladybug:\n\t{}'.format(e))

try:
    from honeybee_energy.result.loadbalance import LoadBalance
except ImportError as e:
    raise ImportError('\nFailed to import honeybee_energy:\n\t{}'.format(e))

try:
    from ladybug_rhino.grasshopper import all_required_inputs
except ImportError as e:
    raise ImportError('\nFailed to import ladybug_rhino:\n\t{}'.format(e))

# Import dewbee dependencies
from dewbee import multiyear_sql
reload(multiyear_sql)
from dewbee.multiyear_sql import MultiYearSQLiteResult


def subtract_loss_from_gain(gain_load, loss_load):
    """Create a single DataCollection from gains and losses."""
    total_loads = []
    for gain, loss in zip(gain_load, loss_load):
        total_load = gain - loss
        total_load.header.metadata['type'] = \
            total_load.header.metadata['type'].replace('Gain ', '')
        total_loads.append(total_load)
    return total_loads


def serialize_data(data_dicts):
    """Reserialize a list of collection dictionaries."""
    if len(data_dicts) == 0:
        return []
    elif data_dicts[0]['type'] == 'HourlyContinuous':
        return [HourlyContinuousCollection.from_dict(data) for data in data_dicts]
    elif data_dicts[0]['type'] == 'Monthly':
        return [MonthlyCollection.from_dict(data) for data in data_dicts]
    elif data_dicts[0]['type'] == 'Daily':
        return [DailyCollection.from_dict(data) for data in data_dicts]


# List of all the output strings that will be requested
cooling_outputs = LoadBalance.COOLING + (
    'Cooling Coil Electricity Energy',
    'Chiller Electricity Energy',
    'Zone VRF Air Terminal Cooling Electricity Energy',
    'VRF Heat Pump Cooling Electricity Energy',
    'Chiller Heater System Cooling Electricity Energy',
    'District Cooling Water Energy',
    'Evaporative Cooler Electricity Energy')

heating_outputs = LoadBalance.HEATING + (
    'Boiler NaturalGas Energy',
    'Heating Coil Total Heating Energy',
    'Heating Coil NaturalGas Energy',
    'Heating Coil Electricity Energy',
    'Humidifier Electricity Energy',
    'Zone VRF Air Terminal Heating Electricity Energy',
    'VRF Heat Pump Heating Electricity Energy',
    'VRF Heat Pump Defrost Electricity Energy',
    'VRF Heat Pump Crankcase Heater Electricity Energy',
    'Chiller Heater System Heating Electricity Energy',
    'District Heating Water Energy',
    'Baseboard Electricity Energy',
    'Hot_Water_Loop_Central_Air_Source_Heat_Pump Electricity Consumption',
    'Boiler Electricity Energy',
    'Water Heater NaturalGas Energy',
    'Water Heater Electricity Energy',
    'Cooling Coil Water Heating Electricity Energy')

lighting_outputs = LoadBalance.LIGHTING
electric_equip_outputs = LoadBalance.ELECTRIC_EQUIP
gas_equip_outputs = LoadBalance.GAS_EQUIP
process_outputs = LoadBalance.PROCESS
shw_outputs = ('Water Use Equipment Heating Energy',) + LoadBalance.HOT_WATER

fan_electric_outputs = (
    'Zone Ventilation Fan Electricity Energy',
    'Fan Electricity Energy',
    'Cooling Tower Fan Electricity Energy')

pump_electric_outputs = 'Pump Electricity Energy'
people_gain_outputs = LoadBalance.PEOPLE_GAIN
solar_gain_outputs = LoadBalance.SOLAR_GAIN
infil_gain_outputs = LoadBalance.INFIL_GAIN
infil_loss_outputs = LoadBalance.INFIL_LOSS
vent_loss_outputs = LoadBalance.VENT_LOSS
vent_gain_outputs = LoadBalance.VENT_GAIN
nat_vent_gain_outputs = LoadBalance.NAT_VENT_GAIN
nat_vent_loss_outputs = LoadBalance.NAT_VENT_LOSS

all_output = [
    cooling_outputs, heating_outputs, lighting_outputs, electric_equip_outputs,
    gas_equip_outputs, process_outputs, shw_outputs, fan_electric_outputs,
    pump_electric_outputs, people_gain_outputs, solar_gain_outputs,
    infil_gain_outputs, infil_loss_outputs, vent_loss_outputs, vent_gain_outputs,
    nat_vent_gain_outputs, nat_vent_loss_outputs
]


if all_required_inputs(ghenv.Component):
    assert os.path.isfile(_sql), 'No sql file found at: {}.'.format(_sql)

    if os.name == 'nt':
        # Windows only: use IronPython + custom multi-year SQL parser
        sql_obj = MultiYearSQLiteResult(_sql)

        # get all of the results relevant for energy use
        cooling = sql_obj.data_collections_by_output_name_and_year(cooling_outputs, _year)
        heating = sql_obj.data_collections_by_output_name_and_year(heating_outputs, _year)
        lighting = sql_obj.data_collections_by_output_name_and_year(lighting_outputs, _year)
        electric_equip = sql_obj.data_collections_by_output_name_and_year(
            electric_equip_outputs, _year)
        hot_water = sql_obj.data_collections_by_output_name_and_year(shw_outputs, _year)
        gas_equip = sql_obj.data_collections_by_output_name_and_year(gas_equip_outputs, _year)
        process = sql_obj.data_collections_by_output_name_and_year(process_outputs, _year)
        fan_electric = sql_obj.data_collections_by_output_name_and_year(
            fan_electric_outputs, _year)
        pump_electric = sql_obj.data_collections_by_output_name_and_year(
            pump_electric_outputs, _year)

        # get all of the results relevant for gains and losses
        people_gain = sql_obj.data_collections_by_output_name_and_year(
            people_gain_outputs, _year)
        solar_gain = sql_obj.data_collections_by_output_name_and_year(
            solar_gain_outputs, _year)
        infil_gain = sql_obj.data_collections_by_output_name_and_year(
            infil_gain_outputs, _year)
        infil_loss = sql_obj.data_collections_by_output_name_and_year(
            infil_loss_outputs, _year)
        vent_loss = sql_obj.data_collections_by_output_name_and_year(
            vent_loss_outputs, _year)
        vent_gain = sql_obj.data_collections_by_output_name_and_year(
            vent_gain_outputs, _year)
        nat_vent_gain = sql_obj.data_collections_by_output_name_and_year(
            nat_vent_gain_outputs, _year)
        nat_vent_loss = sql_obj.data_collections_by_output_name_and_year(
            nat_vent_loss_outputs, _year)

    else:
        raise NotImplementedError(
            'This multi-year component currently only works on Windows.'
        )

    # do arithmetic with any of the gain/loss data collections
    infiltration_load = []
    mech_vent_load = []
    nat_vent_load = []

    if len(infil_gain) == len(infil_loss):
        infiltration_load = subtract_loss_from_gain(infil_gain, infil_loss)

    if len(vent_gain) == len(vent_loss) == len(cooling) == len(heating):
        mech_vent_loss = subtract_loss_from_gain(heating, vent_loss)
        mech_vent_gain = subtract_loss_from_gain(cooling, vent_gain)
        mech_vent_load = [data.duplicate() for data in
                          subtract_loss_from_gain(mech_vent_gain, mech_vent_loss)]
        for load in mech_vent_load:
            load.header.metadata['type'] = \
                'Zone Ideal Loads Ventilation Heat Energy'

    if len(nat_vent_gain) == len(nat_vent_loss):
        nat_vent_load = subtract_loss_from_gain(nat_vent_gain, nat_vent_loss)

    # remove the district hot water system used for service hot water from space heating
    shw_equip, distr_i = [], None
    for i, heat in enumerate(heating):
        if not isinstance(heat, float):
            try:
                heat_equip = heat.header.metadata['System']
                if heat_equip.startswith('SHW'):
                    shw_equip.append(i)
                elif heat_equip == 'SERVICE HOT WATER DISTRICT HEAT':
                    distr_i = i
            except KeyError:
                pass

    if len(shw_equip) != 0 and distr_i is None:
        hot_water = [heating.pop(i) for i in reversed(shw_equip)]
    elif distr_i is not None:
        for i in reversed(shw_equip + [distr_i]):
            heating.pop(i)
# ---------- end multiyearroomenergyresult ----------
multiyearroomcomfortresult = DBReadRoomComfortResultForMultipleYears()  # -> air_temp, oper_temp, rad_temp, rel_humidity, unmet_heat, unmet_cool; inputs year: Int32
# ---------- multiyearroomcomfortresult: Python ----------
"""
Parse all of the common Room-level comfort-related results per simulated year
from an SQL result file that has been generated from an energy simulation.
_
Note that this component only works in Windows, with hourly data for periods 
longer than 1 year.

    Args:
        _sql: The file path of the SQL result file that has been generated from
            an energy simulation.
        _year: The simulation year to extract.
    
    Returns:
        oper_temp: DataCollections for the mean operative temperature of each room (C).
        air_temp: DataCollections for the mean air temperature of each room (C).
        rad_temp: DataCollections for the mean radiant temperature of each room (C).
        rel_humidity: DataCollections for the relative humidity of each room (%).
        unmet_heat: DataCollections for time that the heating setpoint is not met
            in each room (hours).
        unmet_cool: DataCollections for time that the cooling setpoint is not met
            in each room (hours).
"""

ghenv.Component.Name = 'DB Read Room Comfort Result for Multiple Years'
ghenv.Component.NickName = 'MultiyearRoomComfortResult'
ghenv.Component.Message = '0.0.1'
ghenv.Component.Category = 'Dewbee'
ghenv.Component.SubCategory = "3 :: Results"

import os
import subprocess
import json

# Turn off the "old" tag
import ghpythonlib as ghlib
c = ghlib.component._get_active_component()
c.ToggleObsolete(False)

# Import dewbee dependencies
from dewbee import multiyear_sql
reload(multiyear_sql)
from dewbee.multiyear_sql import MultiYearSQLiteResult

try:
    from ladybug_rhino.grasshopper import all_required_inputs
except ImportError as e:
    raise ImportError('\nFailed to import ladybug_rhino:\n\t{}'.format(e))


# List of all the output strings that will be requested
oper_temp_output = 'Zone Operative Temperature'
air_temp_output = 'Zone Mean Air Temperature'
rad_temp_output = 'Zone Mean Radiant Temperature'
rel_humidity_output = 'Zone Air Relative Humidity'
heat_setpt_output = 'Zone Heating Setpoint Not Met Time'
cool_setpt_output = 'Zone Cooling Setpoint Not Met Time'
all_output = [
    oper_temp_output, air_temp_output, rad_temp_output,
    rel_humidity_output, heat_setpt_output, cool_setpt_output
]


if all_required_inputs(ghenv.Component):
    assert os.path.isfile(_sql), 'No sql file found at: {}.'.format(_sql)
    if os.name == 'nt':
        sql_obj = MultiYearSQLiteResult(_sql)
        # Fetch ALL outputs in a single query + single connection
        all_results = sql_obj.data_collections_by_output_names_and_year(all_output, _year)
        # Unpack results
        oper_temp = all_results[oper_temp_output]
        air_temp = all_results[air_temp_output]
        rad_temp = all_results[rad_temp_output]
        rel_humidity = all_results[rel_humidity_output]
        unmet_heat = all_results[heat_setpt_output]
        unmet_cool = all_results[cool_setpt_output]
    else:
        raise NotImplementedError(
            'This multi-year component currently only works on Windows.'
        )
# ---------- end multiyearroomcomfortresult ----------
