# Grasshopper definition DB DEV programs.ghx (Grasshopper 1.0.8)

# ---- group: Program / Equipment
panel = Panel("""0.10
0.10
0.10
0.10
0.10
0.10
0.10
0.2
0.6
0.8
1
0.8
0.4
0.6
1
0.8
0.6
0.2
0.1
0.1
0.1
0.1
0.1
0.1""")
weeklyschedule = HBWeeklySchedule(
    sun="0",
    mon=panel,
    tue=panel,
    wed=panel,
    thu=panel,
    fri=panel,
    sat="0",
    name="equip_sch_sia_3.1",
    type_limit="Fractional")  # -> report, schedule, idf_year, idf_week, idf_days; plug-in component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
graph = QuickGraph(panel, SortOrder=0)

# ---- group: Program / Summer period
analysisperiod = LBAnalysisPeriod(
    start_month=Slider(5, range=1..12),
    start_day=Slider(30, range=1..31),
    start_hour=0,
    end_month=Slider(9, range=1..12),
    end_day=Slider(15, range=1..31),
    end_hour=Slider(23, range=0..23))  # -> period, hoys, dates; plug-in component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

# ---- group: Program / Occupancy
panel_2 = Panel("""0
0
0
0
0
0
0
0.2
0.6
1
1
0.8
0.4
0.6
1
0.8
0.6
0.2
0
0
0
0
0
0""")
weeklyschedule_2 = HBWeeklySchedule(
    sun="0",
    mon=panel_2,
    tue=panel_2,
    wed=panel_2,
    thu=panel_2,
    fri=panel_2,
    sat="0",
    name="occ_sch_sia_3.1",
    type_limit="Fractional")  # -> report, schedule, idf_year, idf_week, idf_days; plug-in component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

# ---- group: Program / Heating and Cooling
constantschedule = HBConstantSchedule(values="26", name="cool_setpoint_sch", type_limit="Temperature")  # -> report, schedule, idf_text; plug-in component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
constantschedule_2 = HBConstantSchedule(values="21", name="heat_setpoint_sch", type_limit="Temperature")  # -> report, schedule, idf_text; plug-in component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

# ----
panel_3 = Panel("C:\Users\gzorzeto\AppData\Roaming\ladybug_tools\standards\programtypes")

# ---- group: Program
panel_4 = Panel("100")
graph_2 = QuickGraph(panel_2, SortOrder=0)
division = Division(A="1", B="14")
panel_5 = Panel("Always On")
sia_2024_3_1 = Panel("7.0")

# ---- group: Program / Activity
constantschedule_3 = HBConstantSchedule(values=panel_4, name="activity_sch_sia_3.2", type_limit="Activity Level")  # -> report, schedule, idf_text; plug-in component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

# ---- group: Program / Office program
hygienic_vent_rate_m3_h_p_sia2024_3_1 = Panel("36")
from_sia2024_einzelbüro = Panel("15.9")
setpoint = HBSetpoint(name="setpoints_mt", heating_sch=constantschedule_2.schedule, cooling_sch=constantschedule.schedule)  # -> setpoint; plug-in component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
lighting = HBLighting(name="light_mt", watts_per_area=from_sia2024_einzelbüro, schedule=weeklyschedule.schedule)  # -> lighting; plug-in component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
equipment = HBEquipment(name="equip_mt", watts_per_area=sia_2024_3_1, schedule=weeklyschedule.schedule, radiant_fract="1")  # -> equip; plug-in component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
people = HBPeople(
    name="people_sia_3.2",
    ppl_per_area=division,
    occupancy_sch=weeklyschedule_2.schedule,
    activity_sch=constantschedule_3.schedule)  # -> people; plug-in component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
infiltration = HBInfiltration(name="infiltration_mt", flow_per_ext_area="0.0001", schedule="Always On")  # -> infil; plug-in component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

# ---- group: Program (continued)
division_2 = Division(A=hygienic_vent_rate_m3_h_p_sia2024_3_1, B="3600")

# ---- group: Program / Office program (continued)
ventilation = HBVentilation(name="mech_vent_mt", flow_per_person=division_2, schedule=panel_5)  # -> vent; plug-in component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
programtype = HBProgramType(
    name="SIA_3_1_small_office",
    people=people,
    lighting=lighting,
    electric_equip=equipment,
    infiltration=infiltration,
    ventilation=ventilation,
    setpoint=setpoint)  # -> program; plug-in component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

# ----
dumpmergeobjects = DBDumpOrMergeObjects(hb_objs=flatten(programtype), name="custom_programs", folder=panel_3, indent="1", dump=Toggle(True))  # -> out, hb_file; inputs hb_objs: list, indent: Int32, abridged: Boolean, dump: Boolean
#   port out: Errors, warnings, etc.
# ---------- dumpmergeobjects: Python ----------
"""
Dump any honeybee object to a JSON file. You can use "HB Load Objects" component
to load the objects from the file back into Grasshopper.
-
This version adds merge behavior for object-library JSON files:
If the target file does not exist, it is created.
If the target file exists and contains a JSON object/dictionary, objects with
matching identifiers are replaced and new ones are appended.
If a single Honeybee Model is written, the file is overwritten as usual.
-

    Args:
        _hb_objs: A list of Honeybee objects to be written to a file.
        _name_: A name for the file to which the honeybee objects will be written.
            (Default: 'unnamed').
        _folder_: An optional directory into which the honeybee objects will be
            written. The default is set to the default simulation folder.
        indent_: An optional positive integer to set the indentation used in the
            resulting JSON file.
        abridged_: Set to "True" to serialize the object in its abridged form.
        _dump: Set to "True" to save the honeybee objects to file.
    
    Returns:
        report: Errors, warnings, and info about added/replaced objects.
        hb_file: The location of the file where the honeybee JSON is saved.
"""

ghenv.Component.Name = 'DB Dump or Merge Objects'
ghenv.Component.NickName = 'DumpMergeObjects'
ghenv.Component.Message = '0.1.2'
ghenv.Component.Category = 'Dewbee'
ghenv.Component.SubCategory = '0 :: Miscellaneous'

import os
import sys
import json
import codecs

try:  # import the core honeybee dependencies
    from honeybee.model import Model
    from honeybee.room import Room
    from honeybee.face import Face
    from honeybee.aperture import Aperture
    from honeybee.door import Door
    from honeybee.shade import Shade
    from honeybee.config import folders
except ImportError as e:
    raise ImportError('\nFailed to import honeybee:\n\t{}'.format(e))

try:  # import the core ladybug_rhino dependencies
    from ladybug_rhino.grasshopper import all_required_inputs, give_warning
except ImportError as e:
    raise ImportError('\nFailed to import ladybug_rhino:\n\t{}'.format(e))


def geo_object_warning(obj):
    """Give a warning that individual geometry objects should be added to a Model."""
    msg = 'An individual {} has been connected to the _hb_objs.\n' \
        'The recommended practice is to add this object to a Model and\n' \
        'serialize the Model instead of serializing individual objects.'.format(
            obj.__class__.__name__)
    print(msg)
    give_warning(ghenv.Component, msg)


def obj_to_dict(obj, abridged=False):
    """Serialize a Honeybee object to a dictionary."""
    try:
        return obj.to_dict(abridged=abridged)
    except TypeError:
        return obj.to_dict()


def open_utf8_read(path):
    """Open a UTF-8 file for reading in IronPython/Python 2."""
    return codecs.open(path, 'r', 'utf-8')


def open_utf8_write(path):
    """Open a UTF-8 file for writing in IronPython/Python 2."""
    return codecs.open(path, 'w', 'utf-8')


def load_existing_library(path):
    """Load an existing JSON library file.

    Returns:
        {} if file does not exist.
        Existing dictionary if valid.

    Raises:
        ValueError if the existing file is not a dictionary-based object library.
    """
    if not os.path.isfile(path):
        return {}

    with open_utf8_read(path) as fp:
        data = json.load(fp)

    if not isinstance(data, dict):
        raise ValueError(
            'Existing JSON file is not a dictionary-based object library.\n'
            'Merge is only supported for JSON files storing objects keyed by identifier.'
        )

    return data


def write_json(path, data, indent):
    """Write JSON to file as UTF-8."""
    with open_utf8_write(path) as fp:
        json.dump(data, fp, indent=indent, ensure_ascii=False)


if all_required_inputs(ghenv.Component) and _dump:
    report_msgs = []

    # set defaults
    name = _name_ if _name_ is not None else 'unnamed'
    folder = _folder_ if _folder_ is not None else folders.default_simulation_folder
    abridged = bool(abridged_)
    indent = indent_ if indent_ is not None else 4

    # choose file extension
    file_name = '{}.json'.format(name) if len(_hb_objs) > 1 or not \
        isinstance(_hb_objs[0], Model) else '{}.hbjson'.format(name)
    hb_file = os.path.join(folder, file_name)

    # warn about individual geometry objects
    geo_types = (Room, Face, Aperture, Door, Shade)
    for obj in _hb_objs:
        if isinstance(obj, geo_types):
            geo_object_warning(obj)

    # ensure output folder exists
    if not os.path.isdir(folder):
        os.makedirs(folder)

    # CASE 1: single Model -> overwrite as normal
    if len(_hb_objs) == 1 and isinstance(_hb_objs[0], Model):
        obj_dict = obj_to_dict(_hb_objs[0], abridged)
        write_json(hb_file, obj_dict, indent)
        report_msgs.append('Wrote single Model to file (overwrite mode).')

    # CASE 2: library/object dump -> merge by identifier
    else:
        # serialize incoming objects
        new_obj_dict = {}
        for obj in _hb_objs:
            try:
                obj_id = obj.identifier
            except AttributeError:
                raise ValueError(
                    'One of the connected objects does not have an "identifier" '
                    'attribute and cannot be stored in the library.'
                )
            new_obj_dict[obj_id] = obj_to_dict(obj, abridged)

        # load existing library, if any
        try:
            existing_obj_dict = load_existing_library(hb_file)
        except Exception as e:
            raise ValueError(
                'Failed to load existing JSON library file:\n{}\nPath: {}'.format(e, hb_file)
            )

        # determine added vs replaced BEFORE update
        added = []
        replaced = []
        for obj_id in new_obj_dict:
            if obj_id in existing_obj_dict:
                replaced.append(obj_id)
            else:
                added.append(obj_id)

        # merge
        existing_obj_dict.update(new_obj_dict)

        # write merged result
        write_json(hb_file, existing_obj_dict, indent)

        # report
        report_msgs.append('Merged objects into existing library.')
        report_msgs.append('Added: {}'.format(len(added)))
        report_msgs.append('Replaced: {}'.format(len(replaced)))

        if len(added) != 0:
            report_msgs.append('Added identifiers: {}'.format(', '.join(sorted(added))))
        if len(replaced) != 0:
            report_msgs.append('Replaced identifiers: {}'.format(', '.join(sorted(replaced))))

    report = '\n'.join(report_msgs)
    print(report)
# ---------- end dumpmergeobjects ----------
