# Grasshopper definition template.gh (Grasshopper 1.0.8)
# plug-ins: LadybugGrasshopper

# ---- group: Parametric room
dom = ConstructDomain(DomainStart=0, DomainEnd=Slider(5, range=0..5))
dom_2 = ConstructDomain(DomainStart=0, DomainEnd=Slider(4, range=0..5))
dom_3 = ConstructDomain(DomainStart=0, DomainEnd=Slider(2.7, range=0..5))
box = DomainBox(Base=PlaneXY(0, 0, 0), X=dom, Y=dom_2, Z=dom_3)
debrep = DeconstructBrep(Brep=box)  # -> Faces, Edges, Vertices
split = SplitList(List=debrep.Faces, Index="2")  # -> ListA, ListB

# ---- group: Insulation material
free_water_saturation_kg_m3 = Panel("526")
water_absorption_coefficient_kg_m2h1_2 = Panel("0.20")
water_content_at_rh80_kg_m3 = Panel("17.3")
moisture_content_m3_m3 = Panel("""0
0.0125
0.0173
0.025
0.526""")
isotherm_rh = Panel("""0
0.65
0.80
0.93
1""")
dry_density_kg_m3 = Panel("168")
holzfaserdämmplatte_1_from_masea = Panel("Wood fiber board")
processmasea = ProcessMASEAData(
    density=dry_density_kg_m3,
    absorpt_coeff=water_absorption_coefficient_kg_m2h1_2,
    w_80=water_content_at_rh80_kg_m3,
    w_f=free_water_saturation_kg_m3,
    sorption_w_m3m3=moisture_content_m3_m3,
    sorption_rh=isotherm_rh)  # -> initial_w, sorption_w, sorption_rh, suction_w, suction_coeff, redist_w, redist_coeff; inputs sorption_w_m3m3: list, sorption_rh: list
# ---------- processmasea: Python ----------
"""
Process moisture-related data collected from the MASEA database into properties 
that can be plugged in the "HygroMat" component to create a hygrothermal material.
_
Link to MASEA: https://www.masea-ensan.com/

    Args:
        _density: Number for the density of the material [kg/m3].
            
        _absorpt_coeff: Number for the water absorption coefficient (A) [kg/(m2h1/2)]
            
        _w_80: Number for the water content at RH=80% [kg/m3]

        _w_f: Number for the water content at free saturation [kg/m3]
             
        _sorption_w_m3m3: A list of moisture contents for the sorption isotherm [m3/m3]
            This list must have the same length as _sorption_rh.
            _
            Note that the units are in m3/m3.
        _sorption_rh: A list of relative humidities between 0 and 1 for the 
            sorption isotherm [-].
            This list must have the same length as _sorption_w_m3m3.
            
    Returns:
        _initial_w: A number for the initial water content ratio [kg/kg]
            _
            This corresponds to _w_80 converted in kg/kg
        _sorption_w: A list of moisture contents for the sorption isotherm [kg/m3]
            This list must have the same length as _sorption_rh.
        _sorption_rh: A list of relative humidities between 0 and 1 for the 
            sorption isotherm [-].
        suction_w: A list of moisture contents for the liquid suction [kg/m3]
        suction_coeff: A list of (moisture-dependent) suction coefficients for 
            the liquid suction [m2/s].
        redist_w: A list of moisture contents for the liquid redistribution [kg/m3]
        redist_coeff: A list of (moisture-dependent) redistribution coefficients 
            for the liquid redistribution [m2/s].
        
"""

ghenv.Component.Name = "Process MASEA Data"
ghenv.Component.NickName = 'ProcessMASEA'
ghenv.Component.Message = '0.0.1'
ghenv.Component.Category = 'Dewbee'
ghenv.Component.SubCategory = ""

# Turn off the "old" tag
import ghpythonlib as ghlib
c = ghlib.component._get_active_component()
c.ToggleObsolete(False)

try:  # import ladybug_rhino dependencies
    from ladybug_rhino.grasshopper import all_required_inputs
except ImportError as e:
    raise ImportError('\nFailed to import ladybug_rhino:\n\t{}'.format(e))

# Suction liquid transport coefficient
# Based on moisture content (w) and free water saturation (wf)
def suction(A, w_f, w):
    if w <= 0: # start with 0
        return 0.0
    value = 3.8*(A/w_f)**2*1000**(w/w_f - 1)
    return max(value, 1e-15) # avoiding tiny values here
    
# Space moisture points geometrically to increase resolution near wf
def moisture_grid(w_f, n):
    return [w_f*(i/n)**2 for i in range(n+1)]


if all_required_inputs(ghenv.Component):
    # Convert (kg/m2h1/2) to (kg/m2s1/2)
    A_SI = _absorpt_coeff/60

    n_steps = 10
    suction_w = moisture_grid(_w_f, n_steps)
    suction_coeff = [suction(A_SI, _w_f, w) for w in suction_w]
    
    redist_w = suction_w
    redist_coeff = [v/10 for v in suction_coeff]
    
    initial_w = _w_80/_density
    
    sorption_w = [v*1000 for v in _sorption_w_m3m3]
    sorption_rh = _sorption_rh
# ---------- end processmasea ----------
thickness_m = Panel("0.37")
opaquemat = HBOpaqueMaterial(
    name=holzfaserdämmplatte_1_from_masea,
    thickness=thickness_m,
    conductivity="0.04",
    density=dry_density_kg_m3,
    spec_heat="1700",
    therm_absp="0.64",
    sol_absp="0.70",
    vis_absp="0.70")  # -> mat; plug-in component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
hygromat = HygrothermalOpaqueMaterial(
    mat=opaquemat,
    porosity="0.88",
    initial_w=processmasea.initial_w,
    sorption_w=processmasea.sorption_w,
    sorption_rh=processmasea.sorption_rh,
    suction_w=processmasea.suction_w,
    suction_coeff=processmasea.suction_coeff,
    redist_w=processmasea.redist_w,
    redist_coeff=processmasea.redist_coeff,
    diff_rh="0",
    diff_resist="3.3",
    conductivity_w="0",
    conductivity="0.04")  # -> out, mat; inputs sorption_w: list, sorption_rh: list, suction_w: list, suction_coeff: list, redist_w: list, redist_coeff: list, diff_rh: list, diff_resist: list, conductivity_w: list, conductivity: list
# ---------- hygromat: Python ----------
"""
Create a hygrothermal opaque material from a standard HB opaque material, which 
can be plugged into the "HB Opaque Construction" component. 
_
Note that all hygrothermal inputs are needed. Except for _porosity and _initial_w,
all hygrothermal inputs must be entered as a lists.
_ 
If you don't have enough data, use the standard "HB Opaque Material" instead. 
The HAMT model will only run on surfaces with constructions containing fully 
characterized hygrothermal properties. If all constructions are characterized, 
HAMT will be run for all surfaces.
_
Check MaterialProperty:HeatAndMoistureTransfer on EnergyPlus input-output documentation
for more information on the required inputs.
    Args:
        _mat: A standard HB opaque material object. For example, it can be the
        output of the "HB Opaque Material" component.
            
        _porosity: A number between 0 and 1 for the porosity. 
            _
            This is the maximum fraction, by volume, of a material that can be
            taken up with moisture. It is used to calculate the maximum point on 
            the sorption isotherm curve.
            
        _initial_w: A number for the initial water content ratio [kg/kg]
             _
             The initial water content is assumed to be distributed evenly through
             the depth of the material. Units are in kg of water per kg of dry material.
             
        _sorption_w: A list of moisture contents for the sorption isotherm [kg/m3]
            This list must have the same length as _sorption_rh.
            _
            Note that E+ automatically calculates the moisture content w at 
            0 and 100% relative humidity (rh), assigning 0 and maximum water 
            content based on porosity, respectively. However, these are overwritten 
            if new w are added to 0 and 100% rh. Following WUFI's recommendation, 
            it is more reasonable to overwrite w(rh=100%) with the free saturation 
            water content (wf). Data should be provided with increasing rh and w 
            up to as high an rh as possible to provide a stable solution.
        _sorption_rh: A list of relative humidities between 0 and 1 for the 
            sorption isotherm [-].
            This list must have the same length as _sorption_w.
            
        _suction_w: A list of moisture contents for the liquid suction [kg/m3]
            This list must have the same length as _suction_coeff
            _
            At least a datapoint at w = 0 is needed. The liquid coefficient at 
            the highest entered w is used for all values above this threshold.
        _suction_coeff: A list of (moisture-dependent) suction coefficients for 
            the liquid suction [m2/s].
            This list must have the same length as _suction_w
            _
            At least a datapoint at w = 0 is needed. The liquid coefficient at 
            the highest entered w is used for all values above this threshold.
            These coefficients are used when the rain flag is set in the epw.
            
        _redist_w: A list of moisture contents for the liquid redistribution [kg/m3]
            This list must have the same length as _redist_coeff
            _
            At least a datapoint at w = 0 is needed. The liquid coefficient at 
            the highest entered w is used for all values above this threshold.
        _redist_coeff: A list of (moisture-dependent) redistribution coefficients 
            for the liquid redistribution [m2/s].
            This list must have the same length as _redist_w
             _
            At least a datapoint at w = 0 is needed. The liquid coefficient at 
            the highest entered w is used for all values above this threshold.
            These coefficients are used when the rain flag is NOT set in the epw.
            
        _diff_rh: A list of relative humidities between 0 and 1 for the vapor 
            diffusion resistance factors [-].
            This list must have the same length as _diff_resist.
            _
            At least a datapoint at rh = 0 is needed. The diffusion resistance 
            factor at the highest entered rh is used for all values above this threshold.
        _diff_resist: A list of (moisture-dependent) vapor diffusion resistance 
            factors [-].
            This list must have the same length as _diff_rh.
            _
            At least a datapoint at rh = 0 is needed. The diffusion resistance 
            factor at the highest entered rh is used for all values above this threshold.
            
        _conductivity_w: A list of moisture contents for the thermal conductivities [kg/m3]
            This list must have the same length as _conductivity.
            _
            At least a datapoint at w = 0 is needed (dry thermal conductivity). 
            The thermal conductivity at the highest entered w is used for all values 
            above this threshold.
        _conductivity: A list of (moisture-dependent) thermal conductivities [W/m-K]
            This list must have the same length as _conductivity_w.
            _
            At least a datapoint at w = 0 is needed (dry thermal conductivity). 
            The thermal conductivity at the highest entered w is used for all values 
            above this threshold.
    Returns:
        mat: A hygrothermal opaque material that can be assigned to a Honeybee
            Opaque construction.
"""

ghenv.Component.Name = "Hygrothermal Opaque Material"
ghenv.Component.NickName = 'HygroMat'
ghenv.Component.Message = '0.0.1'
ghenv.Component.Category = 'Dewbee'
ghenv.Component.SubCategory = ""

# Turn off the "old" tag
import ghpythonlib as ghlib
c = ghlib.component._get_active_component()
c.ToggleObsolete(False)

# Import dewbee dependencies
from dewbee import hygro_material
reload(hygro_material)
from dewbee.hygro_material import HygroMaterial

try:  # import the honeybee-energy dependencies
    from honeybee_energy.material.opaque import EnergyMaterial
except ImportError as e:
    raise ImportError('\nFailed to import honeybee_energy:\n\t{}'.format(e))

try:  # import ladybug_rhino dependencies
    from ladybug_rhino.grasshopper import all_required_inputs
except ImportError as e:
    raise ImportError('\nFailed to import ladybug_rhino:\n\t{}'.format(e))

if all_required_inputs(ghenv.Component):
    mat = _mat.duplicate()
    identifier = mat.identifier
    hygro_mat = HygroMaterial(
        identifier,
        _porosity,
        _initial_w,
        _sorption_w,
        _sorption_rh,
        _suction_w,
        _suction_coeff,
        _redist_w,
        _redist_coeff,
        _diff_rh,
        _diff_resist,
        _conductivity_w,
        _conductivity,
        )
        
    #Check if corresponding lists match
    hygro_mat.values_compatible()
    
    # Add HygroMaterial object as a dictionary to the standard EnergyMaterial
    mat.user_data = {"hygro_material": hygro_mat.to_dict()}
# ---------- end hygromat ----------

# ---- group: Lime plaster
water_absorption_coefficient_kg_m2h1_2_2 = Panel("3")
water_content_at_rh80_kg_m3_2 = Panel("30")
free_water_saturation_kg_m3_2 = Panel("250")
moisture_content_m3_m3_2 = Panel("""0
0.02
0.03
0.05
0.07
0.18
0.25""")
isotherm_rh_2 = Panel("""0
0.5
0.8
0.9
0.93
0.99
1""")
dry_density_kg_m3_2 = Panel("1600")
kalkputz_from_masea = Panel("lime plaster")
processmasea_2 = ProcessMASEAData(
    density=dry_density_kg_m3_2,
    absorpt_coeff=water_absorption_coefficient_kg_m2h1_2_2,
    w_80=water_content_at_rh80_kg_m3_2,
    w_f=free_water_saturation_kg_m3_2,
    sorption_w_m3m3=moisture_content_m3_m3_2,
    sorption_rh=isotherm_rh_2)  # -> initial_w, sorption_w, sorption_rh, suction_w, suction_coeff, redist_w, redist_coeff; inputs sorption_w_m3m3: list, sorption_rh: list; same code as processmasea
thickness_m_2 = Panel("0.03")
opaquemat_2 = HBOpaqueMaterial(
    name=kalkputz_from_masea,
    thickness=thickness_m_2,
    conductivity="0.7",
    density=dry_density_kg_m3_2,
    spec_heat="850",
    therm_absp="0.64",
    sol_absp="0.70",
    vis_absp="0.70")  # -> mat; plug-in component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
hygromat_2 = HygrothermalOpaqueMaterial(
    mat=opaquemat_2,
    porosity="0.3",
    initial_w=processmasea_2.initial_w,
    sorption_w=processmasea_2.sorption_w,
    sorption_rh=processmasea_2.sorption_rh,
    suction_w=processmasea_2.suction_w,
    suction_coeff=processmasea_2.suction_coeff,
    redist_w=processmasea_2.redist_w,
    redist_coeff=processmasea_2.redist_coeff,
    diff_rh="0",
    diff_resist="7",
    conductivity_w="0",
    conductivity="0.7")  # -> out, mat; inputs sorption_w: list, sorption_rh: list, suction_w: list, suction_coeff: list, redist_w: list, redist_coeff: list, diff_rh: list, diff_resist: list, conductivity_w: list, conductivity: list; same code as hygromat

# ---- group: Occupancy
panel = Panel("""1
1
1
1
1
1
0.6
0.4
0
0
0
0
0.8
0.4
0
0
0
0.4
0.8
0.8
0.8
1
1
1""")
constantschedule = HBConstantSchedule(values=panel, name="SIA_OCC_SCH")  # -> report, schedule, idf_text; plug-in component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

# ---- group: Lighting and Appliances
panel_2 = Panel("""0.1
0.1
0.1
0.1
0.1
0.2
0.8
0.2
0.1
0.1
0.1
0.1
0.8
0.2
0.1
0.1
0.1
0.2
0.8
1
0.2
0.2
0.2
0.1""")
constantschedule_2 = HBConstantSchedule(values=panel_2, name="SIA_LIGHT_SCH")  # -> report, schedule, idf_text; plug-in component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

# ---- group: Moisture
panel_3 = Panel("""0.1
0.1
0.1
0.1
0.1
0.2
0.8
0.2
0.1
0.1
0.1
0.1
0.8
0.2
0.1
0.1
0.1
0.2
0.8
1
0.2
0.2
0.2
0.1""")
# Ventilation schedule
constantschedule_3 = HBConstantSchedule(values=panel_3, name="MOISTURE_SCH")  # -> report, schedule, idf_text; plug-in component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

# ---- group: Activity
constantschedule_4 = HBConstantSchedule(values="126", name="SIA_ACT_SCH", type_limit="Activity Level")  # -> report, schedule, idf_text; plug-in component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

# ---- group: Heating and Cooling
constantschedule_5 = HBConstantSchedule(values="26", name="SIA_COOL_SCH", type_limit="Temperature")  # -> report, schedule, idf_text; plug-in component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
constantschedule_6 = HBConstantSchedule(values="21", name="SIA_HEAT_SCH", type_limit="Temperature")  # -> report, schedule, idf_text; plug-in component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

# ---- group: SRE material
# Allinson and Hall, 2010
free_water_saturation_kg_m3_3 = Panel("253.47")
water_absorption_coefficient_kg_m2s1_2 = Panel("0.089")
genliquidcoeff = GenerateLiquidCoefficients(absorpt_coeff=water_absorption_coefficient_kg_m2s1_2, w_f=free_water_saturation_kg_m3_3)  # -> suction_w, suction_coeff, redist_w, redist_coeff
# ---------- genliquidcoeff: Python ----------
"""
Compute liquid transfer coefficients based on absorption coefficient and free 
saturation _w_f
_
This is only an approximation based on Künzel's exponential function. 

    Args:
        _absorpt_coeff: Number for the water absorption coefficient (A) [kg/(m2s1/2)]

        _w_f: Number for the water content at free saturation [kg/m3]
            
    Returns:
        suction_w: A list of moisture contents for the liquid suction [kg/m3]

        suction_coeff: A list of (moisture-dependent) suction coefficients for 
            the liquid suction [m2/s].
            
        redist_w: A list of moisture contents for the liquid redistribution [kg/m3]
        redist_coeff: A list of (moisture-dependent) redistribution coefficients 
            for the liquid redistribution [m2/s].
"""

ghenv.Component.Name = "Generate Liquid Coefficients"
ghenv.Component.NickName = 'GenLiquidCoeff'
ghenv.Component.Message = '0.0.1'
ghenv.Component.Category = 'Dewbee'
ghenv.Component.SubCategory = ""

# Turn off the "old" tag
import ghpythonlib as ghlib
c = ghlib.component._get_active_component()
c.ToggleObsolete(False)

try:  # import ladybug_rhino dependencies
    from ladybug_rhino.grasshopper import all_required_inputs
except ImportError as e:
    raise ImportError('\nFailed to import ladybug_rhino:\n\t{}'.format(e))

# Suction liquid transport coefficient
# Based on moisture content (w) and free water saturation (wf)
def suction(A, w_f, w):
    if w <= 0: # start with 0
        return 0.0
    value = 3.8*(A/w_f)**2*1000**(w/w_f - 1)
    return max(value, 1e-15) # avoiding tiny values here
    
# Space moisture points geometrically to increase resolution near wf
def moisture_grid(w_f, n):
    return [w_f*(i/n)**2 for i in range(n+1)]

if all_required_inputs(ghenv.Component):
    n_steps = 10
    suction_w = moisture_grid(_w_f, n_steps)
    suction_coeff = [suction(_absorpt_coeff, _w_f, w) for w in suction_w]
    
    redist_w = suction_w
    redist_coeff = [v/10 for v in suction_coeff]
# ---------- end genliquidcoeff ----------
opaquemat_3 = HBOpaqueMaterial(name="SCEB", thickness="0.30", conductivity="0.643", density="1900", spec_heat="868")  # -> mat; plug-in component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
panel_4 = Panel("""0.3285
0.4305
0.5815
0.7558
0.80
0.9406
1""")
panel_5 = Panel("""23.13
27.81
40.31
53.44
61.5
105.63
253.47""")
thermalcondmoist = GenerateMoistureDependentThermalConductivity(conductivity_dry="0.643", conductivity_supplement="4.39", density="1900", porosity="0.295")  # -> conductivity_w, conductivity
# ---------- thermalcondmoist: Python ----------
"""
Generate moisture dependent thermal conductivity using a linear relationship.
conductivity = _conductivity_dry*(1+_conductivity_supplement*w/_bulk_density) 
    Args:
        _conductivity_dry: Number for the dry (10°C) thermal conductivity 
        of the material [W/m-K]
        _conductivity_supplement: Number for the linear supplement of thermal
        conductivity [%/M.-%]
        _porosity: A number between 0 and 1 for the porosity. 
            _
            This is the maximum fraction, by volume, of a material that can be
            taken up with moisture. It is used to calculate the maximum point of 
            conductivity_w.
            
        _density: A number for the dry density of the material [kg/m3]
    Returns:
        conductivity_w: A list of moisture contents for the thermal conductivities [kg/m3]

        conductivity: A list of (moisture-dependent) thermal conductivities [W/m-K]
"""

ghenv.Component.Name = "Generate Moisture-Dependent Thermal Conductivity"
ghenv.Component.NickName = 'ThermalCondMoist'
ghenv.Component.Message = '0.0.1'
ghenv.Component.Category = 'Dewbee'
ghenv.Component.SubCategory = ""

# Turn off the "old" tag
import ghpythonlib as ghlib
c = ghlib.component._get_active_component()
c.ToggleObsolete(False)

# thermal conductivity of moist material
def lambda_w (w, lambda_0, b, rho):
    return lambda_0*(1+b*w/rho)

w_max = _porosity*1000
n_steps = 5
step = w_max/n_steps
conductivity_w = [i*step for i in range(n_steps+1)]
conductivity = [lambda_w(w, _conductivity_dry, _conductivity_supplement, _density) 
                for w in conductivity_w]
# ---------- end thermalcondmoist ----------
hygromat_3 = HygrothermalOpaqueMaterial(
    mat=opaquemat_3,
    porosity="0.295",
    initial_w="61.5",
    sorption_w=panel_5,
    sorption_rh=panel_4,
    suction_w=genliquidcoeff.suction_w,
    suction_coeff=genliquidcoeff.suction_coeff,
    redist_w=genliquidcoeff.redist_w,
    redist_coeff=genliquidcoeff.redist_coeff,
    diff_rh="0",
    diff_resist="14.34",
    conductivity_w=thermalcondmoist.conductivity_w,
    conductivity=thermalcondmoist.conductivity)  # -> out, mat; inputs sorption_w: list, sorption_rh: list, suction_w: list, suction_coeff: list, redist_w: list, redist_coeff: list, diff_rh: list, diff_resist: list, conductivity_w: list, conductivity: list; same code as hygromat

# ---- group: RE material
panel_6 = Panel("""0
4.41e-9
6.64e-9
5.44e-9
6.04e-9
6.75e-9
7.42e-9
8.34e-9
9.42e-9""")
panel_7 = Panel("""0
4.41e-10
6.64e-10
5.44e-10
6.04e-10
6.75e-10
7.42e-10
8.34e-10
9.42e-10""")
panel_8 = Panel("""0
6.27
15.97
23.86
32.35
40.84
71.38""")
panel_9 = Panel("""8.492
13.124
17.177
21.809
26.441
31.652
40.144
46.32
54.426
75.656""")
panel_10 = Panel("""0.09
0.2293
0.3542
0.4851
0.5896
0.6808
0.7863
0.842
0.8954
0.9836""")
panel_11 = Panel("""1.34
1.39
1.44
1.55
1.57
1.61
1.86""")
item = ListItem(List=panel_11, Index=0, Wrap=True)
opaquemat_4 = HBOpaqueMaterial(
    name="RE",
    thickness="0.40",
    conductivity=item,
    density="1930",
    spec_heat="773",
    therm_absp="0.64",
    sol_absp="0.70",
    vis_absp="0.70")  # -> mat; plug-in component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
panel_12 = Panel("""0
51.460914
55.788884
60.427519
64.906402
69.578136
73.607479
78.499961
84.139304""")
hygromat_4 = HygrothermalOpaqueMaterial(
    mat=opaquemat_4,
    porosity="0.25",
    initial_w="0.04",
    sorption_w=panel_9,
    sorption_rh=panel_10,
    suction_w=panel_12,
    suction_coeff=panel_6,
    redist_w=panel_12,
    redist_coeff=panel_7,
    diff_rh="0",
    diff_resist="7.8",
    conductivity_w=panel_8,
    conductivity=panel_11)  # -> out, mat; inputs sorption_w: list, sorption_rh: list, suction_w: list, suction_coeff: list, redist_w: list, redist_coeff: list, diff_rh: list, diff_resist: list, conductivity_w: list, conductivity: list; same code as hygromat

# ----
infiltration_m3_s_m2 = Data(9.259259259e-05)
servicehotwater = HBServiceHotWater(name="SIA_DHW", flow_per_area="0.0825", schedule=constantschedule.schedule)  # -> hot_water; plug-in component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
setpoint = HBSetpoint(name="SIA_SETPOINTS", heating_sch=constantschedule_6.schedule, cooling_sch=constantschedule_5.schedule)  # -> setpoint; plug-in component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
people = HBPeople(
    name="SIA_PEOPLE",
    ppl_per_area="0.02",
    occupancy_sch=constantschedule.schedule,
    activity_sch=constantschedule_4.schedule)  # -> people; plug-in component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
infiltration = HBInfiltration(name="SIA_INF", flow_per_ext_area=infiltration_m3_s_m2)  # -> infil; plug-in component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
ventilation = HBVentilation(name="SIA_VENT", ach="1", schedule="Always On")  # -> vent; plug-in component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
lighting = HBLighting(name="SIA_LIGHT", watts_per_area="2.70", schedule=constantschedule_2.schedule)  # -> lighting; plug-in component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
equipment = HBEquipment(name="SIA_EQUIP", watts_per_area="8", schedule=constantschedule_2.schedule, radiant_fract="1")  # -> equip; plug-in component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
programtype = HBProgramType(
    name="SIA_MFH_PROGRAM",
    people=people,
    lighting=lighting,
    electric_equip=equipment,
    hot_water=servicehotwater,
    infiltration=infiltration,
    ventilation=ventilation,
    setpoint=setpoint)  # -> program; plug-in component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

# ---- group: Create constructions and construction set / Window
windowmat = HBWindowMaterial(name="SIA_WINDOW", u_factor="1.2", shgc="0.5", t_vis="0.5")  # -> mat; plug-in component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
windowconstr = HBWindowConstruction(name="SIA_WINDOW", materials=windowmat)  # -> constr; plug-in component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

# ---- group: Create constructions and construction set / HB materials
merge = Merge(Data1=hygromat_2.mat, Data2=hygromat.mat, Data3=hygromat_4.mat)  # -> flatten(Result)

# ---- group: Create constructions and construction set
opaqueconstr = HBOpaqueConstruction(name="INS_RE", materials=merge)  # -> constr; plug-in component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
subfacesubset = HBSubfaceSubset(window=windowconstr, operable=windowconstr)  # -> subface_set; plug-in component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
exteriorsubset = HBExteriorConstructionSubset(exterior_wall=opaqueconstr)  # -> exterior_set; plug-in component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
constructionset = HBConstructionSet(name="CustomSet", exterior_subset=exteriorsubset, subface_subset=subfacesubset)  # -> constr_set; plug-in component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

# ----
falsestart = LBFalseStartToggle(False)

# ----
# Create Honeybee Room
panel_13 = Panel("outdoors")
geo = Geometry(split.ListB)
geo_2 = Geometry(split.ListA)
face = HBFace(geo=geo, bc="adiabatic")  # -> report, faces; plug-in component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
face_2 = HBFace(geo=geo_2, bc=panel_13)  # -> report, faces; plug-in component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
south_wwr = Slider(0.4, range=0.1..0.9)
room = HBRoom(
    faces=flatten([face_2.faces, face.faces]),
    name="MFH_room",
    constr_set=constructionset,
    program=programtype,
    conditioned=Toggle(True))  # -> report, room; plug-in component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
merge_2 = Merge(Data1="0", Data2="0", Data3=south_wwr, Data4="0")
aperturesbyratio = HBAperturesByRatio(hb_objs=flatten(room.room), ratio=merge_2, subdivide=Toggle(False), operable=Toggle(True))  # -> report, hb_objs; plug-in component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

moisturesource = MoistureSource(rooms=aperturesbyratio.hb_objs, name="PlantMoisture", moisture_rate="40", schedule=constantschedule_3.schedule)  # -> rooms; inputs rooms: list, name: list, moisture_rate: list, schedule: list
# ---------- moisturesource: Python ----------
"""
Apply moisture source loads to Rooms using the Process object from Honeybee
-

    Args:
        _rooms: Honeybee Rooms to which process loads should be assigned.
        _name_: Text to set the name for the MoistureSource and to be incorporated
            into a unique MoistureSource identifier. If None, a unique name will
            be generated.
        _moisture_rate: A numerical value for the intensity of moisture generation
            in g/h. Typical cumulative values (you need to convert them to g/h!!!):
            * 200 g - Washing floors
            * 500 g - Dishwashing
            * 900-2000 g - Cooking for four
            * 200-400 g - Typical bathing/washing per person
            * 200-500 g - Five plants or one dog in a day
            _
            [Straube, J. F. (2002). Moisture in Buildings. ASHRAE Journal]
                
        _schedule_: A fractional schedule for the moisture over the course
            of the year. The fractional values will get multiplied by the
            _moisture_generation to yield a complete moisture generation 
            profile. Default: 'Always On'

    Returns:
        infil: An Infiltration object that can be used to create a ProgramType or
            be assigned directly to a Room.
"""

ghenv.Component.Name = 'Moisture Source'
ghenv.Component.NickName = 'MoistureSource'
ghenv.Component.Message = '0.0.1'
ghenv.Component.Category = 'Dewbee'

# Turn off the "old" tag
import ghpythonlib as ghlib
c = ghlib.component._get_active_component()
c.ToggleObsolete(False)

try:  # import the honeybee extension
    from honeybee.typing import clean_and_id_ep_string, clean_ep_string
except ImportError as e:
    raise ImportError('\nFailed to import honeybee:\n\t{}'.format(e))

try:  # import the honeybee-energy extension
    from honeybee_energy.load.process import Process
    from honeybee_energy.lib.schedules import schedule_by_identifier
except ImportError as e:
    raise ImportError('\nFailed to import honeybee_energy:\n\t{}'.format(e))

try:
    from ladybug_rhino.grasshopper import all_required_inputs, longest_list
except ImportError as e:
    raise ImportError('\nFailed to import ladybug_rhino:\n\t{}'.format(e))
    

if all_required_inputs(ghenv.Component):
    # duplicate the initial objects
    rooms = [room.duplicate() for room in _rooms]

    # set default values and check the inputs
    use_category_ = ['Moisture']
    fuel_type = ['None']
    radiant_fract_ = [0.0]
    latent_fract_ = [1]
    lost_fract_ = [0.0]
    for i, sched in enumerate(_schedule):
        if isinstance(sched, str):
            _schedule[i] = schedule_by_identifier(sched)

    # Convert moisture rate from g/h to W
    _watts = [moist / 3600 * 2250 for moist in _moisture_rate] # W
    
    # loop through the rooms and assign moisture loads
    for i, room in enumerate(rooms):
        load_watts = longest_list(_watts, i)
        if load_watts != 0:
            name = clean_and_id_ep_string('Process') if len(_name_) == 0 else \
                clean_ep_string(longest_list(_name_, i))
            process = Process(
                '{}..{}'.format(name, room.identifier), load_watts,
                longest_list(_schedule, i), longest_list(fuel_type, i),
                longest_list(use_category_, i), longest_list(radiant_fract_, i),
                longest_list(latent_fract_, i), longest_list(lost_fract_, i)
            )
            room.properties.energy.add_process_load(process)
# ---------- end moisturesource ----------

model = HBModel(rooms=flatten(moisturesource))  # -> report, model; plug-in component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

# ---- group: Run simulation
toggle = BooleanToggle(True)
simoutput = HBSimulationOutput(zone_energy_use=toggle, gains_and_losses=toggle, comfort_metrics=toggle, surface_energy_flow=toggle)  # -> report, sim_output; plug-in component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
simpar = HBSimulationParameter(output=simoutput.sim_output, timestep=Slider(20, range=0..100))  # -> sim_par; plug-in component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
number_of_years_to_simulate = Slider(2, range=1..10)
epw = FilePath("C:\Users\gzorzeto\OneDrive - ETH Zurich\01_PhD\01_Year\05_Hygrothermal_Model\EPWs\0_CHE_ZH_Zurich.Fluntern_UHI_Urban_High_Buffer_Auto_Present-day.epw")
path = FilePath("C:\Users\gzorzeto\Downloads\")
runhamt = RunHAMTSimulation(
    model=model.model,
    epw_file=epw,
    sim_par=simpar,
    folder=path,
    warmup_days="100",
    sim_years=number_of_years_to_simulate,
    write=falsestart,
    run=falsestart)  # -> report, jsons, osw, osm, idf, sql, zsz, rdd, html; inputs measures: list, add_str: list, warmup_days: Int32, sim_years: Int32, write: Boolean, run: Int32
# ---------- runhamt: Python ----------
"""
Write a honeybee Model to an OSM file (OpenStudio Model), which can then be 
translated with the necessary hygrothermal data to an IDF file in order to 
run EnergyPlus Combined Heat and Moisture Transfer (HAMT) model. This component
should be used in combination with the component "EditIDF", such that warmup days 
and multiyear simulations can be included in the IDF file. The final IDF file 
should be run through the component "RunIDF".
_
Note that this component automatically extract the relevant hygrothermal data from
the honeybee Model, such as moisture sources and hygrothermal material data. The 
HAMT model is only applied to surfaces that have constructions with hygrothermal
material properties. The default Conduction Transfer Function (CTF) solver is applied
to all remaining surfaces.

-
    Args:
        _model: A honeybee model object possessing all geometry and corresponding
            energy simulation properties.
        _epw_file: Path to an .epw file on this computer as a text string.
        _sim_par_: A honeybee Energy SimulationParameter object that describes all
            of the setting for the simulation. If None, some default simulation
            parameters will automatically be used. It is highly recommended that
            at least 20 timesteps per hours are used in HAMT simulations.
        measures_: An optional list of measures to apply to the OpenStudio model
            upon export. Use the "HB Load Measure" component to load a measure
            into Grasshopper and assign input arguments. Measures can be
            downloaded from the NREL Building Components Library (BCL) at
            (https://bcl.nrel.gov/).
        add_str_: THIS OPTION IS JUST FOR ADVANCED USERS OF ENERGYPLUS.
            You can input additional text strings here that you would like
            written into the IDF.  The input here should be complete EnergyPlus
            objects as a single string following the IDF format. This input can
            be used to write objects into the IDF that are not currently supported
            by Honeybee.
        _folder_: An optional folder on this computer, into which the IDF and result
            files will be written.
        _write: Set to "True" to write out the honeybee JSONs (containing the Honeybee
            Model and Simulation Parameters) and write the OpenStudio Model file (OSM).
            This process will also write either an EnergyPlus Input Data File (IDF)
            or an OpenStudio Workflow file (OSW), which can be used to run the
            model through EnergyPlus. Most models can be simulated with just
            and IDF and so no OWS will be written. However, an OSW will be used
            if any measures_ have been connected or if the simulation parameters
            contain an efficiency standard.
        run_: Set to "True" to translate the Honeybee jsons to an OpenStudio Model
            (.osm) and EnergyPlus Input Data File (.idf) and then simulate the
            .idf in EnergyPlus. This will ensure that all result files appear
            in their respective outputs from this component.
            _
            This input can also be the integer "2", which will run the whole translation
            and simulation silently (without any batch windows).

    Returns:
        report: Check here to see a report of the EnergyPlus run.
        jsons: The file paths to the honeybee JSON files that describe the Model and
            SimulationParameter. These will be translated to an OpenStudio model.
        osw: File path to the OpenStudio Workflow JSON on this machine (if necessary
            for simulation). This workflow is executed using the OpenStudio
            command line interface (CLI) and it includes any connected
            measures_. Will be None if no OSW is needed for the simulation.
        osm: The file path to the OpenStudio Model (OSM) that has been generated
            on this computer.
        idf: The file path of the EnergyPlus Input Data File (IDF) that has been
            generated on this computer.
        sql: The file path of the SQL result file that has been generated on this
            computer. This will be None unless run_ is set to True.
        zsz: Path to a .csv file containing detailed zone load information recorded
            over the course of the design days. This will be None unless run_ is
            set to True.
        rdd: The file path of the Result Data Dictionary (.rdd) file that is
            generated after running the file through EnergyPlus.  This file
            contains all possible outputs that can be requested from the EnergyPlus
            model. Use the "HB Read Result Dictionary" component to see what outputs
            can be requested.
        html: The HTML file path containing all requested Summary Reports.
"""

ghenv.Component.Name = 'Run HAMT Simulation'
ghenv.Component.NickName = 'RunHAMT'
ghenv.Component.Message = '0.0.1'
ghenv.Component.Category = 'Dewbee'

import os
import re
import json
import subprocess

# Turn off the "old" tag
import ghpythonlib as ghlib
c = ghlib.component._get_active_component()
c.ToggleObsolete(False)

# Import dewbee dependencies
from dewbee import utils
reload(utils)
from dewbee.utils import generate_hygro_idf, edit_idf

try:
    from ladybug.futil import preparedir, nukedir, copy_file_tree
    from ladybug.epw import EPW
    from ladybug.stat import STAT
except ImportError as e:
    raise ImportError('\nFailed to import ladybug:\n\t{}'.format(e))

try:
    from honeybee.config import folders
    from honeybee.model import Model
except ImportError as e:
    raise ImportError('\nFailed to import honeybee:\n\t{}'.format(e))

try:
    from honeybee_energy.simulation.parameter import SimulationParameter
    from honeybee_energy.measure import Measure
    from honeybee_energy.run import to_openstudio_sim_folder, run_osw, run_idf, \
        output_energyplus_files, _parse_os_cli_failure
    from honeybee_energy.result.err import Err
    from honeybee_energy.config import folders as energy_folders
    from honeybee_energy.writer import generate_idf_string
except ImportError as e:
    raise ImportError('\nFailed to import honeybee_energy:\n\t{}'.format(e))

try:
    from honeybee_openstudio.openstudio import OSModel
except (ImportError, AssertionError):  # Openstudio C# bindings are not usable
    OSModel = None

try:
    from lbt_recipes.version import check_openstudio_version
except ImportError as e:
    raise ImportError('\nFailed to import lbt_recipes:\n\t{}'.format(e))

try:
    from ladybug_rhino.grasshopper import all_required_inputs, give_warning
    from ladybug_rhino.config import units_system
except ImportError as e:
    raise ImportError('\nFailed to import ladybug_rhino:\n\t{}'.format(e))

ROOM_COUNT_THRESH = 1000  # threshold at which the CLI is used for translation


def measures_to_folder(measures, sim_folder):
    osw_dict = {}  # dictionary that will be turned into the OSW JSON
    osw_dict['steps'] = []
    mea_folder = os.path.join(sim_folder, 'measures')
    # ensure measures are correctly ordered
    m_dict = {'ModelMeasure': [], 'EnergyPlusMeasure': [], 'ReportingMeasure': []}
    for measure in measures:
        assert isinstance(measure, Measure), 'Expected honeybee-energy Measure. ' \
            'Got {}.'.format(type(measure))
        m_dict[measure.type].append(measure)
    sorted_measures = m_dict['ModelMeasure'] + m_dict['EnergyPlusMeasure'] + \
        m_dict['ReportingMeasure']
    # add the measures and the measure paths to the OSW
    for measure in sorted_measures:
        measure.validate()  # ensure that all required arguments have values
        osw_dict['steps'].append(measure.to_osw_dict())  # add measure to workflow
        dest_folder = os.path.join(mea_folder, os.path.basename(measure.folder))
        copy_file_tree(measure.folder, dest_folder)
        test_dir = os.path.join(dest_folder, 'tests')
        if os.path.isdir(test_dir):
            nukedir(test_dir, rmdir=True)
    # write the dictionary to a workflow.osw
    osw_json = os.path.join(mea_folder, 'workflow.osw')
    try:
        with open(osw_json, 'w') as fp:
            json.dump(osw_dict, fp, indent=4)
    except UnicodeDecodeError:  # non-unicode character in the dictionary
        with open(osw_json, 'w') as fp:
            json.dump(osw_dict, fp, indent=4, ensure_ascii=False)
    return mea_folder


if all_required_inputs(ghenv.Component) and _write:
    # check the presence of openstudio and check that the version is compatible
    check_openstudio_version()
    assert isinstance(_model, Model), \
        'Expected Honeybee Model for _model input. Got {}.'.format(type(_model))

    # process the simulation parameters
    if _sim_par_ is None:
        sim_par = SimulationParameter()
        sim_par.output.add_zone_energy_use()
        sim_par.output.add_hvac_energy_use()
        sim_par.output.add_electricity_generation()
    else:
        sim_par = _sim_par_.duplicate()  # ensure input is not edited

    # assign design days from the DDY next to the EPW if there are None
    folder, epw_file_name = os.path.split(_epw_file)
    if len(sim_par.sizing_parameter.design_days) == 0:
        msg = None
        ddy_file = os.path.join(folder, epw_file_name.replace('.epw', '.ddy'))
        if os.path.isfile(ddy_file):
            try:
                sim_par.sizing_parameter.add_from_ddy_996_004(ddy_file)
            except AssertionError:
                pass
            if len(sim_par.sizing_parameter.design_days) == 0:
                msg = 'No ddy_file_ was input into the _sim_par_ sizing ' \
                    'parameters\n and no design days were found in the .ddy file '\
                    'next to the _epw_file.'
        else:
             msg = 'No ddy_file_ was input into the _sim_par_ sizing parameters\n' \
                'and no .ddy file was found next to the _epw_file.'
        if msg is not None:
            epw_obj = EPW(_epw_file)
            des_days = [epw_obj.approximate_design_day('WinterDesignDay'),
                        epw_obj.approximate_design_day('SummerDesignDay')]
            sim_par.sizing_parameter.design_days = des_days
            msg = msg + '\nDesign days were generated from the input _epw_file but this ' \
                '\nis not as accurate as design days from DDYs distributed with the EPW.'
            give_warning(ghenv.Component, msg)
            print(msg)
    if sim_par.sizing_parameter.climate_zone is None:
        stat_file = os.path.join(folder, epw_file_name.replace('.epw', '.stat'))
        if os.path.isfile(stat_file):
            stat_obj = STAT(stat_file)
            sim_par.sizing_parameter.climate_zone = stat_obj.ashrae_climate_zone

    # process the simulation folder name and the directory
    _folder_ = folders.default_simulation_folder if _folder_ is None else _folder_
    clean_name = re.sub(r'[^.A-Za-z0-9_-]', '_', _model.display_name)
    directory = os.path.join(_folder_, clean_name, 'openstudio')

    # delete any existing files in the directory and prepare it for simulation
    nukedir(directory, True)
    preparedir(directory)
    sch_directory = os.path.join(directory, 'schedules')
    preparedir(sch_directory)

    # write the model and simulation parameter to JSONs
    model_json = os.path.join(directory, '{}.hbjson'.format(clean_name))
    with open(model_json, 'wb') as fp:
        model_str = json.dumps(_model.to_dict(), ensure_ascii=False)
        fp.write(model_str.encode('utf-8'))
    sim_par_json = os.path.join(directory, 'simulation_parameter.json')
    with open(sim_par_json, 'w') as fp:
        json.dump(sim_par.to_dict(), fp)
    jsons = [model_json, sim_par_json]


# ------------------------------------------------------------------------------
    # Add hygrothermal objects as additional IDF strings
    idf_str, msg = generate_hygro_idf(_model)
    if msg:
        give_warning(ghenv.Component, msg)
    add_str_.append(idf_str)

    # Assign default values for edit_idf()
    warmup_days_ = 100 if warmup_days_ is None else warmup_days_
    sim_years_ = 1 if sim_years_ is None else sim_years_
# ------------------------------------------------------------------------------
    # Run the translation with IronPython
    add_str = '\n'.join(add_str_) if len(add_str_) != 0 and \
        add_str_[0] is not None else None
    osm, osw, idf = to_openstudio_sim_folder(
        _model, directory, epw_file=_epw_file, sim_par=sim_par,
        schedule_directory=sch_directory, enforce_rooms=True,
        additional_measures=measures_, strings_to_inject=add_str)
    # ----------------------------------------------------------------------
    # Edit idf to include warmup days and multiple years to simulation
    idf = edit_idf(idf, warmup_days_, sim_years_)
    # ----------------------------------------------------------------------

    if run_ > 0:
        silent = True if run_ > 1 else False
        if idf is not None:  # run the IDF directly through E+
            sql, zsz, rdd, html, err = run_idf(idf, _epw_file, silent=silent)
        else:
            osm, idf = run_osw(osw, measures_only=False, silent=silent)
            if idf is None or not os.path.isfile(idf):
                _parse_os_cli_failure(directory)
            sql, zsz, rdd, html, err = output_energyplus_files(os.path.dirname(idf))

    # parse the error log and report any warnings
    if run_ >= 1 and err is not None:
        err_obj = Err(err)
        print(err_obj.file_contents)
        for warn in err_obj.severe_errors:
            give_warning(ghenv.Component, warn)
        for error in err_obj.fatal_errors:
            raise Exception(error)
# ---------- end runhamt ----------

# ----
hygrofaces = FacesByHygroType(hb_objs=flatten(model.model))  # -> hygro_faces, non_hygro_faces; inputs hb_objs: list
# ---------- hygrofaces: Python ----------
"""
Get faces that will be run with HAMT (hygro_faces) and those that will be run with
regular CTF simulations (non_hygro_faces). Note that this can include both Face 
and InternalMass objects.
-

    Args:
        _hb_objs: An array of honeybee Models, Rooms or Faces objects to be
            separated into hygro and non hygro faces.

    Returns:
        hygro_faces: Honeybee objects that contain fully characterized hygrothermal 
        constructions and will be used in the HAMT simulations.
        non_hygro_faces: Honeybee objects that do NOT contain fully characterized 
        hygrothermal constructions and will NOT be used in the HAMT simulations.
"""

ghenv.Component.Name = 'Faces by HygroType'
ghenv.Component.NickName = 'HygroFaces'
ghenv.Component.Message = '0.0.1'
ghenv.Component.Category = 'Dewbee'

# Turn off the "old" tag
import ghpythonlib as ghlib
c = ghlib.component._get_active_component()
c.ToggleObsolete(False)

# Import dewbee dependencies
from dewbee import utils
reload(utils)
from dewbee.utils import construction_ishygro
from ladybug_rhino.grasshopper import all_required_inputs
from honeybee.model import Model
from honeybee.room import Room
from honeybee.face import Face

if all_required_inputs(ghenv.Component):
    faces = []
    for hb_obj in _hb_objs:
        if isinstance(hb_obj, Model):
            for room in hb_obj.rooms:
                faces.extend(room.faces)
                for mass in room.properties.energy.internal_masses:
                    faces.append(mass)
            faces.extend(hb_obj.orphaned_faces)
        elif isinstance(hb_obj, Room):
            faces.extend(hb_obj.faces)
            for mass in hb_obj.properties.energy.internal_masses:
                faces.append(mass)
        elif isinstance(hb_obj, Face):
            faces.append(hb_obj)
        else:
            msg = 'Expected Face, Room or Model. Got {}.'.format(type(hb_obj))
            raise TypeError(msg)

    # Separate into hygro and non-hygro
    hygro_faces = []
    non_hygro_faces = []
    for face in faces:
        construction = (
        # Fallback for InternalMass object
            face.construction if hasattr(face, 'construction')
            else face.properties.energy.construction
        )
        if construction_ishygro(construction):
            hygro_faces.append(face)
        else:
            non_hygro_faces.append(face)
# ---------- end hygrofaces ----------
# Finish visualization!
python = GhPythonScript(x=hygrofaces.non_hygro_faces)  # -> out, a; inputs x: list
# ---------- python: Python ----------
from ladybug_rhino.fromgeometry import from_face3ds_to_colored_mesh
from ladybug.color import Colorset
a = []
palette = Colorset.openstudio_palette()
for face in x:
    a.append(face.geometry)
a = from_face3ds_to_colored_mesh(a, palette[2])
# ---------- end python ----------

# ---- group: Read results
number_slider = Slider(2, range=1..3)
multiyearroomenergyresult = ReadRoomEnergyResultForMultipleYears(sql=runhamt.sql, year=number_slider)  # -> cooling, heating, lighting, electric_equip, gas_equip, process, hot_water, fan_electric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; inputs year: Int32
# ---------- multiyearroomenergyresult: Python ----------
"""
Parse all of the common Room-level comfort-related results per simulated year
from an SQL result file that has been generated from an energy simulation.
_
Note that this component only works in Windows, with hourly data for periods 
longer than 1 year.

-
    Args:
        _sql: The file path of the SQL result file that has been generated from
            an energy simulation.

    Returns:
        cooling: DataCollections for the cooling energy in kWh. For Ideal Air
            loads, this output is the sum of sensible and latent heat that must
            be removed from each room.  For detailed HVAC systems, this output
            will be electric energy needed to power each chiller/cooling coil.
        heating: DataCollections for the heating energy needed in kWh. For Ideal
            Air loads, this is the heat that must be added to each room.  For
            detailed HVAC systems, this will be fuel energy or electric energy
            needed for each boiler/heating element.
        lighting: DataCollections for the electric lighting energy used for
            each room in kWh.
        electric_equip: DataCollections for the electric equipment energy used
            for each room in kWh.
        gas_equip: DataCollections for the gas equipment energy used for each
            room in kWh.
        process: DataCollections for the process load energy used for each
            room in kWh.
        hot_water: DataCollections for the service hote water energy used for each
            room in kWh.
        fan_electric: DataCollections for the fan electric energy in kWh for
            either a ventilation fan or a HVAC system fan.
        pump_electric: DataCollections for the water pump electric energy in kWh
            for a heating/cooling system.
        people_gain: DataCollections for the internal heat gains in each room
            resulting from people (kWh).
        solar_gain: DataCollections for the total solar gain in each room (kWh).
        infiltration_load: DataCollections for the heat loss (negative) or heat
            gain (positive) in each room resulting from infiltration (kWh).
        mech_vent_load: DataCollections for the heat loss (negative) or heat gain
            (positive) in each room resulting from the outdoor air coming through
            the HVAC System (kWh).
        nat_vent_load: DataCollections for the heat loss (negative) or heat gain
            (positive) in each room resulting from natural ventilation (kWh).
"""

ghenv.Component.Name = 'Read Room Energy Result for Multiple Years'
ghenv.Component.NickName = 'MultiyearRoomEnergyResult'
ghenv.Component.Message = '0.0.1'
ghenv.Component.Category = 'Dewbee'

import os
import subprocess
import json

# Turn off the "old" tag
import ghpythonlib as ghlib
c = ghlib.component._get_active_component()
c.ToggleObsolete(False)

# Import dewbee dependencies
from dewbee import multiyear_sql
reload(multiyear_sql)
from dewbee.multiyear_sql import MultiYearSQLiteResult

try:
    from ladybug_rhino.grasshopper import all_required_inputs
except ImportError as e:
    raise ImportError('\nFailed to import ladybug_rhino:\n\t{}'.format(e))

try:
    from ladybug.sql import SQLiteResult
    from ladybug.datacollection import HourlyContinuousCollection, \
        MonthlyCollection, DailyCollection
except ImportError as e:
    raise ImportError('\nFailed to import ladybug:\n\t{}'.format(e))

try:
    from honeybee.config import folders
except ImportError as e:
    raise ImportError('\nFailed to import honeybee:\n\t{}'.format(e))

try:
    from honeybee_energy.result.loadbalance import LoadBalance
except ImportError as e:
    raise ImportError('\nFailed to import honeybee_energy:\n\t{}'.format(e))

try:
    from ladybug_rhino.grasshopper import all_required_inputs
except ImportError as e:
    raise ImportError('\nFailed to import ladybug_rhino:\n\t{}'.format(e))

def subtract_loss_from_gain(gain_load, loss_load):
    """Create a single DataCollection from gains and losses."""
    total_loads = []
    for gain, loss in zip(gain_load, loss_load):
        total_load = gain - loss
        total_load.header.metadata['type'] = \
            total_load.header.metadata['type'].replace('Gain ', '')
        total_loads.append(total_load)
    return total_loads

# List of all the output strings that will be requested
cooling_outputs = LoadBalance.COOLING + (
    'Cooling Coil Electricity Energy',
    'Chiller Electricity Energy',
    'Zone VRF Air Terminal Cooling Electricity Energy',
    'VRF Heat Pump Cooling Electricity Energy',
    'Chiller Heater System Cooling Electricity Energy',
    'District Cooling Water Energy',
    'Evaporative Cooler Electricity Energy')
heating_outputs = LoadBalance.HEATING + (
    'Boiler NaturalGas Energy',
    'Heating Coil Total Heating Energy',
    'Heating Coil NaturalGas Energy',
    'Heating Coil Electricity Energy',
    'Humidifier Electricity Energy',
    'Zone VRF Air Terminal Heating Electricity Energy',
    'VRF Heat Pump Heating Electricity Energy',
    'VRF Heat Pump Defrost Electricity Energy',
    'VRF Heat Pump Crankcase Heater Electricity Energy',
    'Chiller Heater System Heating Electricity Energy',
    'District Heating Water Energy',
    'Baseboard Electricity Energy',
    'Hot_Water_Loop_Central_Air_Source_Heat_Pump Electricity Consumption',
    'Boiler Electricity Energy',
    'Water Heater NaturalGas Energy',
    'Water Heater Electricity Energy',
    'Cooling Coil Water Heating Electricity Energy')
lighting_outputs = LoadBalance.LIGHTING
electric_equip_outputs = LoadBalance.ELECTRIC_EQUIP
gas_equip_outputs = LoadBalance.GAS_EQUIP
process_outputs = LoadBalance.PROCESS
shw_outputs = ('Water Use Equipment Heating Energy',) + LoadBalance.HOT_WATER
fan_electric_outputs = (
    'Zone Ventilation Fan Electricity Energy',
    'Fan Electricity Energy',
    'Cooling Tower Fan Electricity Energy')
pump_electric_outputs = 'Pump Electricity Energy'
people_gain_outputs = LoadBalance.PEOPLE_GAIN
solar_gain_outputs = LoadBalance.SOLAR_GAIN
infil_gain_outputs = LoadBalance.INFIL_GAIN
infil_loss_outputs = LoadBalance.INFIL_LOSS
vent_loss_outputs = LoadBalance.VENT_LOSS
vent_gain_outputs = LoadBalance.VENT_GAIN
nat_vent_gain_outputs = LoadBalance.NAT_VENT_GAIN
nat_vent_loss_outputs = LoadBalance.NAT_VENT_LOSS
all_output = \
[cooling_outputs, heating_outputs, lighting_outputs, electric_equip_outputs, gas_equip_outputs,
 process_outputs, shw_outputs, fan_electric_outputs, pump_electric_outputs,
 people_gain_outputs, solar_gain_outputs, infil_gain_outputs, infil_loss_outputs,
 vent_loss_outputs, vent_gain_outputs, nat_vent_gain_outputs, nat_vent_loss_outputs]

if all_required_inputs(ghenv.Component):
    assert os.path.isfile(_sql), 'No sql file found at: {}.'.format(_sql)
    # Only works for windows
    if os.name == 'nt':
        sql_obj = MultiYearSQLiteResult(_sql)  # create the SQL result parsing object
        
        # get all of the results relevant for energy use
        cooling = sql_obj.data_collections_by_output_name_and_year(cooling_outputs, _year)
        heating = sql_obj.data_collections_by_output_name_and_year(heating_outputs, _year)
        lighting = sql_obj.data_collections_by_output_name_and_year(lighting_outputs, _year)
        electric_equip = sql_obj.data_collections_by_output_name_and_year(electric_equip_outputs, _year)
        hot_water = sql_obj.data_collections_by_output_name_and_year(shw_outputs, _year)
        gas_equip = sql_obj.data_collections_by_output_name_and_year(gas_equip_outputs, _year)
        process = sql_obj.data_collections_by_output_name_and_year(process_outputs, _year)
        fan_electric = sql_obj.data_collections_by_output_name_and_year(fan_electric_outputs, _year)
        pump_electric = sql_obj.data_collections_by_output_name_and_year(pump_electric_outputs, _year)

        # get all of the results relevant for gains and losses
        people_gain = sql_obj.data_collections_by_output_name_and_year(people_gain_outputs, _year)
        solar_gain = sql_obj.data_collections_by_output_name_and_year(solar_gain_outputs, _year)
        infil_gain = sql_obj.data_collections_by_output_name_and_year(infil_gain_outputs, _year)
        infil_loss = sql_obj.data_collections_by_output_name_and_year(infil_loss_outputs, _year)
        vent_loss = sql_obj.data_collections_by_output_name_and_year(vent_loss_outputs, _year)
        vent_gain = sql_obj.data_collections_by_output_name_and_year(vent_gain_outputs, _year)
        nat_vent_gain = sql_obj.data_collections_by_output_name_and_year(nat_vent_gain_outputs, _year)
        nat_vent_loss = sql_obj.data_collections_by_output_name_and_year(nat_vent_loss_outputs, _year)
    else:
        raise ValueError("Sorry all, this still does not work for Mac :(")        

    # do arithmetic with any of the gain/loss data collections
    if len(infil_gain) == len(infil_loss):
        infiltration_load = subtract_loss_from_gain(infil_gain, infil_loss)
    if len(vent_gain) == len(vent_loss) == len(cooling) == len(heating):
        mech_vent_loss = subtract_loss_from_gain(heating, vent_loss)
        mech_vent_gain = subtract_loss_from_gain(cooling, vent_gain)
        mech_vent_load = [data.duplicate() for data in
                          subtract_loss_from_gain(mech_vent_gain, mech_vent_loss)]
        for load in mech_vent_load:
            load.header.metadata['type'] = \
                'Zone Ideal Loads Ventilation Heat Energy'
    if len(nat_vent_gain) == len(nat_vent_loss):
        nat_vent_load = subtract_loss_from_gain(nat_vent_gain, nat_vent_loss)

    # remove the district hot water system used for service hot water from space heating
    shw_equip, distr_i = [], None
    for i, heat in enumerate(heating):
        if not isinstance(heat, float):
            try:
                heat_equip = heat.header.metadata['System']
                if heat_equip.startswith('SHW'):
                    shw_equip.append(i)
                elif heat_equip == 'SERVICE HOT WATER DISTRICT HEAT':
                    distr_i = i
            except KeyError:
                pass
    if len(shw_equip) != 0 and distr_i is None:
        hot_water = [heating.pop(i) for i in reversed(shw_equip)]
    elif distr_i is not None:
        for i in reversed(shw_equip + [distr_i]):
            heating.pop(i)
# ---------- end multiyearroomenergyresult ----------
multiyearroomcomfortresult = ReadRoomComfortResultForMultipleYears(sql=runhamt.sql, year=number_slider)  # -> out, oper_temp, rad_temp, rel_humidity, unmet_heat, unmet_cool; inputs year: Int32
# ---------- multiyearroomcomfortresult: Python ----------
"""
Parse all of the common Room-level comfort-related results per simulated year
from an SQL result file that has been generated from an energy simulation.
_
Note that this component only works in Windows, with hourly data for periods 
longer than 1 year.

-
    Args:
        _sql: The file path of the SQL result file that has been generated from
            an energy simulation.
    
    Returns:
        oper_temp: DataCollections for the mean operative temperature of each room (C).
        air_temp: DataCollections for the mean air temperature of each room (C).
        rad_temp: DataCollections for the mean radiant temperature of each room (C).
        rel_humidity: DataCollections for the relative humidity of each room (%).
        unmet_heat: DataCollections for time that the heating setpoint is not met
            in each room (hours).
        unmet_cool: DataCollections for time that the cooling setpoint is not met
            in each room (hours).
"""

ghenv.Component.Name = 'Read Room Comfort Result for Multiple Years'
ghenv.Component.NickName = 'MultiyearRoomComfortResult'
ghenv.Component.Message = '0.0.1'
ghenv.Component.Category = 'Dewbee'

import os
import subprocess
import json

# Turn off the "old" tag
import ghpythonlib as ghlib
c = ghlib.component._get_active_component()
c.ToggleObsolete(False)

# Import dewbee dependencies
from dewbee import multiyear_sql
reload(multiyear_sql)
from dewbee.multiyear_sql import MultiYearSQLiteResult

try:
    from ladybug_rhino.grasshopper import all_required_inputs
except ImportError as e:
    raise ImportError('\nFailed to import ladybug_rhino:\n\t{}'.format(e))


# List of all the output strings that will be requested
oper_temp_output = 'Zone Operative Temperature'
air_temp_output = 'Zone Mean Air Temperature'
rad_temp_output = 'Zone Mean Radiant Temperature'
rel_humidity_output = 'Zone Air Relative Humidity'
heat_setpt_output = 'Zone Heating Setpoint Not Met Time'
cool_setpt_output = 'Zone Cooling Setpoint Not Met Time'
all_output = [
    oper_temp_output, air_temp_output, rad_temp_output,
    rel_humidity_output, heat_setpt_output, cool_setpt_output
]


if all_required_inputs(ghenv.Component):
    # check the size of the SQL file to see if we should use the CLI
    assert os.path.isfile(_sql), 'No sql file found at: {}.'.format(_sql)
    if os.name == 'nt':
        # small file on windows; use IronPython like usual
        sql_obj = MultiYearSQLiteResult(_sql)  # create the SQL result parsing object
        # get all of the results
        oper_temp = sql_obj.data_collections_by_output_name_and_year(oper_temp_output, _year)
        air_temp = sql_obj.data_collections_by_output_name_and_year(air_temp_output, _year)
        rad_temp = sql_obj.data_collections_by_output_name_and_year(rad_temp_output, _year)
        rel_humidity = sql_obj.data_collections_by_output_name_and_year(rel_humidity_output, _year)
        unmet_heat = sql_obj.data_collections_by_output_name_and_year(heat_setpt_output, _year)
        unmet_cool = sql_obj.data_collections_by_output_name_and_year(cool_setpt_output, _year)
# ---------- end multiyearroomcomfortresult ----------
